# Grasshopper definition TerminalAutomation_Updated_WebApp.ghx (Grasshopper 1.0.8)
# plug-ins: Pufferfish, Wombat, AirportPlanning

# ---- group: International Profile
checked_bag = Slider(30, range=10..100)
online_check_in = Slider(30, range=10..100)
peak_arrival_time_before_flight_min = Panel("120")
male = Slider(70, range=10..100)

# ---- group: Domestic Profile
# Passenger Profiles
online_check_in_2 = Slider(30, range=10..100)
checked_bag_2 = Slider(30, range=10..100)
peak_arrival_time_before_flight_min_2 = Panel("90")
male_2 = Slider(70, range=10..100)

# ---- group: Spatial Inputs
level_of_service = ValueList({"A", "B", "C", "D", "E", "F"}, selected="C")
boundary_dimensions_x = Slider(261, range=50..350)
boundary_dimensionsy = Slider(40, range=10..100)
# Facility Specific Inputs
no_of_entry_gates = Slider(4, range=2..30)
facility_inputs_legacy_level_of_service = GetString(level_of_service, {"A", "B", "C", "D", "E", "F"}, selected=[], AtLeast=1, AtMost=1, TreeAccess=False)

# ----
no_of_boarding_gates = Slider(50, range=2..100)

passenger_load_factor = Slider(70, range=10..100)
gate_utilization = Slider(80, range=10..100)
seating_islands_per_gate = Slider(15, range=2..50)
gate_show_up_rate = Slider(80, range=10..100)
seat_provision = Slider(60, range=10..100)
turnaround_time_min = Panel("60")
critical_aircraft_capacity = Panel("180")

security_staffing_percentage = Slider(80, range=0..100)
offset_from_emigration = Slider(2, range=2..10)
security_points = Slider(24, range=10..50)

# ---- group: Spatial Inputs
toggle = BooleanToggle(True)
avg_processing_min = Panel("2.5")
check_in_counters = Slider(140, range=60..150)

# ---- group: Spatial Inputs / Check In
config_b_max_counters_in_line = Panel("15")
list = ValueList({"Config A:Perpendicular to Movement", "Config B:Parallel to Movement"}, selected="Config B:Parallel to Movement")
config_a_max_counters_in_line = Panel("40")

# ---- group: Spatial Inputs / E-Gates
offset_from_check_in = Slider(2, range=2..10)
e_gates = Slider(35, range=10..100)
toggle_2 = BooleanToggle(True)

# ---- group: Spatial Inputs / Immigration Counters
emigration_counters = Slider(30, range=10..50)
emigration_staffing_percentage = Slider(80, range=0..100)
offset_from_e_gates = Slider(2, range=2..10)
toggle_3 = BooleanToggle(True)

# ---- group: Planning Inputs
p_domestic = Slider(60, range=0..100)
p_departing = Slider(70, range=20..100)
p_using_checkin = Slider(80, range=20..80)

# ----
# Planning Inputs
annual_pax_million = Slider(30, range=1..50)

domestic_passenger_profile_peak_arrival = GetString(peak_arrival_time_before_flight_min_2, AtLeast=1, AtMost=1, TreeAccess=False)  # "{Domestic Passenger Profile} Peak Arrival Time Before Flight (min)"
domestic_passenger_profile_checked_bag = GetInteger(checked_bag_2, AtLeast=1, AtMost=1, Maximum=100, Minimum=10, TreeAccess=False)
domestic_passenger_profile_online_check = GetInteger(online_check_in_2, AtLeast=1, AtMost=1, Maximum=100, Minimum=10, TreeAccess=False)  # "{Domestic Passenger Profile} Online Check In (%)"
domestic_passenger_profile_male = GetInteger(male_2, AtLeast=1, AtMost=1, Maximum=100, Minimum=10, TreeAccess=False)
division = Division(A=domestic_passenger_profile_checked_bag, B="100")
division_2 = Division(A=domestic_passenger_profile_online_check, B="100")
division_3 = Division(A=domestic_passenger_profile_male, B="100")

# ---- group: Spatial Inputs
spatial_inputs_no_of_entry_gates = GetInteger(no_of_entry_gates, AtLeast=1, AtMost=1, Maximum=30, Minimum=2, TreeAccess=False)
spatial_inputs_boundary_dimensions_x = GetInteger(boundary_dimensions_x, AtLeast=1, AtMost=1, Maximum=350, Minimum=50, TreeAccess=False)
spatial_inputs_boundary_dimensions_y = GetInteger(boundary_dimensionsy, AtLeast=1, AtMost=1, Maximum=100, Minimum=10, TreeAccess=False)

# ----
international_passenger_profile_peak_arr = GetString(peak_arrival_time_before_flight_min, AtLeast=1, AtMost=1, TreeAccess=False)  # "{International Passenger Profile} Peak Arrival Time Before Flight (min)"
international_passenger_profile_checked = GetInteger(checked_bag, AtLeast=1, AtMost=1, Maximum=100, Minimum=10, TreeAccess=False)  # "{International Passenger Profile} Checked Bag (%)"
international_passenger_profile_online_c = GetInteger(online_check_in, AtLeast=1, AtMost=1, Maximum=100, Minimum=10, TreeAccess=False)  # "{International Passenger Profile} Online Check In (%)"
international_passenger_profile_male = GetInteger(male, AtLeast=1, AtMost=1, Maximum=100, Minimum=10, TreeAccess=False)
division_4 = Division(A=international_passenger_profile_checked, B="100")
division_5 = Division(A=international_passenger_profile_male, B="100")
division_6 = Division(A=international_passenger_profile_online_c, B="100")

# ---- group: Spatial Inputs / Check-In Inputs
check_in_inputs_total_check_in_counters = GetBoolean(
    toggle,
    AtLeast=1,
    AtMost=1,
    FalseValue="Optimize Manually",
    TreeAccess=False,
    TrueValue="Optimize Counters Automatically")  # "{Check In Inputs} Total Check In Counters Optimise Boolean"
check_in_inputs_avg_process_time_min_for = GetString(avg_processing_min, AtLeast=1, AtMost=1, TreeAccess=False)  # "{Check In Inputs} Avg.Process time (min) for Check-In"
check_in_inputs_total_check_in_counters_2 = GetInteger(check_in_counters, AtLeast=1, AtMost=1, Maximum=150, Minimum=60, TreeAccess=False)

# ----
emigration_inputs_total_emigration_count = GetInteger(emigration_counters, AtLeast=1, AtMost=1, Maximum=100, Minimum=10, TreeAccess=False)  # "{Emigration Inputs} Total Emigration Counters"
emigration_inputs_emigration_staffing_pe = GetInteger(emigration_staffing_percentage, AtLeast=1, AtMost=1, Maximum=100, Minimum=10, TreeAccess=False)  # "{Emigration Inputs} Emigration Staffing Percentage"
emigration_inputs_check_in_inputs_total = GetBoolean(
    toggle_3,
    AtLeast=1,
    AtMost=1,
    FalseValue="Optimize Manually",
    TreeAccess=False,
    TrueValue="Optimize Counters Automatically")  # "{Emigration Inputs} {Check In Inputs} Total Emigration Counters Optimise Boolean"
emigration_inputs_immigration_offset_fro = GetInteger(offset_from_e_gates, AtLeast=1, AtMost=1, Maximum=100, Minimum=10, TreeAccess=False)  # "{Emigration Inputs}Immigration Offset from E-Gates (m)"

security_inputs_total_security_lanes = GetInteger(security_points, AtLeast=1, AtMost=1, Maximum=100, Minimum=10, TreeAccess=False)
security_inputs_security_staffing_percen = GetBoolean(
    Toggle(True),
    AtLeast=1,
    AtMost=1,
    FalseValue="Optimize Manually",
    TreeAccess=False,
    TrueValue="Optimize Counters Automatically")  # "{Security Inputs} Security Staffing Percentage"
security_inputs_security_offset_from_emi = GetInteger(offset_from_emigration, AtLeast=1, AtMost=1, Maximum=100, Minimum=10, TreeAccess=False)  # "{Security Inputs} Security Offset from Emigration counters (m)"
security_inputs_total_security_lanes_opt = GetInteger(security_staffing_percentage, AtLeast=1, AtMost=1, Maximum=100, Minimum=10, TreeAccess=False)  # "{Security Inputs} } Total Security Lanes Optimise Boolean"

# ---- group: Spatial Inputs
check_in_inputs_orientation_of_check_in = GetString(
    list,
    {"Config A:Perpendicular to Movement", "Config B:Parallel to Movement"}, selected=[],
    AtLeast=1,
    AtMost=1,
    Prompt="Select Configuration for the Check In counters",
    TreeAccess=False)  # "{Check In Inputs} Orientation of Check In Counters"
check_in_inputs_max_counters_in_a_row = GetInteger(config_a_max_counters_in_line, AtLeast=1, AtMost=1, Maximum=50, Minimum=15, TreeAccess=False)
check_in_inputs_max_counters_in_a_column = GetInteger(config_b_max_counters_in_line, AtLeast=1, AtMost=1, Maximum=50, Minimum=5, TreeAccess=False)  # "{Check In Inputs} Max. Counters in a Columns"

# ----
e_gates_inputs_total_e_gates = GetInteger(e_gates, AtLeast=1, AtMost=1, Maximum=100, Minimum=10, TreeAccess=False)
e_gates_inputs_optimised_e_gates = GetBoolean(
    toggle_2,
    AtLeast=1,
    AtMost=1,
    FalseValue="Optimize Manually",
    TreeAccess=False,
    TrueValue="Optimize Counters Automatically")
e_gates_inputs_offset_from_check_in_m = GetInteger(offset_from_check_in, AtLeast=1, AtMost=1, Maximum=100, Minimum=10, TreeAccess=False)

boarding_inputs_gate_utilization = GetInteger(gate_utilization, AtLeast=1, AtMost=1, Maximum=100, Minimum=10, TreeAccess=False)
boarding_inputs_critical_aircraft_capaci = GetString(critical_aircraft_capacity, AtLeast=1, AtMost=1, TreeAccess=False)  # "{Boarding Inputs} Critical Aircraft Capacity"
boarding_inputs_passenger_load_capacity = GetInteger(passenger_load_factor, AtLeast=1, AtMost=1, Maximum=100, Minimum=10, TreeAccess=False)
boarding_inputs_turnaround_time_min = GetString(turnaround_time_min, AtLeast=1, AtMost=1, TreeAccess=False)
boarding_inputs_gate_show_up_rate = GetInteger(gate_show_up_rate, AtLeast=1, AtMost=1, Maximum=100, Minimum=10, TreeAccess=False)
boarding_inputs_optimise_boarding_gates = GetBoolean(
    Toggle(True),
    AtLeast=1,
    AtMost=1,
    FalseValue="Optimize Manually",
    TreeAccess=False,
    TrueValue="Optimize Counters Automatically")
boarding_inputs_seating_islands_per_gate = GetInteger(seating_islands_per_gate, AtLeast=1, AtMost=1, Maximum=100, Minimum=10, TreeAccess=False)
boarding_inputs_seating_islands_per_gate_2 = GetInteger(no_of_boarding_gates, AtLeast=1, AtMost=1, Maximum=100, Minimum=10, TreeAccess=False)
boarding_inputs_seat_provision = GetInteger(seat_provision, AtLeast=1, AtMost=1, Maximum=100, Minimum=10, TreeAccess=False)
boarding_inputs_optimise_seating_per_gat = GetBoolean(
    Toggle(True),
    AtLeast=1,
    AtMost=1,
    FalseValue="Optimize Manually",
    TreeAccess=False,
    TrueValue="Optimize Counters Automatically")  # "{Boarding Inputs} Optimise Seating Per Gate"
division_7 = Division(A=boarding_inputs_passenger_load_capacity, B="100")
division_8 = Division(A=boarding_inputs_gate_utilization, B="100")
division_9 = Division(A=boarding_inputs_gate_show_up_rate, B="100")
division_10 = Division(A=boarding_inputs_seat_provision, B="100")

# ---- group: Planning Inputs
planning_inputs_passengers_using_check_i = GetInteger(p_using_checkin, AtLeast=1, AtMost=1, Maximum=80, Minimum=20, TreeAccess=False)  # "{Planning Inputs} Passengers Using Check-In (%)"
planning_inputs_annual_pax_million = GetInteger(annual_pax_million, AtLeast=1, AtMost=1, Maximum=50, Minimum=1, TreeAccess=False)
planning_inputs_passenger_departing = GetInteger(p_departing, AtLeast=1, AtMost=1, Maximum=100, Minimum=10, TreeAccess=False)

# ----
planning_inputs_domestic_passenger = GetInteger(p_domestic, AtLeast=1, AtMost=1, Maximum=100, Minimum=10, TreeAccess=False)
panel = Panel("""Config A:Perpendicular to Movement
Config B:Parallel to Movement""")
index = ItemIndex(List=panel, Item=panel)
everything_except_check_in_area_m2 = Panel("""1.4
1.2
1.0
0.8
0.6
0.5""")
panel_2 = Panel("""A
B
C
D
E
F""")
wait_ciculatearea_m2 = Panel("""10
12
20
25
30
1000""")
wait_ciculatearea_m2_2 = Panel("""2.7
2.3
1.9
1.5
1.0
1.0""")
check_in_area_m2 = Panel("""1.6
1.4
1.2
1.0
0.8
0.5""")
security_screening_and_immigration_min = Panel("""5
7.5
10
20
30
45""")
num = Number(check_in_inputs_avg_process_time_min_for)
index_2 = ItemIndex(List=wait_ciculatearea_m2, Item=wait_ciculatearea_m2)
list_2 = ValueList({"Domestic": 0, "International": 1}, selected="Domestic")
list_3 = ValueList({"Origin": 0, "Transfer": 1, "Destination": 2}, selected="Origin")
list_4 = ValueList({"Domestic": 0, "International": 1}, selected="International")
list_5 = ValueList({"Origin": 0, "Transfer": 1, "Destination": 2}, selected="Origin")
ap = ArrivalProfile(Peak=domestic_passenger_profile_peak_arrival, Sigma="20")
ap_2 = ArrivalProfile(Peak=international_passenger_profile_peak_arr, Sigma="30")
check_in_area_min = Panel("""5
10
20
30
45
100""")
random_seed = Panel("5")
wp = WalkingProfile(AverageSpeed="1.35", StandardDeviation="1")
division_11 = Division(A=planning_inputs_domestic_passenger, B="100")
pp = PassengerProfile(
    Name="Domestic Economy",
    Percentage=Slider(100, range=0..100),
    PassengerType=list_2,
    Journey=list_3,
    OnlineCheckInProbability=division_2,
    CheckedBagProbability=division,
    ServiceTimeMultiplier=1,
    MaleProbability=division_3,
    ArrivalProfile=ap)
pp_2 = PassengerProfile(
    Name="International Leisure",
    Percentage=Slider(100, range=0..100),
    PassengerType=list_4,
    Journey=list_5,
    OnlineCheckInProbability=division_6,
    CheckedBagProbability=division_4,
    ServiceTimeMultiplier=1,
    MaleProbability=division_5,
    ArrivalProfile=ap_2)
avg_processing_min_2 = Panel("2.5")
min_passenger = Panel("1.5")
target_wait_min = Panel("20")
staffing = Slider(100, range=0..100)
optimize_counters = BooleanToggle(True)
sp = ServiceProfile(MeanServiceTime=avg_processing_min_2, StandardDeviation=min_passenger)
min_passenger_2 = Panel("0.5")
avg_processing_min_3 = Panel("1.5")
tmatch = MatchText(Text=facility_inputs_legacy_level_of_service, Pattern=panel_2, Case=True)
sp_2 = ServiceProfile(MeanServiceTime=avg_processing_min_3, StandardDeviation=min_passenger_2)
index_3 = ItemIndex(List=panel_2, Item=panel_2)
dispatch = Dispatch(List=index_3, DispatchPattern=tmatch)  # -> ListA, ListB
item = ListItem(List=panel_2, Index=dispatch.ListA, Wrap=True)
item_2 = ListItem(List=everything_except_check_in_area_m2, Index=dispatch.ListA, Wrap=True)
item_3 = ListItem(List=security_screening_and_immigration_min, Index=dispatch.ListA, Wrap=True)
item_4 = ListItem(List=check_in_area_m2, Index=dispatch.ListA, Wrap=True)
item_5 = ListItem(List=wait_ciculatearea_m2_2, Index=dispatch.ListA, Wrap=True)
item_6 = ListItem(List=wait_ciculatearea_m2, Index=dispatch.ListA, Wrap=True)
target_wait_min_2 = Panel("10")
staffing_2 = Slider(100, range=0..100)
optimize_counters_2 = BooleanToggle(True)
xy = XYPlane(Origin="0,0,0")
from_facility = ValueList({"CheckIn", "BagDrop", "Immigration", "Security"}, selected="CheckIn")
from_facility_2 = ValueList({"CheckIn", "BagDrop", "Immigration", "Security"}, selected="BagDrop")
eligible = Slider(100, range=0..100)

dom = ConstructDomain(DomainStart=0, DomainEnd=spatial_inputs_boundary_dimensions_x)
dom_2 = ConstructDomain(DomainStart=0, DomainEnd=spatial_inputs_boundary_dimensions_y)
rectangle = Rectangle(Plane=xy, XSize=dom, YSize=dom_2, Radius=0)  # -> Rectangle, Length
disc = Discontinuity(Curve=rectangle.Rectangle, Level=1)  # -> Points, Parameters
shatter = Shatter(Curve=rectangle.Rectangle, Parameters=disc.Parameters)
item_7 = ListItem(List=shatter, Index=0, Wrap=True)  # -> Item2, Item1, Item
offset = OffsetCurve(Curve=rectangle.Rectangle, Distance=expr("-x/2", "0.4"), Corners=1)
range = Range(Domain=Domain(0, 1), Steps=expr("x*2", spatial_inputs_no_of_entry_gates))
crv = Curve(item_7.Item2)
boundary = BoundarySurfaces(Edges=flatten([offset, rectangle.Rectangle]))
dispatch_2 = Dispatch(List=range, DispatchPattern=[True, False])  # -> ListA, ListB
eval = EvaluateCurve(Curve=reparameterize(crv), Parameter=dispatch_2.ListB)  # -> Point, Tangent, Angle

e_gate = Mesh(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)
brec = BoundingRectangle(Geometry=e_gate, Plane=PlaneXY(0, 0, 0), Axis=0, Slide=0, Union=True)  # -> Bounding, DimensionX, DimensionY
tmatch_2 = MatchText(Text=check_in_inputs_orientation_of_check_in, Pattern=panel, Case=True)
debrep = DeconstructBrep(Brep=brec.Bounding)  # -> Faces, Edges, Vertices
item_8 = ListItem(List=debrep.Vertices, Index=0, Wrap=True)
dispatch_3 = Dispatch(List=index, DispatchPattern=tmatch_2)  # -> ListA, ListB
from_facility_3 = ValueList({"CheckIn", "BagDrop", "Immigration", "Security"}, selected="BagDrop")
from_facility_4 = ValueList({"CheckIn", "BagDrop", "Immigration", "Security"}, selected="Immigration")
filter = StreamFilter(Gate=dispatch_3.ListA, Stream0=check_in_inputs_max_counters_in_a_row, Stream1=check_in_inputs_max_counters_in_a_column)
avg_processing_min_4 = Panel("0.5")
min_passenger_3 = Panel("0.25")
target_wait_min_3 = Panel("10")
sp_3 = ServiceProfile(MeanServiceTime=avg_processing_min_4, StandardDeviation=min_passenger_3)
c_bake = ContextBake(BoundaryInput_48_83_227_100=boundary)
emigration_counter = Mesh([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])
avg_processing_min_5 = Panel("0.25")
min_passenger_4 = Panel("0.1")

panel_3 = Panel("Block 01")
panel_4 = Panel("Block 02")

brec_2 = BoundingRectangle(Geometry=emigration_counter, Plane=PlaneXY(0, 0, 0), Axis=0, Slide=0, Union=True)  # -> Bounding, DimensionX, DimensionY
mirror = Mirror(Geometry=emigration_counter, Plane=PlaneYZ(0, 0, 0))  # -> Geometry, Transform
sort_pt = SortPoints(Points=eval.Point)  # -> Points, Indices

dom_3 = ConstructDomain(DomainStart=expr("-x", "0"), DomainEnd="6")
dom_4 = ConstructDomain(DomainStart=expr("-x", "6"), DomainEnd="6")
X = UnitX(Factor=1)
rectangle_2 = Rectangle(Plane=sort_pt.Points, XSize=dom_4, YSize=dom_3, Radius=0)  # -> Rectangle, Length
area = Area(Geometry=rectangle_2.Rectangle)  # -> Area, Centroid
X_2 = UnitX(Factor=expr("-x", "6"))
srf = Surface(rectangle_2.Rectangle)
move = Move(Geometry=area.Centroid, Motion=X_2)  # -> Geometry, Transform
line = LineSDL(Start=move.Geometry, Direction=X, Length=expr("x*2", "6"))

mesh = Mesh(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)
sp_4 = ServiceProfile(MeanServiceTime=avg_processing_min_5, StandardDeviation=min_passenger_4)
mesh_2 = Mesh(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)
addition = Addition(A="0", B="1.2")
geo = Geometry([emigration_counter, mirror.Geometry])
index_4 = ItemIndex(List=sort_pt.Points, Item=sort_pt.Points)
multiplication = Multiplication(A=brec_2.DimensionX, B="1.05")
target_wait_min_4 = Panel("10")
_2checkin_module = Curve(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)
addition_2 = Addition(A=index_4, B="1")
concat = Concatenate(FragmentA="Gate ", FragmentB=addition_2)
multiplication_2 = Multiplication(A="10", B="2")
brec_3 = BoundingRectangle(Geometry=rectangle.Rectangle, Plane=PlaneXY(0, 0, 0), Axis=0, Slide=0, Union=True)  # -> Bounding, DimensionX, DimensionY
multiplication_3 = Multiplication(A="20", B="2")

expression = Expression(x=planning_inputs_annual_pax_million, Expression="0.002*(1/x^(1/2))")
multiplication_4 = Multiplication(A=planning_inputs_annual_pax_million, B="1000000")
multiplication_5 = Multiplication(A=expression, B=multiplication_4)
roundf = RoundToFactor(NumberX=multiplication_5, Factor="200", RoundType=0)  # -> Rounded, Difference, MultiplierR, MultiplierX
dhp = Integer(roundf.Rounded)

pd = PassengerDemand(
    DesignHourDemand=dhp,
    DeparturePercentage=planning_inputs_passenger_departing,
    DomesticPercentage=planning_inputs_domestic_passenger)
pg = PassengerGenerator(
    PassengerDemand=pd,
    DomesticProfiles=pp,
    InternationalProfiles=pp_2,
    DepartureMinute="800",
    SimulationHorizon="300",
    WalkingProfile=wp,
    RandomSeed=random_seed)  # -> Passengers, PassengerGenerationResult, ArrivalSimulations
pdt = PassengerDetails(Passengers=pg.Passengers)  # -> PassengerID, ArrivalTime, ServiceTime, StartService, EndService, WaitingTime, AssignedCounter, WalkingSpeed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
chk = CheckIn(
    Passengers=pg.Passengers,
    ServiceProfile=sp,
    CheckInCounters=check_in_inputs_total_check_in_counters_2,
    OptimizeCounters=optimize_counters,
    TargetWait=target_wait_min,
    StaffingPercentage=staffing,
    RandomSeed=random_seed)  # -> Passengers, CheckInPassengers, QueueResults, CountersUsed, PeakQueueLength, AverageWait, MaximumWait, _95thPercentileWait, CounterUtilization
filter_2 = StreamFilter(
    Gate=check_in_inputs_total_check_in_counters,
    Stream0=check_in_inputs_total_check_in_counters_2,
    Stream1=chk.CountersUsed)
panel_5 = Panel(pdt.ArrivalTime)
qs = QueueStatistics(QueueResults=chk.QueueResults)  # -> AverageWait, MaximumWait, _95thPercentileWait, PeakQueueLength, ResourceUtilization
filter_3 = PassengerFilter(Passengers=chk.Passengers)  # -> Domestic, International, Male, Female, CheckedBags, CabinBagOnly
bd = BagDrop(
    Passengers=chk.Passengers,
    ServiceProfile=sp_2,
    BagDropCounters=8,
    OptimizeCounters=optimize_counters_2,
    TargetWait=target_wait_min_2,
    StaffingPercentage=staffing_2,
    RandomSeed=random_seed)  # -> Passengers, QueueResults, PhysicalCounters

list_6 = ValueList({"CheckIn": 0, "BagDrop": 1, "Security": 2, "Immigration": 3, "Verification": 4}, selected="BagDrop")
list_7 = ValueList({"Island", "Linear", "Retrofit"}, selected="Linear")
division_12 = Division(B="2")
tpl = FacilityTemplate(FacilityType=list_6, TopologyOverride=list_7)  # -> Template, AvailableTopologies
std = FacilityStandards(
    FacilityType=list_6,
    QueueAreaPax=Slider(1.3, range=1.3..1.8),
    ProcessorWidth=division_12,
    ProcessorDepth=2,
    ProcessorPitch=division_12,
    Circulation=25,
    Support=10)
size = FacilitySizer(OperationalResults=bd.QueueResults, Passengers=bd.Passengers, Standards=std, Template=tpl.Template)  # -> SizingResult, TotalArea, QueueArea, ProcessingArea, CirculationArea, Topology, Advice, EquipmentNames, EquipmentCounts
panel_6 = Panel(size.TotalArea)

wlk = Walking(Passengers=bd.Passengers, Distance="50", WalkingSpeed=wp, FromFacility=from_facility, ToFacility=from_facility_2)
ver = PassengerVerification(Passengers=wlk, EligiblePercentage=eligible, ThroughputPerGate=300, DesignUtilization=0.85)  # -> Passengers, VerificationResults, RequiredGates, EligiblePassengers

# ---- group: Passenger Verification
list_8 = ValueList({"CheckIn": 0, "BagDrop": 1, "Security": 2, "Immigration": 3, "Verification": 4}, selected="Verification")
list_9 = ValueList({"Island", "Linear", "Flow-Through"}, selected="Flow-Through")
tpl_2 = FacilityTemplate(FacilityType=list_8)  # -> Template, AvailableTopologies
std_2 = FacilityStandards(
    FacilityType=list_8,
    QueueAreaPax=item_2,
    ProcessorWidth=brec.DimensionX,
    ProcessorDepth=brec.DimensionY,
    ProcessorPitch=brec.DimensionX,
    Circulation=25,
    Support=10)
panel_7 = Panel(tpl_2.AvailableTopologies)
size_2 = FacilitySizer(
    OperationalResults=ver.VerificationResults,
    Passengers=ver.Passengers,
    Standards=std_2,
    Template=tpl_2.Template,
    PhysicalCountOverride=e_gates_inputs_total_e_gates)  # -> SizingResult, TotalArea, QueueArea, ProcessingArea, CirculationArea, Topology, Advice, EquipmentNames, EquipmentCounts

# ----
wlk_2 = Walking(Passengers=ver.Passengers, Distance="50", WalkingSpeed=wp, FromFacility=from_facility_3, ToFacility=from_facility_4)
filter_4 = PassengerFilter(Passengers=wlk_2)  # -> Domestic, International, Male, Female, CheckedBags, CabinBagOnly
imm = Immigration(
    Passengers=filter_4.International,
    ServiceProfile=sp_3,
    ImmigrationBooths=emigration_inputs_total_emigration_count,
    OptimizeBooths=emigration_inputs_check_in_inputs_total,
    TargetWait=item_3,
    StaffingPercentage=emigration_inputs_emigration_staffing_pe,
    RandomSeed=random_seed)  # -> Passengers, QueueResults, PhysicalBooths
merge = Merge(Data1=flatten(filter_4.Domestic), Data2=flatten(imm.Passengers))
pdt_2 = PassengerDetails(Passengers=imm.Passengers)  # -> PassengerID, ArrivalTime, ServiceTime, StartService, EndService, WaitingTime, AssignedCounter, WalkingSpeed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
panel_8 = Panel(size_2.Advice)
filter_5 = StreamFilter(Gate=e_gates_inputs_optimised_e_gates, Stream0=e_gates_inputs_total_e_gates, Stream1=ver.RequiredGates)
panel_9 = Panel(pdt_2.ArrivalTime)
sec = Security(
    Passengers=merge,
    ServiceProfile=sp_4,
    SecurityLanes=security_inputs_total_security_lanes,
    OptimizeLanes=Toggle(True),
    TargetWait=item_3,
    StaffingPercentage=security_inputs_total_security_lanes_opt,
    RandomSeed=random_seed)  # -> Passengers, QueueResults, PhysicalLanes

list_10 = ValueList({"CheckIn": 0, "BagDrop": 1, "Security": 2, "Immigration": 3, "Verification": 4}, selected="Immigration")
list_11 = ValueList({"Linear": "Linear ", "Staggered", "E-Gate Bank"}, selected="Staggered")
tpl_3 = FacilityTemplate(FacilityType=list_10, TopologyOverride=list_11)  # -> Template, AvailableTopologies
std_3 = FacilityStandards(
    FacilityType=list_10,
    QueueAreaPax=item_2,
    ProcessorWidth=multiplication,
    ProcessorDepth=brec_2.DimensionY,
    ProcessorPitch=brec_2.DimensionX,
    Circulation=25,
    Support=10)
size_3 = FacilitySizer(
    OperationalResults=imm.QueueResults,
    Passengers=imm.Passengers,
    Standards=std_3,
    Template=tpl_3.Template,
    PhysicalCountOverride=emigration_inputs_total_emigration_count)  # -> SizingResult, TotalArea, QueueArea, ProcessingArea, CirculationArea, Topology, Advice, EquipmentNames, EquipmentCounts

pdt_3 = PassengerDetails(Passengers=sec.Passengers)  # -> PassengerID, ArrivalTime, ServiceTime, StartService, EndService, simplify(WaitingTime), AssignedCounter, WalkingSpeed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
pdt_4 = PassengerDetails(Passengers=sec.Passengers)  # -> PassengerID, ArrivalTime, ServiceTime, StartService, EndService, WaitingTime, AssignedCounter, WalkingSpeed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
qs_2 = QueueStatistics(QueueResults=sec.QueueResults)  # -> AverageWait, MaximumWait, _95thPercentileWait, PeakQueueLength, ResourceUtilization
subtraction = Subtraction(A=brec_3.DimensionX, B=multiplication_3)
subtraction_2 = Subtraction(A=brec_3.DimensionY, B=multiplication_2)
area_2 = Area(Geometry=brec_3.Bounding)  # -> Area, Centroid
x_ray_machine = Mesh(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)
wtmd_machine = Mesh(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)
X_3 = UnitX(Factor="1.2")
division_13 = Division(A=subtraction, B=brec_3.DimensionX)
division_14 = Division(A=subtraction_2, B=brec_3.DimensionY)
Z = UnitZ(Factor="0.1")
brec_4 = BoundingRectangle(Geometry=wtmd_machine, Plane=PlaneXY(0, 0, 0), Axis=0, Slide=0, Union=True)  # -> Bounding, DimensionX, DimensionY
brec_5 = BoundingRectangle(Geometry=x_ray_machine, Plane=PlaneXY(0, 0, 0), Axis=0, Slide=0, Union=True)  # -> Bounding, DimensionX, DimensionY
panel_10 = Panel(pdt_4.EndService)
scale_nu = ScaleNU(Geometry=brec_3.Bounding, Plane=area_2.Centroid, ScaleX=division_13, ScaleY=division_14, ScaleZ=1)  # -> Geometry, Transform
panel_11 = Panel(pdt_3.WaitingTime)
integer_division = IntegerDivision(A=filter_2, B=filter)

brec_6 = BoundingRectangle(Geometry=rectangle.Rectangle, Plane=PlaneXY(0, 0, 0), Axis=0, Slide=0, Union=True)  # -> Bounding, DimensionX, DimensionY
brec_7 = BoundingRectangle(Geometry=_2checkin_module, Plane=PlaneXY(0, 0, 0), Axis=0, Slide=0, Union=True)  # -> Bounding, DimensionX, DimensionY
series = Series(Start=0, Step=brec_7.DimensionX, Count=expr("x/2", filter_2))
division_15 = Division(A=filter_2, B="2")
round = Round(Number=division_15)  # -> Nearest, Floor, Ceiling
division_16 = Division(A=division_15, B=integer_division)
round_2 = Round(Number=division_16)  # -> Nearest, Floor, Ceiling
division_17 = Division(A=brec_6.DimensionX, B=integer_division)
int = Integer(division_17)
range_2 = Range(Domain=Domain(0, 1), Steps=expr("x-1", integer_division))  # -> expr("x", Range)
series_2 = Series(Start=0, Step=int, Count=integer_division)

list_12 = ValueList({"Island", "Linear", "Flow-Through"}, selected="Island")
list_13 = ValueList({"CheckIn": 0, "BagDrop": 1, "Security": 2, "Immigration": 3}, selected="CheckIn")
division_18 = Division(A=brec_7.DimensionX, B="2")
tpl_4 = FacilityTemplate(FacilityType=list_13, TopologyOverride=list_12)  # -> Template, AvailableTopologies
std_4 = FacilityStandards(
    FacilityType=list_13,
    QueueAreaPax=item_4,
    ProcessorWidth=division_18,
    ProcessorDepth=brec_7.DimensionY,
    ProcessorPitch=division_18,
    Circulation=25,
    Support=10)
size_4 = FacilitySizer(
    OperationalResults=chk.QueueResults,
    Passengers=chk.Passengers,
    Standards=std_4,
    Template=tpl_4.Template,
    PhysicalCountOverride=check_in_inputs_total_check_in_counters_2)  # -> SizingResult, TotalArea, QueueArea, ProcessingArea, CirculationArea, Topology, Advice, EquipmentNames, EquipmentCounts
panel_12 = Panel(size_4.QueueArea)

disc_2 = Discontinuity(Curve=brec_6.Bounding, Level=1)  # -> Points, Parameters
shatter_2 = Shatter(Curve=brec_6.Bounding, Parameters=disc_2.Parameters)
item_9 = ListItem(List=shatter_2, Index=0, Wrap=True)  # -> Item1, Item, Item1_2, Item2
crv_2 = Curve(item_9.Item)

Y = UnitY(Factor=expr("-x", e_gates_inputs_offset_from_check_in_m))
dim = Dimensions(Surface=scale_nu.Geometry)  # -> UDimension, VDimension
addition_3 = Addition(A=brec_4.DimensionX, B=Slider(0.75, range=0..1))
explode = Explode(Curve=scale_nu.Geometry, Recursive=True)  # -> Segments, Vertices
drec = DeconstructRectangle(Rectangle=scale_nu.Geometry)  # -> BasePlane, XInterval, YInterval
multiplication_6 = Multiplication(A=multiplication, B="2")
multiplication_7 = Multiplication(A=addition_3, B="2.2")
addition_4 = Addition(A=brec_5.DimensionX, B=multiplication_7)
division_19 = Division(A=brec_7.DimensionX, B="2")
X_4 = UnitX(Factor=multiplication_6)
division_20 = Division(A=dim.VDimension, B=division_19)
multiplication_8 = Multiplication(A=integer_division, B=round_2.Ceiling)
round_3 = Round(Number=division_20)  # -> Nearest, Floor, Ceiling
item_10 = ListItem(List=explode.Segments, Index=0, Wrap=True)  # -> Item, Item1, Item2
division_21 = Division(A=brec_7.DimensionX, B="2")

divide = DivideCurve(Curve=crv_2, Count=integer_division, Kinks=False)  # -> Points, Tangents, Parameters
item_11 = ListItem(List=divide.Points, Index=0, Wrap=True)
cull_ends = CullEnds(List=divide.Points)  # -> List, Culled
cp = ClosestPoint(Point=eval.Point, Cloud=cull_ends.List)  # -> ClosestPoint, CPIndex, Distance
ln = Line(StartPoint=eval.Point, EndPoint=cp.ClosestPoint)

arrlinear = LinearArray(Geometry=geo, Direction=X_4, Count=expr("x/2", imm.PhysicalBooths))  # -> Geometry, Transform
repeat = RepeatData(Data=round_2.Ceiling, Length=integer_division)

number_slider = Slider(1.2, range=0.2..1.2)
list_14 = ValueList({"CheckIn": 0, "BagDrop": 1, "Security": 2, "Immigration": 3, "Verification": 4}, selected="Security")
list_15 = ValueList({"Centralized", "Decentralized"}, selected="Centralized")
tpl_5 = FacilityTemplate(FacilityType=list_14, TopologyOverride=list_15)  # -> Template, AvailableTopologies
std_5 = FacilityStandards(
    FacilityType=list_14,
    QueueAreaPax=item_2,
    ProcessorWidth=addition_4,
    ProcessorDepth=brec_5.DimensionY,
    ProcessorPitch=multiplication_7,
    Circulation="10",
    Support=10)
size_5 = FacilitySizer(
    OperationalResults=sec.QueueResults,
    Passengers=sec.Passengers,
    Standards=std_5,
    Template=tpl_5.Template,
    PhysicalCountOverride=security_inputs_total_security_lanes)  # -> SizingResult, TotalArea, QueueArea, ProcessingArea, CirculationArea, Topology, simplify(Advice), flatten(EquipmentNames), flatten(EquipmentCounts)
filter_6 = PassengerFilter(Passengers=sec.Passengers)  # -> Domestic, International, Male, Female, CheckedBags, CabinBagOnly

subtraction_3 = Subtraction(A=multiplication_8, B=round.Nearest)
min = Minimum(A=round_3.Nearest, B=filter)
brec_8 = BoundingRectangle(Geometry=flatten(arrlinear.Geometry), Plane=PlaneXY(0, 0, 0), Axis=0, Slide=0, Union=True)  # -> Bounding, DimensionX, DimensionY
c_script = CSharpScript(values=repeat, remainder=subtraction_3)  # -> out, result, a; inputs values: list of Int32, remainder: Int32
# ---------- c_script: C# ----------
// Grasshopper Script Instance
#region Usings
using System;
using System.Linq;
using System.Collections;
using System.Collections.Generic;
using System.Drawing;

using Rhino;
using Rhino.Geometry;

using Grasshopper;
using Grasshopper.Kernel;
using Grasshopper.Kernel.Data;
using Grasshopper.Kernel.Types;
#endregion

public class Script_Instance : GH_ScriptInstance
{
    #region Notes
    /* 
      Members:
        RhinoDoc RhinoDocument
        GH_Document GrasshopperDocument
        IGH_Component Component
        int Iteration

      Methods (Virtual & overridable):
        Print(string text)
        Print(string format, params object[] args)
        Reflect(object obj)
        Reflect(object obj, string method_name)
    */
    #endregion

    private void RunScript(
		List<int> values,
		int remainder,
		ref object result,
		ref object a)
{
    if (values == null || values.Count == 0)
    {
        result = new List<int>();
        return;
    }

    int n = values.Count;

    // If remainder is 0 or negative, just return the original list
    if (remainder <= 0)
    {
        result = new List<int>(values);
        return;
    }

    // If remainder is larger than n, we can only subtract 1 from each element at most
    // (for a -1 distribution). If you want to allow subtracting more than 1 per element,
    // adjust the logic accordingly.
    int countSmaller = remainder % n;        // how many elements get -1
    int extra = remainder / n;               // how many full units we can subtract from each

    // Base smaller value = original - 1 - extra
    // Larger value = original - extra
    // But we'll assume remainder < n and extra = 0 for the simple case (each change is -1)

    if (extra == 0)
    {
        // Simple case: each of 'countSmaller' elements is reduced by 1
        int baseValue = values[0]; // assume all are equal
        int smaller = baseValue - 1;
        int larger = baseValue;
        

        List<int> list = new List<int>(n);

        // Alternate fairly: larger, smaller, larger, smaller, ...
        for (int i = 0; i < n; i++)
        {   int A=0;
            // Put smaller values at positions where i % 2 == 1, until we have enough
            if (i % 2 == 1 && countSmaller > 0 && A==1)
            {
                list.Add(smaller);
                countSmaller--;
                A=1;
            }
            else if (i % 2 == 0 && countSmaller > 0 && A==0)
            {
                // If we run out of odd positions, fill remaining smaller at even positions
                list.Add(smaller);
                countSmaller--;
                A=0;
            }
            else
            {
                list.Add(larger);
            }
        }

        result = list;
    }
    else
    {
        // More general case: subtract 'extra' from all, and then 1 more from 'countSmaller'
        int baseValue = values[0];
        int allSub = extra;
        int smaller = baseValue - allSub - 1;
        int larger = baseValue - allSub;

        List<int> list = new List<int>(n);

        for (int i = 0; i < n; i++)
        {
            if (i % 2 == 1 && countSmaller > 0)
            {
                list.Add(smaller);
                countSmaller--;
            }
            else if (countSmaller > 0)
            {
                list.Add(smaller);
                countSmaller--;
            }
            else
            {
                list.Add(larger);
            }
        }

        result = list;
    }
}
}
# ---------- end c_script ----------
multiplication_9 = Multiplication(A=min, B="2")
area_3 = Area(Geometry=brec_8.Bounding)  # -> Area, Centroid
merge_2 = Merge(
    Data1=flatten("Physical Desks: 118 | Staffed Desks: 118 (100%) | Demand/Capacity: 0.43"),
    Data2=flatten(qs.PeakQueueLength),
    Data3=flatten(qs.AverageWait),
    Data4=flatten(qs.MaximumWait),
    Data5=flatten(qs._95thPercentileWait))  # -> simplify(flatten(Result))
division_22 = Division(A=filter_2, B=multiplication_9)
round_4 = Round(Number=division_22)  # -> Nearest, Floor, Ceiling
item_12 = ListItem(List=merge_2, Index=0, Wrap=True)  # -> Item, Item1, Item2, Item3, Item4

# ---- group: Peak Queueing Area
area_for_ropes_corners = Panel("1.2")
multiplication_10 = Multiplication(A=item_12.Item1, B=item_4)
panel_13 = Panel(item_12.Item1)

# ----
num_2 = Number("100")
division_23 = Division(A=brec_7.DimensionX, B="2")
filter_7 = PassengerFilter(Passengers=filter_6.Domestic)  # -> Domestic, International, Male, Female, CheckedBags, CabinBagOnly
max = Maximum()
divide_2 = DivideCurve(Curve=item_10.Item2, Count=expr("x-1", round_4.Nearest), Kinks=False)  # -> reverse(Points), Tangents, Parameters
divide_3 = DivideCurve(Curve=item_10.Item, Count=expr("x-1", round_4.Nearest), Kinks=False)  # -> Points, Tangents, Parameters
Y_2 = UnitY(Factor=1)
multiplication_11 = Multiplication(A=min, B=division_23)
line_2 = LineSDL(Start=divide_2.Points, Direction=expr("-x", Y_2), Length=multiplication_11)
list_16 = ValueList({"CheckIn": 0, "BagDrop": 1, "Security": 2, "Immigration": 3, "Verification": 4, "Boarding": 5, "Retail": 6}, selected="Boarding")
list_17 = ValueList({"CheckIn": 0, "BagDrop": 1, "Security": 2, "Immigration": 3, "Verification": 4, "Boarding": 5, "Retail": 6}, selected="Retail")
list_18 = ValueList({"CheckIn": 0, "BagDrop": 1, "Security": 2, "Immigration": 3, "Verification": 4}, selected="Security")
list_19 = ValueList({"CheckIn": 0, "BagDrop": 1, "Security": 2, "Immigration": 3, "Verification": 4}, selected="Immigration")
list_20 = ValueList({"CheckIn": 0, "BagDrop": 1, "Security": 2, "Immigration": 3, "Verification": 4}, selected="Verification")
shift = ShiftList(List=divide_3.Parameters, Shift=1, Wrap=False)
report = FacilityReporter(
    FacilityType=list_18,
    OperationalResults=sec.QueueResults,
    SizingResult=size_5.SizingResult,
    TargetWait95=target_wait_min_4,
    BaselineCount=sec.PhysicalLanes)  # -> LevelOfService, ExecutiveSummary
report_2 = FacilityReporter(
    FacilityType=list_19,
    OperationalResults=imm.QueueResults,
    SizingResult=size_3.SizingResult,
    TargetWait95=item_3,
    BaselineCount=imm.PhysicalBooths)  # -> LevelOfService, ExecutiveSummary
report_3 = FacilityReporter(
    FacilityType=list_20,
    OperationalResults=ver.VerificationResults,
    SizingResult=size_2.SizingResult,
    TargetWait95=target_wait_min_3,
    BaselineCount=ver.RequiredGates)  # -> LevelOfService, ExecutiveSummary
offset_2 = OffsetCurve(Curve=line_2, Distance=expr("x/2", "3"), Corners=1)
offset_3 = OffsetCurve(Curve=line_2, Distance=expr("-x/2", "3"), Corners=1)
panel_14 = Panel(report.ExecutiveSummary)
c_print = ContextPrint(EmigrationSummary=report_2.ExecutiveSummary)
merge_3 = Merge(Data1=offset_3, Data2=offset_2)  # -> simplify(Result)
panel_15 = Panel(report_2.ExecutiveSummary)
panel_16 = Panel(report_3.ExecutiveSummary)
c_print_2 = ContextPrint(EGatesPassengerVerificationSummary=report_3.ExecutiveSummary)
flip = FlipCurve(Curve=offset_2)  # -> Curve, Flag
flip_2 = FlipCurve(Curve=offset_3)  # -> Curve, Flag
c_print_3 = ContextPrint(SecuritySummary=report.ExecutiveSummary)
divlength = DivideLength(Curve=flip_2.Curve, Length=expr("x/2", brec_7.DimensionX))  # -> Points, Tangents, Parameters
divlength_2 = DivideLength(Curve=flip.Curve, Length=expr("x/2", brec_7.DimensionX))  # -> Points, Tangents, Parameters
brec_9 = BoundingRectangle(Geometry=merge_3, Plane=PlaneXY(0, 0, 0), Axis=0, Slide=0, Union=True)  # -> Bounding, DimensionX, DimensionY
cull_i = CullIndex(List=divlength_2.Points, Indices=0, Wrap=True)
cull_i_2 = CullIndex(List=divlength.Points, Indices=0, Wrap=True)
flippln = FlipPlane(Plane=cull_i, FlipX=True, FlipY=True, FlipZ=True)  # -> Flipped, R
pflip = FlipPlane(Plane=cull_i_2, ReverseX=False, ReverseY=True, SwapAxes=True)
offset_4 = OffsetCurve(Curve=brec_9.Bounding, Distance=expr("-x/2", "1"), Corners=1)
dispatch_4 = Dispatch(List=pflip, DispatchPattern=[True, False])  # -> reverse(ListA), ListB
dispatch_5 = Dispatch(List=flippln.Flipped, DispatchPattern=[True, False])  # -> reverse(ListA), ListB
fillet = Fillet(Curve=offset_4, Radius=expr("x/2", "1"))
fillet_2 = Fillet(Curve=brec_9.Bounding, Radius="1")
X_5 = UnitX(Factor=expr("x/2", brec_7.DimensionX))
item_13 = ListItem(List=dispatch_5.ListA, Index=0, Wrap=True)  # -> Item1, Item
item_14 = ListItem(List=dispatch_4.ListA, Index=0, Wrap=True)  # -> Item1, Item
transform = Transform(Geometry=mesh, Transform=item_13.Item1)
transform_2 = Transform(Geometry=mesh, Transform=item_14.Item1)  # -> flatten(Geometry)
bbox = BoundingBox(Content=transform_2, Plane=PlaneXY(0, 0, 0))  # -> Box, Box_2
area_4 = Area(Geometry=bbox.Box)  # -> Area, Centroid
xz = XZPlane(Origin=area_4.Centroid)
Z_2 = UnitZ(Factor="0.17")
mirror_2 = Mirror(Geometry=transform_2, Plane=xz)  # -> Geometry, Transform
custom_mesh_settings = SettingsCustom(
    StitchSeams=True,
    SimplePlanes=True,
    Refine=False,
    MinCount=16,
    MaxCount=400,
    AspectRatio="1",
    MaxDistance=0,
    MaxAngle=20,
    MinEdge=0,
    MaxEdge=0)

merge_4 = Merge(Data1=fillet_2, Data2=fillet)  # -> flatten(Result)
area_5 = Area(Geometry=merge_4)  # -> Area, Centroid
scale = Scale(Geometry=merge_4, Center=area_5.Centroid, Factor="0.98")  # -> Geometry, Transform
boundary_2 = BoundarySurfaces(Edges=scale.Geometry)
transform_3 = Transform(Geometry=mesh_2, Transform=dispatch_4.ListB)
transform_4 = Transform(Geometry=mesh_2, Transform=dispatch_5.ListB)
xy_2 = XYPlane(Origin=Point(0, 0, 0))
extr = Extrude(Base=boundary_2, Direction=Z_2)
mirror_3 = Mirror(Geometry=transform_4, Plane=xy_2)  # -> Geometry, Transform
mesh_3 = MeshBrep(Brep=extr, Settings=custom_mesh_settings)

mirror_4 = Mirror(Geometry=transform, Plane=xy_2)  # -> Geometry, Transform
mirror_5 = Mirror(Geometry=mirror_4.Geometry, Plane=xz)  # -> Geometry, Transform
item_15 = ListItem(List=mirror_5.Geometry, Index=0, Wrap=True)
dwell = DwellTimeRetailBuffer(
    Passengers=sec.Passengers,
    DepartureMinute="800",
    GateOpenTime="50",
    GateCloseTime="15",
    PeakArrival="30",
    RandomSeed=random_seed)  # -> Passengers, AverageDwellTime
list_21 = ValueList({"CheckIn": 0, "BagDrop": 1, "Security": 2, "Immigration": 3, "Verification": 4, "Boarding": 5, "Retail": 6}, selected="Retail")
list_22 = ValueList({"CheckIn": 0, "BagDrop": 1, "Security": 2, "Immigration": 3, "Verification": 4, "Boarding": 5, "Retail": 6}, selected="Retail")

merge_5 = Merge(Data1=mirror_2.Geometry, Data2=item_15)
merge_6 = Merge(Data1=transform_3, Data2=mirror_3.Geometry)
lng = ListLength(List=flatten(merge_5))
lng_2 = ListLength(List=flatten(merge_6))  # -> expr("x*2", Length)
ma = MassAddition(Input=[lng, lng_2])  # -> Result, PartialResults
merge_7 = Merge(Data1=merge_5, Data2=merge_6)
subtraction_4 = Subtraction(A=ma.Result, B=filter_2)
min_counters = CSharpScript(x=subtraction_4)  # -> out, a; inputs x: Int32, y: Boolean
# ---------- min_counters: C# ----------
// Grasshopper Script Instance
#region Usings
using System;
using System.Linq;
using System.Collections;
using System.Collections.Generic;
using System.Drawing;

using Rhino;
using Rhino.Geometry;

using Grasshopper;
using Grasshopper.Kernel;
using Grasshopper.Kernel.Data;
using Grasshopper.Kernel.Types;
#endregion

public class Script_Instance : GH_ScriptInstance
{
    #region Notes
    /* 
      Members:
        RhinoDoc RhinoDocument
        GH_Document GrasshopperDocument
        IGH_Component Component
        int Iteration

      Methods (Virtual & overridable):
        Print(string text)
        Print(string format, params object[] args)
        Reflect(object obj)
        Reflect(object obj, string method_name)
    */
    #endregion

    private void RunScript(int x, bool y, ref object a)
    {
        if(x>0)
        a=$"You can reduce {x} counter";
        else if(x==0)
        a=$"The Configuration fits {x} counters";
        else 
        a=$"You need to add {Math.Abs(x)} counters";
    }
}
# ---------- end min_counters ----------

pdt_5 = PassengerDetails(Passengers=dwell.Passengers)  # -> PassengerID, ArrivalTime, ServiceTime, StartService, EndService, simplify(WaitingTime), AssignedCounter, WalkingSpeed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
tpl_6 = FacilityTemplate(FacilityType=list_21)  # -> Template, AvailableTopologies
std_6 = FacilityStandards(
    FacilityType=list_22,
    QueueAreaPax=1.2,
    ProcessorWidth=1.5,
    ProcessorDepth=2,
    ProcessorPitch=1.8,
    Circulation=25,
    Support=10)
num_3 = Number(dwell.AverageDwellTime)
size_6 = FacilitySizer(OperationalResults=num_3, Passengers=dwell.Passengers, Standards=std_6, Template=tpl_6.Template)  # -> SizingResult, TotalArea, QueueArea, ProcessingArea, CirculationArea, Topology, Advice, EquipmentNames, EquipmentCounts
report_4 = FacilityReporter(FacilityType=list_17, SizingResult=size_6.SizingResult, TargetWait95=10)  # -> LevelOfService, ExecutiveSummary
panel_17 = Panel(report_4.ExecutiveSummary)
c_print_4 = ContextPrint(RetailAreaSummary=report_4.ExecutiveSummary)
min_walk = CSharpScript(x=cp.Distance, y="75")  # -> out, b, a; inputs x: list of Int32, y: Int32
# ---------- min_walk: C# ----------
// Grasshopper Script Instance
#region Usings
using System;
using System.Linq;
using System.Collections;
using System.Collections.Generic;
using System.Drawing;

using Rhino;
using Rhino.Geometry;

using Grasshopper;
using Grasshopper.Kernel;
using Grasshopper.Kernel.Data;
using Grasshopper.Kernel.Types;
#endregion

public class Script_Instance : GH_ScriptInstance
{
    #region Notes
    /* 
      Members:
        RhinoDoc RhinoDocument
        GH_Document GrasshopperDocument
        IGH_Component Component
        int Iteration

      Methods (Virtual & overridable):
        Print(string text)
        Print(string format, params object[] args)
        Reflect(object obj)
        Reflect(object obj, string method_name)
    */
    #endregion

    private void RunScript(List<int> x, int y, ref object b, ref object a)
    {
        foreach(int l in x)
        {
        if(l<75)
        {a="Walk Distance from Entry to E-Gates is comfortable";
          b=1;}
        else 
        {a=$"Walking Distance from Entry to E-Gate {l}m is not comfortable";
         b=2; }
        }
    }
}
# ---------- end min_walk ----------
panel_18 = Panel(size_6.EquipmentNames)
item_16 = ListItem(List=min_walk.a, Index=0, Wrap=True)
panel_19 = Panel(size_6.EquipmentCounts)
panel_20 = Panel(item_16)
panel_21 = Panel(min_counters.a)
md_slider = MDSlider(
    SliderMode=0,
    slider_value=Point(0.502658751, 1, 0.5),
    x_domain=Domain(0, 1),
    y_domain=Domain(0, 1),
    z_domain=Domain(0, 1))
multiplication_12 = Multiplication(A=item_12.Item1, B=item_5)
division_24 = Division(A="100", B="100")
multiplication_13 = Multiplication(A=division_24, B=item_12.Item4)
smaller = SmallerThan(FirstNumber=multiplication_13, SecondNumber=wait_ciculatearea_m2)  # -> SmallerThan, OrEqualTo
dispatch_6 = Dispatch(List=index_2, DispatchPattern=smaller.SmallerThan)  # -> ListA, ListB
smaller_2 = SmallerThan(FirstNumber=multiplication_13, SecondNumber=item_6)  # -> SmallerThan, OrEqualTo
item_17 = ListItem(List=dispatch_6.ListA, Index=0, Wrap=True)
item_18 = ListItem(List=panel_2, Index=item_17, Wrap=True)

multiplication_14 = Multiplication(A=planning_inputs_passenger_departing, B=dhp, C="0.01")
avr = Average(Input=qs.ResourceUtilization)
multiplication_15 = Multiplication(A=multiplication_14, B=planning_inputs_passengers_using_check_i, C="0.01")
roundd = RoundToDecimalPlace(NumberX=avr, DecimalPlace="2", RoundType=2)  # -> Rounded, Difference
c_script_2 = CSharpScript(y=multiplication_13)  # -> out, a; inputs y: Double
# ---------- c_script_2: C# ----------
// Grasshopper Script Instance
#region Usings
using System;
using System.Linq;
using System.Collections;
using System.Collections.Generic;
using System.Drawing;

using Rhino;
using Rhino.Geometry;

using Grasshopper;
using Grasshopper.Kernel;
using Grasshopper.Kernel.Data;
using Grasshopper.Kernel.Types;
#endregion

public class Script_Instance : GH_ScriptInstance
{
    #region Notes
    /* 
      Members:
        RhinoDoc RhinoDocument
        GH_Document GrasshopperDocument
        IGH_Component Component
        int Iteration

      Methods (Virtual & overridable):
        Print(string text)
        Print(string format, params object[] args)
        Reflect(object obj)
        Reflect(object obj, string method_name)
    */
    #endregion

    private void RunScript(double y, ref object a)
    {
        string b;
        // Write your logic here
       
         if(y<10)
         b="A";
         else if(y<12)
         b="B";
         else if(y<20)
         b="C";
         else if(y<25)
         b="D";
         else if(y<30)
         b="E";
         else
         b="F";
        
        a=b;
    }
}
# ---------- end c_script_2 ----------

expression_2 = Expression(x=item, y=c_script_2.a, Expression="If(x=y, true, false)")
and = GateAnd(A=expression_2, B=smaller_2.SmallerThan)
filter_8 = StreamFilter(Gate=and, Stream0=item_18, Stream1=c_script_2.a)

concat_2 = Concatenate(FragmentA="Your desired LoS was ", FragmentB=item, FragmentC=",and you are successfully delivering it.")
concat_3 = Concatenate(FragmentA="Your desired LoS was ", FragmentB=item, FragmentC=",but you are delivering ", FragmentD=filter_8)

filter_9 = StreamFilter(Gate=and, Stream0=concat_3, Stream1=concat_2)
xy_3 = XYPlane(Origin=Point(0, 0, 0))
prot = RotatePlane(Plane=xy_3, Angle=degrees("90"))
tag_orientation = StreamFilter(Gate=dispatch_3.ListA, Stream0=xy_3, Stream1=prot)
c_script_3 = CSharpScript(x=multiplication_13, y=item_6)  # -> out, a; inputs x: Double, y: Double
# ---------- c_script_3: C# ----------
// Grasshopper Script Instance
#region Usings
using System;
using System.Linq;
using System.Collections;
using System.Collections.Generic;
using System.Drawing;

using Rhino;
using Rhino.Geometry;

using Grasshopper;
using Grasshopper.Kernel;
using Grasshopper.Kernel.Data;
using Grasshopper.Kernel.Types;
#endregion

public class Script_Instance : GH_ScriptInstance
{
    #region Notes
    /* 
      Members:
        RhinoDoc RhinoDocument
        GH_Document GrasshopperDocument
        IGH_Component Component
        int Iteration

      Methods (Virtual & overridable):
        Print(string text)
        Print(string format, params object[] args)
        Reflect(object obj)
        Reflect(object obj, string method_name)
    */
    #endregion

    private void RunScript(double x, double y, ref object a)
    {
    if (x < y/2)
         a= 1;
    else if (x < y) // here x is already >= 10
         a= 0;
    else
   a= 2;     // x >= 20
    }
    
}
# ---------- end c_script_3 ----------
int_2 = Integer(c_script_3.a)
over_design = ColourSwatch(SwatchColor=RGB(255, 83, 23))
sub_optimum = ColourSwatch(SwatchColor=RGB(255, 200, 61))
optimum = ColourSwatch(SwatchColor=RGB(43, 166, 53))
round_5 = Round(Number=item_12.Item2)  # -> Nearest, Floor, Ceiling
Z_3 = UnitZ(Factor=1)
filter_10 = StreamFilter(Gate=int_2, Stream0=optimum, Stream1=over_design, Stream2=sub_optimum)
panel_22 = Panel("""216,67,30
246,99,62
255,141,112
253,189,173""")
panel_23 = Panel("""3
4""")
concat_4 = Concatenate(FragmentC="[", FragmentA=filter_10, FragmentB="(200)", FragmentD="]")
mesh_4 = Mesh([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])
round_6 = Round(Number=multiplication_13)  # -> Nearest, Floor, Ceiling
filter_11 = StreamFilter(Gate=int_2, Stream0="Optimum", Stream1="Over-Designed", Stream2="Sub-Optimum")
lng_3 = ListLength(List=panel_23)
_95_percentile_wait_time_min = Panel(round_5.Floor)
peak_queue_length = Panel(item_12.Item1)
demand_capacity = Panel(item_12.Item)
concat_5 = Concatenate(FragmentA=panel_22, FragmentB="(150)")
_95_percentile_wait_time_min_2 = Panel(round_6.Ceiling)
panel_24 = Panel(concat_4)
repeat_2 = RepeatData(Data=mesh_4, Length=lng_3)
c_print_5 = ContextPrint(CheckInAreaColor=concat_4)
bbox_2 = BoundingBox(Content=repeat_2, Plane=PlaneXY(0, 0, 0))  # -> Box, Box_2
concat_6 = Concatenate(FragmentA="Peak Queue Length Combined", FragmentD=":", FragmentB=peak_queue_length)
concat_7 = Concatenate(FragmentA="95th Percentile Wait Time (min)", FragmentD=":", FragmentB=_95_percentile_wait_time_min_2)
concat_8 = Concatenate(FragmentA="Average Wait Time (min)", FragmentD=":", FragmentB=_95_percentile_wait_time_min)
concat_9 = Concatenate(FragmentC="Configuration of ", FragmentA=filter_2, FragmentD=" Counters is ", FragmentB=filter_11)
debrep_2 = DeconstructBrep(Brep=bbox_2.Box)  # -> Faces, Edges, Vertices
panel_25 = Panel("""A
B
C
D
E
F
G
H
I
J
K
L""")
item_19 = ListItem(List=debrep_2.Vertices, Index=0, Wrap=True)
yz = YZPlane(Origin=item_19)
mirror_6 = Mirror(Geometry=graft(repeat_2), Plane=yz)  # -> simplify(Geometry), Transform
panel_26 = Panel("1,0.5")
merge_8 = Merge(Data1=simplify(graft(repeat_2)), Data2=mirror_6.Geometry)
brec_10 = BoundingRectangle(Geometry=merge_8, Plane=PlaneXY(0, 0, 0), Axis=0, Slide=0, Union=True)  # -> Bounding, simplify(flatten(DimensionX)), simplify(DimensionY)
bang = ExplodeTree(Data=merge_8)  # -> Branch0, Branch1, Branch2
item_20 = ListItem(List=brec_10.DimensionX, Index=0, Wrap=True)
bang_2 = ExplodeTree(Data=brec_10.DimensionY)  # -> Branch0, Branch1, Branch2
group = Group(Geometry=bang.Branch1)
textsrf = TextOnSurface(Text=concat, Font="Sans Bold:no Italic:no", Height="1.5", Depth=0, BaseLine=line, BaseSurface=srf)  # -> flatten(Symbols)
move_2 = Move(Geometry=textsrf, Motion=Z)  # -> Geometry, Transform

c_bake_2 = ContextBake(Gates_48_83_227_100=srf)
c_bake_3 = ContextBake(Gates_46_61_122_255=move_2.Geometry)

cset = CreateSet(List=item_20)  # -> Set, Map
addition_5 = Addition(A=cset.Set, B="1.2")
addition_6 = Addition(A=bang_2.Branch1, B="1.5")
filter_12 = StreamFilter(Gate=0, Stream0="Over-Designed", Stream1="Optimum", Stream2="Sub-Optimum")
paramptinrec = ParameterPointInRectangle(Rectangle=rectangle.Rectangle, ParameterX=0.5, ParameterY=0.85)  # -> Point, Normal
filter_13 = StreamFilter(Gate=0, Stream0=over_design, Stream1=optimum, Stream2=sub_optimum)
Z_4 = UnitZ(Factor=0.1)
panel_27 = Panel("sq.m.This includes Queue Area, Circulation Area and Corridor Area")
pt = Point(paramptinrec.Point)
X_6 = UnitX(Factor=1)
line_3 = LineSDL(Start=pt, Direction=expr("-x*100", X_6), Length="500")
line_4 = LineSDL(Start=pt, Direction=X_6, Length="500")
concat_10 = Concatenate(FragmentA="*", FragmentB=filter_9, FragmentC="*")
join = JoinCurves(Curves=[line_4, line_3], Preserve=False)
flip_3 = FlipCurve(Curve=join)  # -> Curve, Flag
srf_2 = Surface(rectangle.Rectangle)
textsrf_2 = TextOnSurface(Text=filter_11, Font="Sans Bold:no Italic:no", Height=3, Depth=0, BaseLine=flip_3.Curve, BaseSurface=srf_2)
panel_28 = Panel(filter_2)
multiplication_16 = Multiplication(A=panel_28, B="2")
concat_11 = Concatenate(FragmentA="{", FragmentE="*", FragmentB=panel_28, FragmentF="*", FragmentC="}", FragmentD="[146, 172, 30]")
c_print_6 = ContextPrint(NoOfCountersInConfiguration=concat_11)

# ---- group: ARDM text
c_bake_4 = ContextBake(Counters_46_61_122_180=textsrf_2)

# ----
panel_29 = Panel(concat_11)
concat_12 = Concatenate(FragmentA="179, 57, 26", FragmentB="(150)")
concat_13 = Concatenate(FragmentA="117,144,255", FragmentB="(150)")

queuearea = Number(size_5.QueueArea)
circulationarea = Number(size_5.CirculationArea)
processingarea = Number(size_5.ProcessingArea)
multiplication_17 = Multiplication(A=queuearea, B=area_for_ropes_corners)
item_21 = ListItem(List=size_5.EquipmentNames, Index=0, Wrap=True)  # -> Item, Item1, Item2
item_22 = ListItem(List=size_5.EquipmentCounts, Index=0, Wrap=True)  # -> Item, Item1, Item2
panel_30 = Panel(item_21.Item)
panel_31 = Panel(item_21.Item1)
panel_32 = Panel(item_21.Item2)
division_25 = Division(A=item_22.Item, B=item_22.Item2)
division_26 = Division(A=item_22.Item, B=item_22.Item1)
round_7 = Round(Number=division_26)  # -> Nearest, Floor, Ceiling
round_8 = Round(Number=division_25)  # -> Nearest, Floor, Ceiling
addition_7 = Addition(A=round_7.Ceiling, B=round_8.Ceiling)
series_3 = Series(Start=0, Step=addition_3, Count=addition_7)
X_7 = UnitX(Factor=series_3)
move_3 = Move(Geometry=wtmd_machine, Motion=X_7)  # -> simplify(Geometry), Transform
merge_9 = Merge(Data1=simplify(x_ray_machine), Data2=simplify(move_3.Geometry))
brec_11 = BoundingRectangle(Geometry=flatten(merge_9), Plane=PlaneXY(0, 0, 0), Axis=0, Slide=0, Union=True)  # -> Bounding, flatten(DimensionX), DimensionY
multiplication_18 = Multiplication(A=multiplication_17, B=division_11)
multiplication_19 = Multiplication(A=circulationarea, B=division_11)
multiplication_20 = Multiplication(A=processingarea, B=division_11)
multiplication_21 = Multiplication(A=item_22.Item, B=division_11)
addition_8 = Addition(A=brec_11.DimensionX, B="0")  # -> simplify(Result)
group_2 = Group(Geometry=flatten(merge_9))
area_6 = Area(Geometry=brec_11.Bounding)  # -> Area, Centroid
subtraction_5 = Subtraction(A=item_22.Item, B=multiplication_21)
subtraction_6 = Subtraction(A=multiplication_17, B=multiplication_18)
subtraction_7 = Subtraction(A=circulationarea, B=multiplication_19)
subtraction_8 = Subtraction(A=processingarea, B=multiplication_20)
cluster = Cluster(N=addition_8, C=subtraction_5, relay=group_2, O=area_6.Centroid, A=subtraction_6, A_2=subtraction_7)  # -> geo_2, R, V
cluster_2 = Cluster(N=addition_8, C=multiplication_21, relay=group_2, O=area_6.Centroid, A=multiplication_18, A_2=multiplication_19)  # -> geo_2, R, V
move_4 = Move(Geometry=cluster_2.R, Motion=cluster_2.V)  # -> Geometry, Transform
move_5 = Move(Geometry=cluster.R, Motion=cluster.V)  # -> Geometry, Transform
geo_2 = Geometry(cluster_2.geo_2)
geo_3 = Geometry(cluster.geo_2)

offcrv = OffsetCurve(Curve=move_4.Geometry, Plane=PlaneXY(0, 0, 0), Distance="-0.15", BothSides=0, Kinks=move_4.Geometry, CapType=1)
boundary_3 = BoundarySurfaces(Edges=flatten([offcrv, move_4.Geometry]))
brec_12 = BoundingRectangle(Geometry=flatten([boundary_3, geo_2]), Plane=PlaneXY(0, 0, 0), Axis=0, Slide=0, Union=True)  # -> Bounding, DimensionX, DimensionY

brec_13 = BoundingRectangle(Geometry=boundary_3, Plane=PlaneXY(0, 0, 0), Axis=0, Slide=0, Union=True)  # -> Bounding, DimensionX, DimensionY
X_8 = UnitX(Factor=brec_13.DimensionX)
move_6 = Move(Geometry=move_5.Geometry, Motion=X_8)  # -> Geometry, Transform
move_7 = Move(Geometry=geo_3, Motion=X_8)  # -> Geometry, Transform

explode_2 = Explode(Curve=brec_12.Bounding, Recursive=True)  # -> Segments, Vertices
item_23 = ListItem(List=explode_2.Segments, Index=0, Wrap=True)  # -> Item2, Item1, Item
brec_14 = BoundingRectangle(Geometry=flatten([move_6.Geometry, move_7.Geometry]), Plane=PlaneXY(0, 0, 0), Axis=0, Slide=0, Union=True)  # -> Bounding, DimensionX, DimensionY
merge_10 = Merge(Data1=boundary_3, Data2=geo_2)
curvepoint = PointOnCurve(item_23.Item2, parameter=0.5)
pdecon = Deconstruct(Point=curvepoint)  # -> XComponent, YComponent, ZComponent
area_7 = Area(Geometry=brec_14.Bounding)  # -> Area, Centroid
offset_5 = OffsetCurve(Curve=move_6.Geometry, Distance="-0.15", Corners=1)
explode_3 = Explode(Curve=brec_14.Bounding, Recursive=True)  # -> Segments, Vertices
item_24 = ListItem(List=explode_3.Segments, Index=0, Wrap=True)  # -> Item2, Item1, Item
boundary_4 = BoundarySurfaces(Edges=flatten([offset_5, move_6.Geometry]))
curvepoint_2 = PointOnCurve(item_24.Item2, parameter=0.5)
merge_11 = Merge(Data1=boundary_4, Data2=move_7.Geometry)

partition = PartitionList(List=series, Size=c_script.result)  # -> simplify(Chunks)
lng_4 = ListLength(List=partition)
multiplication_22 = Multiplication(A=lng_4, B=brec_7.DimensionX)
bnd = Bounds(Numbers=partition)
dedomain = DeconstructDomain(Domain=bnd)  # -> Start, End
subtraction_9 = Subtraction(A=simplify(graft(series_2)), B=dedomain.Start)
panel_33 = Panel("0")

subtraction_10 = Subtraction(A=int, B=multiplication_22)
addition_9 = Addition(A=partition, B=subtraction_9)

cull_i_3 = CullIndex(List=flatten(subtraction_10), Indices=integer_division, Wrap=True)

lng_5 = ListLength(List=cull_i_3)  # -> expr("x-1", Length)
max_2 = Maximum(A=lng_5, B="1")
ma_2 = MassAddition(Input=cull_i_3)  # -> Result, PartialResults

division_27 = Division(A=ma_2.Result, B=max_2)

panel_34 = Panel(division_27)
min_cross_circulation_spacing = Integer(division_27)
min_cross_circulation = CSharpScript(x=min_cross_circulation_spacing, y="10")  # -> out, b, c, a; inputs x: Int32, y: Int32
# ---------- min_cross_circulation: C# ----------
// Grasshopper Script Instance
#region Usings
using System;
using System.Linq;
using System.Collections;
using System.Collections.Generic;
using System.Drawing;

using Rhino;
using Rhino.Geometry;

using Grasshopper;
using Grasshopper.Kernel;
using Grasshopper.Kernel.Data;
using Grasshopper.Kernel.Types;
#endregion

public class Script_Instance : GH_ScriptInstance
{
    #region Notes
    /* 
      Members:
        RhinoDoc RhinoDocument
        GH_Document GrasshopperDocument
        IGH_Component Component
        int Iteration

      Methods (Virtual & overridable):
        Print(string text)
        Print(string format, params object[] args)
        Reflect(object obj)
        Reflect(object obj, string method_name)
    */
    #endregion

    private void RunScript(int x, int y, ref object b, ref object c, ref object a)
    {
        if(x>y)
        {a=$"You can reduce {x-y}m for cross circulation per aisle.";
         b=true;
         c=0;}
        else if(x<y)
        {a=$"You need to increase {y-x}m for cross circulation per aisle.";
         b=false;
         c=2;}
        else if(x==y)
        {a=$"Optimum cross circulation aisle";
         b=true;
         c=1;}
    }
}
# ---------- end min_cross_circulation ----------
int_3 = Integer(min_cross_circulation.b)
panel_35 = Panel(min_cross_circulation_spacing)

multiplication_23 = Multiplication(A=simplify(graft(range_2)), B=subtraction_10)  # -> simplify(Result)
addition_10 = Addition(A=addition_9, B=multiplication_23)
X_9 = UnitX(Factor=addition_10)

move_8 = Move(Geometry=item_11, Motion=X_9)  # -> Geometry, Transform
move2pt = MoveToPoint(Geometry=_2checkin_module, PointA=Point(1554.866621, 821.5733485, 0), PointB=move_8.Geometry)  # -> Moved, Vector, Transform

lng_6 = ListLength(List=flatten(move_8.Geometry))
xy_4 = XYPlane(Origin=move_8.Geometry)
brec_15 = BoundingRectangle(Geometry=move2pt.Moved, Plane=PlaneXY(0, 0, 0), Axis=0, Slide=0, Union=True)  # -> simplify(Bounding), DimensionX, DimensionY
disc_3 = Discontinuity(Curve=brec_15.Bounding, Level=1)  # -> Points, Parameters
shatter_3 = Shatter(Curve=brec_15.Bounding, Parameters=disc_3.Parameters)
item_25 = ListItem(List=shatter_3, Index=0, Wrap=True)  # -> Item1, Item, Item1_2, Item2
crv_3 = Curve(item_25.Item2)
len = Length(Curve=crv_3)
eval_2 = EvaluateCurve(Curve=reparameterize(crv_3), Parameter="0.5")  # -> Point, Tangent, Angle
dom_5 = ConstructDomain(DomainStart=expr("-x/2", len), DomainEnd=expr("x/2", len))

move_9 = Move(Geometry=xy_4, Motion=X_5)  # -> Geometry, Transform
multiplication_24 = Multiplication(A=lng_6, B="2")
min_check_in = CSharpScript(x=multiplication_24, y=filter_2)  # -> out, a; inputs x: Int32, y: Int32
# ---------- min_check_in: C# ----------
// Grasshopper Script Instance
#region Usings
using System;
using System.Linq;
using System.Collections;
using System.Collections.Generic;
using System.Drawing;

using Rhino;
using Rhino.Geometry;

using Grasshopper;
using Grasshopper.Kernel;
using Grasshopper.Kernel.Data;
using Grasshopper.Kernel.Types;
#endregion

public class Script_Instance : GH_ScriptInstance
{
    #region Notes
    /* 
      Members:
        RhinoDoc RhinoDocument
        GH_Document GrasshopperDocument
        IGH_Component Component
        int Iteration

      Methods (Virtual & overridable):
        Print(string text)
        Print(string format, params object[] args)
        Reflect(object obj)
        Reflect(object obj, string method_name)
    */
    #endregion

    private void RunScript(int x, int y, ref object a)
    {
        if(x>y)
        a=$"You can reduce {x-y} check in counters.";
        else if(x<y)
        a=$"You need to increase {y-x} heck in counters.";
        else if(x==y)
        a=$"The Configuration matches the check in counter demand.";
    }
}
# ---------- end min_check_in ----------

division_28 = Division(A=brec_14.DimensionY, B="2")
division_29 = Division(A=brec_8.DimensionY, B="2")
addition_11 = Addition(A=division_29, B=division_28)
Y_3 = UnitY(Factor=addition_11)
move2pt_2 = MoveToPoint(PointA=area_3.Centroid, PointB=area_7.Centroid)  # -> Moved, Vector, Transform
move_10 = Move(Motion=Y_3)  # -> Geometry, Transform
comp = Compound(Transforms=flatten([move2pt_2.Transform, move_10.Transform]))
transform_5 = Transform(Geometry=arrlinear.Geometry, Transform=comp)
brec_16 = BoundingRectangle(Geometry=flatten(transform_5), Plane=PlaneXY(0, 0, 0), Axis=0, Slide=0, Union=True)  # -> Bounding, DimensionX, DimensionY
explode_4 = Explode(Curve=brec_16.Bounding, Recursive=True)  # -> Segments, Vertices
item_26 = ListItem(List=explode_4.Segments, Index=0, Wrap=True)  # -> Item2, Item1, Item
Y_4 = UnitY(Factor="2")
move_11 = Move(Geometry=item_26.Item2, Motion=Y_4)  # -> Geometry, Transform
len_2 = Length(Curve=move_11.Geometry)
division_30 = Division(A=size_3.QueueArea, B=len_2)
Y_5 = UnitY(Factor=expr("-x", emigration_inputs_immigration_offset_fro))
pdecon_2 = Deconstruct(Point=curvepoint_2)  # -> XComponent, YComponent, ZComponent

max_3 = Maximum(A=division_30, B=item_2)

tstat = TreeStatistics(Tree=move_9.Geometry)  # -> Paths, Length, Count

avr_2 = Average(Input=tstat.Length)
smaller_3 = SmallerThan(FirstNumber=tstat.Length, SecondNumber=expr("x/2", avr_2))  # -> SmallerThan, OrEqualTo
panel_36 = Panel(tstat.Length)
dispatch_7 = Dispatch(List=tstat.Paths, DispatchPattern=smaller_3.SmallerThan)  # -> ListA, ListB
branch = TreeBranch(Tree=move_9.Geometry, Path=dispatch_7.ListB, MaintainPaths=True)

addition_12 = Addition(A=brec_7.DimensionY, B="2")
addition_13 = Addition(A=brec_7.DimensionY, B="2")
offset_6 = OffsetCurve(Curve=offset_3, Distance=expr("-x", addition_13), Corners=1)
offset_7 = OffsetCurve(Curve=offset_2, Distance=addition_12, Corners=1)
len_3 = Length(Curve=offset_7)
eval_3 = EvaluateCurve(Curve=reparameterize(offset_6), Parameter=0)  # -> Point, Tangent, Angle
eval_4 = EvaluateCurve(Curve=reparameterize(offset_7), Parameter=1)  # -> Point, Tangent, Angle
len_4 = Length(Curve=offset_6)
ma_3 = MassAddition(Input=flatten([len_3, len_4]))  # -> Result, PartialResults
prot_2 = RotatePlane(Plane=eval_3.Point, Angle=degrees("-90"))
prot_3 = RotatePlane(Plane=eval_4.Point, Angle=degrees("90"))
dom_6 = ConstructDomain(DomainStart=0, DomainEnd=len_3)
division_31 = Division(A="3", B="2")
subtraction_11 = Subtraction(A=round_4.Nearest, B="1")
division_32 = Division(A=brec_6.DimensionX, B="2")
panel_37 = Panel(division_32)

multiplication_25 = Multiplication(A="2", B="2")

md_slider_2 = MDSlider(
    SliderMode=0,
    slider_value=Point(0.5406689528, 0.826637082, 0.5),
    x_domain=Domain(0, 1),
    y_domain=Domain(0, 1),
    z_domain=Domain(0, 1))
evalsrf = EvaluateSurface(Surface=reparameterize(brec_6.Bounding), Point=md_slider_2)  # -> Point, Normal, UDirection, VDirection, Frame
Y_6 = UnitY(Factor="2")
move_12 = Move(Geometry=evalsrf.Point, Motion=Y_6)  # -> Geometry, Transform
X_10 = UnitX(Factor=expr("-x", division_32))
move_13 = Move(Geometry=move_12.Geometry, Motion=X_10)  # -> Geometry, Transform

transform_6 = Transform(Geometry=mesh_2, Transform=branch)

furniture_blocks = StreamFilter(Gate=dispatch_3.ListA, Stream0=transform_6, Stream1=[merge_7, mesh_3])

# ---- group: Counter Blocks
geo_4 = Geometry(flatten(furniture_blocks))
c_bake_5 = ContextBake(Counters_47_71_172_150=geo_4)

# ----
Y_7 = UnitY(Factor=max_3)
move_14 = Move(Geometry=move_11.Geometry, Motion=Y_7)  # -> Geometry, Transform
extr_2 = Extrude(Base=move_11.Geometry, Direction=Y_7)
curvepoint_3 = PointOnCurve(move_14.Geometry, parameter=0.5)

crv_4 = Curve(extr_2)
offset_8 = OffsetCurve(Curve=crv_4, Distance="-0.15", Corners=1)
boundary_5 = BoundarySurfaces(Edges=flatten([crv_4, offset_8]))
merge_12 = Merge(Data1=transform_5, Data2=boundary_5)

multiplication_26 = Multiplication(A=multiplication_10, B=area_for_ropes_corners)
roundf_2 = RoundToFactor(NumberX=multiplication_26, Factor="5", RoundType=0)  # -> Rounded, Difference, MultiplierR, MultiplierX
md_slider_3 = MDSlider(
    SliderMode=0,
    slider_value=Point(0.502658751, 0, 0.5),
    x_domain=Domain(0, 1),
    y_domain=Domain(0, 1),
    z_domain=Domain(0, 1))
division_33 = Division(A=multiplication_26, B=division_15)
multiplication_27 = Multiplication(A=division_33, B=lng_4)  # -> simplify(Result)
division_34 = Division(A=multiplication_27, B=len)  # -> simplify(Result)

multiplication_28 = Multiplication(A=division_34, B="1")

addition_14 = Addition(A="2", B=multiplication_28)
dom_7 = ConstructDomain(DomainStart="2", DomainEnd=addition_14)
rectangle_3 = Rectangle(Plane=eval_2.Point, XSize=dom_5, YSize=dom_7, Radius=0)  # -> Rectangle, Length

panel_38 = Panel(addition_14)
brec_17 = BoundingRectangle(Geometry=flatten(rectangle_3.Rectangle), Plane=PlaneXY(0, 0, 0), Axis=0, Slide=0, Union=True)  # -> Bounding, DimensionX, DimensionY
rdiff = RegionDifference(CurvesA=brec_17.Bounding, CurvesB=flatten(rectangle_3.Rectangle))
evalsrf_2 = EvaluateSurface(Surface=reparameterize(brec_17.Bounding), Point=md_slider)  # -> Point, Normal, UDirection, VDirection, Frame
brec_18 = BoundingRectangle(Geometry=rdiff, Plane=PlaneXY(0, 0, 0), Axis=0, Slide=0, Union=False)  # -> Bounding, DimensionX, DimensionY
addition_15 = Addition(A=brec_17.DimensionY, B="2", C=brec_7.DimensionY)
paramptinrec_2 = ParameterPointInRectangle(Rectangle=brec_18.Bounding, ParameterX=0.5, ParameterY=0)  # -> Point, Normal
division_35 = Division(A=addition_15, B=brec_17.DimensionY)
area_8 = Area(Geometry=rdiff)  # -> Area, Centroid
subtraction_12 = Subtraction(A=multiplication_12, B=area_8.Area)
scale_nu_2 = ScaleNU(Geometry=brec_17.Bounding, Plane=evalsrf_2.Point, ScaleX=1, ScaleY=division_35, ScaleZ=1)  # -> Geometry, Transform
area_9 = Area(Geometry=scale_nu_2.Geometry)  # -> Area, Centroid
area_10 = Area(Geometry=scale_nu_2.Geometry)  # -> Area, Centroid
addition_16 = Addition(A=subtraction_12, B=area_9.Area)

evalsrf_3 = EvaluateSurface(Surface=reparameterize(scale_nu_2.Geometry), Point=md_slider_3)  # -> Point, Normal, UDirection, VDirection, Frame
item_27 = ListItem(List=addition_16, Index=0, Wrap=True)
division_36 = Division(A=item_27, B=area_9.Area)
item_28 = ListItem(List=flatten(multiplication_28), Index=0, Wrap=True)

scale_nu_3 = ScaleNU(Geometry=scale_nu_2.Geometry, Plane=evalsrf_3.Point, ScaleX=1, ScaleY=division_36, ScaleZ=1)  # -> Geometry, Transform
offset_9 = OffsetCurve(Curve=scale_nu_3.Geometry, Distance=1, Corners=1)
roundf_3 = RoundToFactor(NumberX=area_10.Area, Factor="5", RoundType=0)  # -> Rounded, Difference, MultiplierR, MultiplierX
subtraction_13 = Subtraction(A=brec_6.DimensionY, B=addition_15)
min_cross_circulation_2 = CSharpScript(x=subtraction_13, y="10")  # -> out, b, a; inputs x: Int32, y: Int32
# ---------- min_cross_circulation_2: C# ----------
// Grasshopper Script Instance
#region Usings
using System;
using System.Linq;
using System.Collections;
using System.Collections.Generic;
using System.Drawing;

using Rhino;
using Rhino.Geometry;

using Grasshopper;
using Grasshopper.Kernel;
using Grasshopper.Kernel.Data;
using Grasshopper.Kernel.Types;
#endregion

public class Script_Instance : GH_ScriptInstance
{
    #region Notes
    /* 
      Members:
        RhinoDoc RhinoDocument
        GH_Document GrasshopperDocument
        IGH_Component Component
        int Iteration

      Methods (Virtual & overridable):
        Print(string text)
        Print(string format, params object[] args)
        Reflect(object obj)
        Reflect(object obj, string method_name)
    */
    #endregion

    private void RunScript(int x, int y, ref object b, ref object a)
    {
        if(x<y)
        {a=$"You need {y-x}m space for circulation behind queueing area.";
         b=true;}
        else if((x>y)&&((x-y)<10))
        {a=$"You have {x-y}m deep Check-In Hall area,do check if that's sufficient.";
         b=false;}
        else 
        {a=$"You have {x-y}m deep Check-In Hall area,do check if it's not overdesigned.";
         b=true;}
    }
}
# ---------- end min_cross_circulation_2 ----------
queue_area_sq_m = Panel(multiplication_26)
concat_14 = Concatenate(FragmentA="Queue Area (sq.m)", FragmentD=":", FragmentB=queue_area_sq_m)

concat_15 = Concatenate(FragmentA="3.", FragmentB=min_cross_circulation.a)
concat_16 = Concatenate(FragmentA="1.", FragmentB=min_check_in.a)
concat_17 = Concatenate(FragmentA="4.", FragmentB=min_cross_circulation_2.a)
concat_18 = Concatenate(FragmentA="2.", FragmentB=item_16)
config_summariser = Concatenate(Min_Counters=concat_16, Min_Walk=concat_18, Min_Cross_Space=concat_15, Min_Space_Behind_Queue=concat_17)

panel_39 = Panel(config_summariser)

division_37 = Division(A=multiplication_26, B=ma_3.Result)
dom_8 = ConstructDomain(DomainStart=0, DomainEnd=division_37)
addition_17 = Addition(A=division_37, B=addition_12, C=division_31)
multiplication_29 = Multiplication(A=addition_17, B=subtraction_11, C="2")
roundd_2 = RoundToDecimalPlace(NumberX=multiplication_29, DecimalPlace="2", RoundType=0)  # -> Rounded, Difference
roundd_3 = RoundToDecimalPlace(NumberX=division_37, DecimalPlace="2", RoundType=2)  # -> Rounded, Difference
subtraction_14 = Subtraction(A=dim.UDimension, B=roundd_2.Rounded)
division_38 = Division(A=subtraction_14, B=subtraction_11)
min_circulation_space = CSharpScript(x=division_38, y="6")  # -> out, b, a; inputs x: Int32, y: Double
# ---------- min_circulation_space: C# ----------
// Grasshopper Script Instance
#region Usings
using System;
using System.Linq;
using System.Collections;
using System.Collections.Generic;
using System.Drawing;

using Rhino;
using Rhino.Geometry;

using Grasshopper;
using Grasshopper.Kernel;
using Grasshopper.Kernel.Data;
using Grasshopper.Kernel.Types;
#endregion

public class Script_Instance : GH_ScriptInstance
{
    #region Notes
    /* 
      Members:
        RhinoDoc RhinoDocument
        GH_Document GrasshopperDocument
        IGH_Component Component
        int Iteration

      Methods (Virtual & overridable):
        Print(string text)
        Print(string format, params object[] args)
        Reflect(object obj)
        Reflect(object obj, string method_name)
    */
    #endregion

    private void RunScript(int x, double y, ref object b, ref object a)
    {
        if(x>y)
       { a=$"You can reduce {x-y}m for cross circulation per aisle.";
         b= true;}
        else if(x<y)
        {a=$"You need to increase {y-x}m for cross circulation per aisle.";
          b= false;}
        else if(x==y)
       { a=$"Optimum cross circulation aisle";
        b= true;}
    }
}
# ---------- end min_circulation_space ----------
int_4 = Integer(min_circulation_space.b)

multiplication_30 = Multiplication(A=division_37, B="2")
addition_18 = Addition(A=multiplication_25, B=multiplication_30)
subtraction_15 = Subtraction(A=shift, B=addition_18)

rectangle_4 = Rectangle(Plane=simplify(prot_3), XSize=dom_6, YSize=dom_8, Radius=0)  # -> Rectangle, Length
rectangle_5 = Rectangle(Plane=simplify(prot_2), XSize=dom_6, YSize=dom_8, Radius=0)  # -> simplify(Rectangle), Length
flatten = FlattenTree(Tree=[rectangle_5.Rectangle, rectangle_4.Rectangle], Path="{0}")

partition_2 = PartitionList(List=flatten, Size="2")
brec_19 = BoundingRectangle(Geometry=flatten, Plane=PlaneXY(0, 0, 0), Axis=0, Slide=0, Union=True)  # -> Bounding, DimensionX, DimensionY
brec_20 = BoundingRectangle(Geometry=partition_2, Plane=PlaneXY(0, 0, 0), Axis=0, Slide=0, Union=False)  # -> Bounding, DimensionX, DimensionY
multiplication_31 = Multiplication(A=brec_19.DimensionY, B=brec_3.DimensionX)
offset_10 = OffsetCurve(Curve=brec_19.Bounding, Distance=1, Corners=1)
rdiff_2 = RegionDifference(CurvesA=brec_19.Bounding, CurvesB=flatten(brec_20.Bounding))
roundf_4 = RoundToFactor(NumberX=multiplication_31, Factor="5", RoundType=0)  # -> Rounded, Difference, MultiplierR, MultiplierX
brec_21 = BoundingRectangle(Geometry=rdiff_2, Plane=PlaneXY(0, 0, 0), Axis=0, Slide=0, Union=False)  # -> Bounding, DimensionX, DimensionY

paramptinrec_3 = ParameterPointInRectangle(Rectangle=brec_21.Bounding, ParameterX=0.5, ParameterY=0)  # -> Point, Normal
dispatch_8 = Dispatch(List=paramptinrec_3.Point, DispatchPattern=[True, False])  # -> ListA, ListB
queue_area = StreamFilter(Gate=dispatch_3.ListA, Stream0=rectangle_3.Rectangle, Stream1=flatten)
que_depth = StreamFilter(Gate=dispatch_3.ListA, Stream0=item_28, Stream1=roundd_3.Rounded)
furniture_blocks_2 = StreamFilter(Gate=dispatch_3.ListA, Stream0=int_3, Stream1=int_4)

furniture_blocks_3 = StreamFilter(
    Gate=dispatch_3.ListA,
    Stream0=" is not sufficient (Check Width of Aisles).",
    Stream1=" is not sufficient (Check Depth or Aisle Spacing).")
furniture_blocks_4 = StreamFilter(Gate=dispatch_3.ListA, Stream0=move_13.Geometry, Stream1=move_13.Geometry)
total_cuvre = StreamFilter(Gate=dispatch_3.ListA, Stream0=offset_9, Stream1=offset_10)
total_cuvre_2 = StreamFilter(Gate=dispatch_3.ListA, Stream0=paramptinrec_2.Point, Stream1=dispatch_8.ListB)

gate = StreamGate(Stream=furniture_blocks_3, Gate=furniture_blocks_2)  # -> Target0, Target1
gate_2 = StreamGate(Stream=rectangle.Rectangle, Gate=furniture_blocks_2)  # -> Target0, Target1

Y_8 = UnitY(Factor=1)
line_5 = LineSDL(Start=total_cuvre_2, Direction=expr("-x", Y_8), Length="6")
end = EndPoints(Curve=line_5)  # -> Start, End
panel_40 = Panel("45")
Z_5 = UnitZ(Factor=1)
X_11 = UnitX(Factor=end.End)
vrot = Rotate(Vector=X_11, Axis=Z_5, Angle=degrees("45"))
yz_2 = YZPlane(Origin=end.End)
line_6 = LineSDL(Start=end.End, Direction=vrot, Length="1.5")
mirror_7 = Mirror(Geometry=line_6, Plane=yz_2)  # -> Geometry, Transform
join_2 = JoinCurves(Curves=[mirror_7.Geometry, line_6, line_5], Preserve=False)
offcrv_2 = OffsetCurve(Curve=join_2, Plane=PlaneXY(0, 0, 0), Distance=-0.2, BothSides=0.2, Kinks=0, CapType=1)  # -> flatten(Offset)
runion = RegionUnion(Curves=offcrv_2)
srf_3 = Surface(runion)

pt_2 = Point(end.End)
lng_7 = ListLength(List=pt_2)
division_39 = Division(A=filter_5, B=lng_7)
multiplication_32 = Multiplication(A=addition, B=division_39)
dom_9 = ConstructDomain(DomainStart=expr("-x/2", multiplication_32), DomainEnd=expr("x/2", multiplication_32))
rectangle_6 = Rectangle(Plane=pt_2, XSize=dom_9, YSize=brec.DimensionY, Radius=0)  # -> Rectangle, Length
debrep_3 = DeconstructBrep(Brep=rectangle_6.Rectangle)  # -> Faces, Edges, Vertices
item_29 = ListItem(List=debrep_3.Vertices, Index=0, Wrap=True)
move2pt_3 = MoveToPoint(Geometry=e_gate, PointA=item_8, PointB=item_29)  # -> Moved, Vector, Transform
arrlinear_2 = LinearArray(Geometry=move2pt_3.Moved, Direction=X_3, Count=division_39)  # -> Geometry, Transform
move_15 = Move(Geometry=arrlinear_2.Geometry, Motion=Y)  # -> Geometry, Transform
brec_22 = BoundingRectangle(Geometry=move_15.Geometry, Plane=PlaneXY(0, 0, 0), Axis=0, Slide=0, Union=True)  # -> Bounding, DimensionX, DimensionY
explode_5 = Explode(Curve=brec_22.Bounding, Recursive=True)  # -> Segments, Vertices
item_30 = ListItem(List=explode_5.Segments, Index=0, Wrap=True)  # -> simplify(Item)
tstat_2 = TreeStatistics(Tree=item_30)  # -> Paths, Length, Count
lng_8 = ListLength(List=tstat_2.Paths)
multiplication_33 = Multiplication(A=division_11, B=lng_8)
round_9 = Round(Number=multiplication_33)  # -> Nearest, Floor, Ceiling
partition_3 = PartitionList(List=tstat_2.Paths, Size=round_9.Nearest)  # -> simplify(Chunks)
branch_2 = TreeBranch(Tree=simplify(partition_3), Path="1", MaintainPaths=True)
branch_3 = TreeBranch(Tree=simplify(partition_3), Path="0", MaintainPaths=True)
branch_4 = TreeBranch(Tree=simplify(item_30), Path=branch_3, MaintainPaths=True)
branch_5 = TreeBranch(Tree=simplify(item_30), Path=branch_2, MaintainPaths=True)
brec_23 = BoundingRectangle(Geometry=flatten(branch_5), Plane=PlaneXY(0, 0, 0), Axis=0, Slide=0, Union=True)  # -> Bounding, DimensionX, DimensionY
curvepoint_4 = PointOnCurve(branch_4, parameter=0.5)
explode_6 = Explode(Curve=brec_23.Bounding, Recursive=True)  # -> Segments, Vertices
item_31 = ListItem(List=explode_6.Segments, Index=0, Wrap=True)
curvepoint_5 = PointOnCurve(item_31, parameter=0.5)
pdecon_3 = Deconstruct(Point=curvepoint_4)  # -> XComponent, YComponent, ZComponent
subtraction_16 = Subtraction(A=pdecon.YComponent, B=pdecon_3.YComponent)
addition_19 = Addition(A=subtraction_16, B=security_inputs_security_offset_from_emi)
Y_9 = UnitY(Factor=expr("-x", addition_19))
move_16 = Move(Geometry=merge_10, Motion=Y_9)  # -> Geometry, Transform
brec_24 = BoundingRectangle(Geometry=flatten(move_16.Geometry), Plane=PlaneXY(0, 0, 0), Axis=0, Slide=0, Union=True)  # -> Bounding, DimensionX, DimensionY

Y_10 = UnitY(Factor="1")
X_12 = UnitX(Factor=1)
move_17 = Move(Geometry=end.Start, Motion=Y_10)  # -> Geometry, Transform
line_7 = LineSDL(Start=move_17.Geometry, Direction=expr("-x", X_12), Length="3")
line_8 = LineSDL(Start=move_17.Geometry, Direction=X_12, Length="3")
join_3 = JoinCurves(Curves=[line_8, line_7], Preserve=False)  # -> flatten(Curves)
srf_4 = Surface(total_cuvre)
flip_4 = FlipCurve(Curve=join_3)  # -> Curve, Flag
concat_19 = Concatenate(FragmentA="E-Gates")
textsrf_3 = TextOnSurface(Text=concat_19, Font="Sans Bold:no Italic:no", Height=1.2, Depth=0, BaseLine=flip_4.Curve, BaseSurface=srf_4)  # -> flatten(Symbols)

srf_5 = Surface(gate_2.Target0)
srf_6 = Surface(queue_area)
runion_2 = RegionUnion(Curves=flatten(srf_6))
crv_5 = Curve(runion_2)
srf_7 = Surface(crv_5)
queue_depth_m = Panel(que_depth)
area_11 = Area(Geometry=crv_5)  # -> Area, Centroid
c_bake_6 = ContextBake(CheckInArea=srf_7)
roundd_4 = RoundToDecimalPlace(NumberX=queue_depth_m, DecimalPlace="1", RoundType=0)  # -> Rounded, Difference
sort_pt_2 = SortPoints(Points=area_11.Centroid)  # -> Points, Indices
concat_20 = Concatenate(FragmentA="Queue Depth (m)", FragmentD=":", FragmentB=roundd_4.Rounded)
index_5 = ItemIndex(List=sort_pt_2.Points, Item=sort_pt_2.Points)
item_32 = ListItem(List=panel_25, Index=index_5, Wrap=True)
merge_13 = Merge(Data1=concat_9, Data2=concat_14, Data3=concat_6, Data4=concat_8, Data5=concat_7, Data6=concat_20)  # -> flatten(Result)
c_print_7 = ContextPrint(Metrics=merge_13)
concat_21 = Concatenate(FragmentA="Zone ", FragmentB=item_32)
pl_origin = PlaneOrigin(Base=tag_orientation, Origin=sort_pt_2.Points)
brec_25 = BoundingRectangle(Geometry=srf_7, Plane=pl_origin, Axis=0, Slide=0, Union=True)  # -> Bounding, flatten(DimensionX), DimensionY
item_33 = ListItem(List=brec_25.DimensionX, Index=0, Wrap=True)
deplane = DeconstructPlane(Plane=pl_origin)  # -> Origin, XAxis, YAxis, ZAxis
c_bake_7 = ContextBake(Arrows_0_0_0_150=flatten(srf_3))
offset_11 = OffsetCurve(Curve=total_cuvre, Distance=expr("-x/2", "0.15"), Corners=1)
offset_12 = OffsetCurve(Curve=total_cuvre, Distance=expr("x/2", "0.15"), Corners=1)
amp = Amplitude(Vector=deplane.XAxis, Amplitude=expr("-x/2", item_33))
c_bake_8 = ContextBake(Text_0_0_0_150=flatten(textsrf_3))
boundary_6 = BoundarySurfaces(Edges=[offset_11, offset_12])
move_18 = Move(Geometry=pl_origin, Motion=amp)  # -> Geometry, Transform
area_12 = Area(Geometry=offset_11)  # -> Area, Centroid
line_9 = LineSDL(Start=move_18.Geometry, Direction=deplane.XAxis, Length=item_33)
roundf_5 = RoundToFactor(NumberX=area_12.Area, Factor="10", RoundType=0)  # -> Rounded, Difference, MultiplierR, MultiplierX
textsrf_4 = TextOnSurface(Text=concat_21, Font="Sans Bold:no Italic:no", Height="1.5", Depth=0, BaseLine=line_9, BaseSurface=srf_7)
concat_22 = Concatenate(FragmentA="{", FragmentE="*", FragmentB=roundf_5.Rounded, FragmentF="*", FragmentC="}", FragmentD="[146, 172, 30]")
concat_23 = Concatenate(FragmentD="Designed Check In  Area of ", FragmentA=concat_22, FragmentB="sq.m", FragmentC=gate.Target0)
gate_3 = StreamGate(Stream=concat_23, Gate=furniture_blocks_2)  # -> Target0, Target1
move_19 = Move(Geometry=textsrf_4, Motion=Z_4)  # -> Geometry, Transform
concat_24 = Concatenate(FragmentA="Total designed check in area is ", FragmentB=concat_22, FragmentC=panel_27)

concat_25 = Concatenate(FragmentA="1.", FragmentB=min_counters.a, FragmentC=" in the layout")
concat_26 = Concatenate(FragmentA="2.", FragmentB=min_circulation_space.a)
concat_27 = Concatenate(FragmentA="3.", FragmentB=min_circulation_space.a)
config_summariser_2 = Concatenate(Min_Counters=concat_25, Min_Cross_Space=concat_26)

iata_los_summary = Concatenate(LoS_Provided=concat_10, Min_Cross_Space=concat_24, C=gate_3.Target0)
c_print_8 = ContextPrint(LoSSummary=iata_los_summary)
panel_41 = Panel(config_summariser_2)
filter_14 = StreamFilter(Gate=dispatch_3.ListA, Stream0=config_summariser, Stream1=config_summariser_2)
panel_42 = Panel(iata_los_summary)
txt = Text(flatten(filter_14))

# ----
# Summary:
# Metrics:
panel_43 = Panel(merge_13)
# Suggested Improvements:
panel_44 = Panel(iata_los_summary)
panel_45 = Panel(txt)

c_print_9 = ContextPrint(SuggestedSpatialImprovements=txt)

# ---- group: Check In Area
c_bake_9 = ContextBake(CheckIn_BoundingBox_179_57_26_150=flatten(boundary_6))

# ----
c_script_4 = CSharpScript(
    FlightProfile="International Full-Service (Widebody Mix)",
    ProcessingConcept="Common Use Terminal Equipment (CUTE) – Traditional Desks",
    TotalPax=dhp,
    DemandCapacityRatio=roundd.Rounded,
    TargetWait=item_6,
    Wait95=qs._95thPercentileWait,
    MaxWait=qs.MaximumWait,
    AvgWait=qs.AverageWait,
    Counters=panel_28,
    Pitch="2",
    PeakQueueLength=qs.PeakQueueLength,
    QueueFootprint=roundf_2.Rounded,
    SpacePerPax=item_4,
    QueueDepth=roundd_4.Rounded,
    TargetLoS=facility_inputs_legacy_level_of_service,
    TagClass="85, 85, 85",
    TagClass1="119,119,119",
    ColorGood="#9BAB20")  # -> out, SummaryOutput; inputs FlightProfile: String, ProcessingConcept: String, TotalPax: Int32, AvgServiceTime: Double, PeakArrivalRate: Double, DemandCapacityRatio: Double, TargetWait: Double, Wait95: Double, MaxWait: Double, AvgWait: Double, Counters: Int32, Pitch: Double, PeakQueueLength: Int32, QueueFootprint: Double, SpacePerPax: Double, QueueDepth: Double, TargetLoS: String, WaitThresholds: list of Double, TagClass: String, TagClass1: String, ColorTooGood: String, ColorGood: String, ColorLittleBad: String, ColorBad: String, ColorWorst: String, ColorVeryWorst: String
# ---------- c_script_4: C# ----------
using System;
using System.Collections.Generic;
using System.Text;

public class Script_Instance : GH_ScriptInstance
{
    private void RunScript(
		string FlightProfile,
		string ProcessingConcept,
		int TotalPax,
		double AvgServiceTime,
		double PeakArrivalRate,
		double DemandCapacityRatio,
		double TargetWait,
		double Wait95,
		double MaxWait,
		double AvgWait,
		int Counters,
		double Pitch,
		int PeakQueueLength,
		double QueueFootprint,
		double SpacePerPax,
		double QueueDepth,
		string TargetLoS,
		List<double> WaitThresholds,
		string TagClass,
		string TagClass1,
		string ColorTooGood,
		string ColorGood,
		string ColorLittleBad,
		string ColorBad,
		string ColorWorst,
		string ColorVeryWorst,
		ref object SummaryOutput)
    {
        // ----------------------------------------------------------------------
        // Default Header/Label Colors (Dark & Medium Grey)
        // ----------------------------------------------------------------------
        if (string.IsNullOrWhiteSpace(TagClass)) TagClass = "#555555";
        if (string.IsNullOrWhiteSpace(TagClass1)) TagClass1 = "#777777";
        
        // ----------------------------------------------------------------------
        // Custom LoS Severity Palette Fallbacks (lightest to darkest HEX codes)
        // ----------------------------------------------------------------------
        if (string.IsNullOrWhiteSpace(ColorTooGood))   ColorTooGood   = "#FFD9D0";
        if (string.IsNullOrWhiteSpace(ColorGood))      ColorGood      = "#FDBDAD";
        if (string.IsNullOrWhiteSpace(ColorLittleBad)) ColorLittleBad = "#FF8D70";
        if (string.IsNullOrWhiteSpace(ColorBad))       ColorBad       = "#F6633E";
        if (string.IsNullOrWhiteSpace(ColorWorst))     ColorWorst     = "#D8431E";
        if (string.IsNullOrWhiteSpace(ColorVeryWorst)) ColorVeryWorst = "#B3391A";

        // Default target to "C" if nothing is provided
        if (string.IsNullOrWhiteSpace(TargetLoS)) TargetLoS = "C";
        int targetIndex = GetLoSIndex(TargetLoS);

        // Fallback for wait thresholds if list is empty or not plugged in
        if (WaitThresholds == null || WaitThresholds.Count < 6)
        {
            WaitThresholds = new List<double> { 10.0, 12.0, 20.0, 25.0, 30.0, 1000.0 };
        }

        // ----------------------------------------------------------------------
        // 1. Evaluate SPACE LoS
        // ----------------------------------------------------------------------
        string achievedSpaceLoS = GetAchievedSpaceLoS(SpacePerPax);
        int spaceDiff = GetLoSIndex(achievedSpaceLoS) - targetIndex;
        string dynamicSpaceColor = GetSeverityColor(spaceDiff, ColorTooGood, ColorGood, ColorLittleBad, ColorBad, ColorWorst, ColorVeryWorst);

        // ----------------------------------------------------------------------
        // 2. Evaluate WAIT TIME LoS
        // ----------------------------------------------------------------------
        string achievedWaitLoS = GetAchievedWaitLoS(Wait95, WaitThresholds);
        int waitDiff = GetLoSIndex(achievedWaitLoS) - targetIndex;
        string dynamicWaitColor = GetSeverityColor(waitDiff, ColorTooGood, ColorGood, ColorLittleBad, ColorBad, ColorWorst, ColorVeryWorst);

        // Auto-evaluate Capacity Color (Reusing Good and Bad colors)
        string dcEvalText = DemandCapacityRatio <= 1.0 
            ? $"{{*Balanced System*}}[{ColorGood}]" 
            : $"{{*Overloaded System*}}[{ColorBad}]";


        StringBuilder sb = new StringBuilder();

        // --- Block 1: Scenario Definition ---
        sb.AppendLine($"{{*Scenario Definition*}}[{TagClass}]");
        sb.AppendLine();
        sb.AppendLine($"{{*Flight Profile:*}}[{TagClass1}] {FlightProfile}");
        sb.AppendLine();
        sb.AppendLine($"{{*Processing Concept:*}}[{TagClass1}] {ProcessingConcept}");
        sb.AppendLine("--------------------------------");

        // --- Block 2: Demand & Throughput ---
        sb.AppendLine($"{{*Demand & Throughput*}}[{TagClass}]");
        sb.AppendLine();
        sb.AppendLine($"{{*Total Passenger Demand:*}}[{TagClass1}] {TotalPax} pax (Design Hour Volume)");
        sb.AppendLine();
        sb.AppendLine($"{{*Average Service Time:*}}[{TagClass1}] {Math.Round(AvgServiceTime, 1)} seconds / pax");
        sb.AppendLine();
        sb.AppendLine($"{{*Peak Arrival Rate:*}}[{TagClass1}] {Math.Round(PeakArrivalRate, 1)} passengers / minute");
        sb.AppendLine();
        sb.AppendLine($"{{*System Demand/Capacity Ratio:*}}[{TagClass1}] {Math.Round(DemandCapacityRatio, 2)} – {dcEvalText}");
        sb.AppendLine("--------------------------------");

        // --- Block 3: Operational Performance ---
        sb.AppendLine($"{{*Operational Performance (Metrics)*}}[{TagClass}]");
        sb.AppendLine();
        sb.AppendLine($"{{*Target Wait Time (Max LoS {TargetLoS}):*}}[{TagClass1}] {Math.Round(TargetWait, 1)} minutes");
        
        string waitEvalText = $"{{*Achieved LoS {achievedWaitLoS} (Target: {TargetLoS})*}}[{dynamicWaitColor}]";
        sb.AppendLine();
        sb.AppendLine($"{{*95th Percentile Wait Time:*}}[{TagClass1}] {Math.Round(Wait95, 1)} minutes – {waitEvalText}");
        sb.AppendLine();
        sb.AppendLine($"{{*Maximum Wait Time:*}}[{TagClass1}] {Math.Round(MaxWait, 1)} minutes");
        sb.AppendLine();
        sb.AppendLine($"{{*Average Wait Time:*}}[{TagClass1}] {Math.Round(AvgWait, 1)} minutes");
        sb.AppendLine("--------------------------------");

        // --- Block 4: Resource Configuration ---
        sb.AppendLine($"{{*Resource Configuration*}}[{TagClass}]");
        sb.AppendLine();
        sb.AppendLine($"{{*Optimized Counter Allocation:*}}[{TagClass1}] {Counters} Desks Required");
        sb.AppendLine();
        double frontage = Math.Round(Counters * Pitch, 1);
        sb.AppendLine($"{{*Required Linear Frontage:*}}[{TagClass1}] ~{frontage} meters (assuming {Pitch}m pitch per desk)");
        sb.AppendLine();
        sb.AppendLine("--------------------------------");

        // --- Block 5: Space & Layout Metrics ---
        sb.AppendLine($"{{*Space & Layout Metrics*}}[{TagClass}]");
        sb.AppendLine();
        sb.AppendLine($"{{*Peak Queue Length:*}}[{TagClass1}] {PeakQueueLength} passengers (Maximum simultaneous accumulation)");
        sb.AppendLine();
        sb.AppendLine($"{{*Estimated Queue Footprint:*}}[{TagClass1}] {Math.Round(QueueFootprint, 1)} sq.m");
        
        string spaceEvalText = $"{{*Achieved LoS {achievedSpaceLoS} (Target: {TargetLoS})*}}[{dynamicSpaceColor}]";
        sb.AppendLine();
        sb.AppendLine($"{{*Space per Passenger:*}}[{TagClass1}] {Math.Round(SpacePerPax, 2)} sq.m/pax – {spaceEvalText}");
        sb.AppendLine();
        sb.AppendLine($"{{*Required Queue Depth:*}}[{TagClass1}] {Math.Round(QueueDepth, 1)} meters");

        SummaryOutput = sb.ToString();
    }

    // --- HELPER METHODS ---

    // reusable method to map the numeric difference to your palette
    private string GetSeverityColor(int diff, string cTooGood, string cGood, string cLittleBad, string cBad, string cWorst, string cVeryWorst)
    {
        if (diff < 0) return cTooGood;           
        if (diff == 0) return cGood;             
        if (diff == 1) return cLittleBad;        
        if (diff == 2) return cBad;              
        if (diff == 3) return cWorst;            
        return cVeryWorst;                       
    }

    // Convert LoS string to a numeric index for comparison
    private int GetLoSIndex(string los)
    {
        string upper = los.Trim().ToUpper();
        if (upper == "A") return 0;
        if (upper == "B") return 1;
        if (upper == "C") return 2;
        if (upper == "D") return 3;
        if (upper == "E") return 4;
        if (upper == "F") return 5;
        return 2; // Default to C
    }

    // Determine Achieved LoS based on Space per Passenger (Higher space = Better LoS)
    private string GetAchievedSpaceLoS(double space)
    {
        if (space >= 1.6) return "A";
        if (space >= 1.4) return "B"; 
        if (space >= 1.2) return "C"; 
        if (space >= 1.0) return "D";
        if (space >= 0.8) return "E";
        return "F";
    }

    // Determine Achieved LoS based on Wait Time Thresholds (Lower wait = Better LoS)
    private string GetAchievedWaitLoS(double wait, List<double> thresholds)
    {
        if (wait <= thresholds[0]) return "A";
        if (wait <= thresholds[1]) return "B";
        if (wait <= thresholds[2]) return "C";
        if (wait <= thresholds[3]) return "D";
        if (wait <= thresholds[4]) return "E";
        return "F";
    }
}
# ---------- end c_script_4 ----------
c_print_10 = ContextPrint(ProjectSummary=c_script_4.SummaryOutput)

# ---- group: Check In Zone Texts
c_bake_10 = ContextBake(Zone_47_43_38_200=flatten(move_19.Geometry))

# ----
c_bake_11 = ContextBake(ErrorBox_255_23_23_100=srf_5)
panel_46 = Panel(c_script_4.SummaryOutput)
preview = CustomPreview(Geometry=move_16.Geometry, Material=concat_13)
preview_2 = CustomPreview(
    Geometry=move_15.Geometry,
    Material={diffuse=RGB(221, 160, 221), emission=RGB(66, 48, 66), shine=0.5, specular=RGB(255, 255, 255), transparency=0})
c_bake_12 = ContextBake(DSecurityLanes_117_144_255_150=flatten(move_16.Geometry))
c_bake_13 = ContextBake(EGates_47_71_172_150=flatten(move_15.Geometry))

move2pt_4 = MoveToPoint(Geometry=merge_12, PointA=curvepoint_3, PointB=curvepoint_5)  # -> Moved, Vector, Transform
move_20 = Move(Geometry=move2pt_4.Moved, Motion=Y_5)  # -> Geometry, Transform
brec_26 = BoundingRectangle(Geometry=flatten(move_20.Geometry), Plane=PlaneXY(0, 0, 0), Axis=0, Slide=0, Union=True)  # -> Bounding, DimensionX, DimensionY
explode_7 = Explode(Curve=brec_26.Bounding, Recursive=True)  # -> Segments, Vertices
item_34 = ListItem(List=explode_7.Segments, Index=0, Wrap=True)
curvepoint_6 = PointOnCurve(item_34, parameter=0.5)
pdecon_4 = Deconstruct(Point=curvepoint_6)  # -> XComponent, YComponent, ZComponent
subtraction_17 = Subtraction(A=pdecon_2.YComponent, B=pdecon_4.YComponent)
addition_20 = Addition(A=subtraction_17, B=security_inputs_security_offset_from_emi)
Y_11 = UnitY(Factor=expr("-x", addition_20))
move_21 = Move(Geometry=merge_11, Motion=Y_11)  # -> Geometry, Transform

subtraction_18 = Subtraction(A=pdecon_4.XComponent, B=pdecon_2.XComponent)
X_13 = UnitX(Factor=subtraction_18)
panel_47 = Panel(subtraction_17)
move_22 = Move(Geometry=move_21.Geometry, Motion=X_13)  # -> Geometry, Transform

brec_27 = BoundingRectangle(Geometry=flatten(move_22.Geometry), Plane=PlaneXY(0, 0, 0), Axis=0, Slide=0, Union=True)  # -> Bounding, DimensionX, DimensionY

preview_3 = CustomPreview(Geometry=move_22.Geometry, Material=concat_13)
preview_4 = CustomPreview(
    Geometry=move_20.Geometry,
    Material={diffuse=RGB(221, 160, 221), emission=RGB(66, 48, 66), shine=0.5, specular=RGB(255, 255, 255), transparency=0})
c_bake_14 = ContextBake(IEmigrationCounters_117_144_255_150=flatten(move_20.Geometry))
c_bake_15 = ContextBake(ISecurityLanes_117_144_255_150=flatten(move_22.Geometry))

brec_28 = BoundingRectangle(
    Geometry=flatten([brec_27.Bounding, brec_25.Bounding, rectangle.Rectangle]),
    Plane=PlaneXY(0, 0, 0),
    Axis=0,
    Slide=0,
    Union=True)  # -> Bounding, DimensionX, DimensionY
explode_8 = Explode(Curve=brec_28.Bounding, Recursive=True)  # -> Segments, Vertices
item_35 = ListItem(List=explode_8.Segments, Index=0, Wrap=True)  # -> Item2, Item1, Item
len_5 = Length(Curve=item_35.Item)
division_40 = Division(A=size_6.ProcessingArea, B=len_5)
round_10 = Round(Number=division_40)  # -> Nearest, Floor, Ceiling
division_41 = Division(A=graft(size_6.EquipmentCounts), B=round_10.Ceiling)  # -> simplify(Result)
addition_21 = Addition(A=round_10.Ceiling, B="10")
lng_9 = ListLength(List=flatten(division_41))
offset_13 = OffsetCurve(Curve=item_35.Item, Distance=addition_21, Corners=1)
offcrv_3 = OffsetCurve(Curve=item_35.Item, Plane=PlaneXY(0, 0, 0), Distance=round_10.Ceiling, BothSides=0, Kinks=0, CapType=1)
curvepoint_7 = PointOnCurve(offset_13, parameter=0.5)
evalsrf_4 = EvaluateSurface(Surface=reparameterize(offcrv_3), Point="0,0,0")  # -> Point, Normal, UDirection, VDirection, Frame
dom_10 = ConstructDomain(DomainStart=0, DomainEnd=round_10.Ceiling)
dom_11 = ConstructDomain(DomainStart=0, DomainEnd=division_41)
series_4 = Series(Start="0", Step=1, Count=lng_9)
rectangle_7 = Rectangle(Plane=evalsrf_4.Point, XSize=dom_11, YSize=dom_10, Radius=0)  # -> simplify(Rectangle), Length
repeat_3 = RepeatData(Data=division_41, Length=lng_9)
flip_5 = FlipMatrix(Data=repeat_3)
repeat_4 = RepeatData(Data=flip_5, Length=graft(series_4))  # -> simplify(Data)
ma_4 = MassAddition(Input=repeat_4)  # -> Result, PartialResults
list_23 = ValueList({"CheckIn": 0, "BagDrop": 1, "Security": 2, "Immigration": 3, "Verification": 4, "Boarding": 5}, selected="Boarding")
list_24 = ValueList({"3 Seat Module": 3, "4 Seat Module": 4, "5 Seat Module": 5}, selected="3 Seat Module")
nullrep = ReplaceNulls(Items=ma_4.Result, Replacements="0")  # -> Items, Count
X_14 = UnitX(Factor=nullrep.Items)

move_23 = Move(Geometry=simplify(rectangle_7.Rectangle), Motion=simplify(X_14))  # -> Geometry, Transform
Y_12 = UnitY(Factor=expr("-x", "3"))
move_24 = Move(Geometry=simplify(move_23.Geometry), Motion=simplify(Y_12))  # -> Geometry, Transform
area_13 = Area(Geometry=move_24.Geometry)  # -> Area, Centroid
X_15 = UnitX(Factor=1)
srf_8 = Surface(move_24.Geometry)
line_10 = LineSDL(Start=area_13.Centroid, Direction=X_15, Length=expr("x/2", division_41))
line_11 = LineSDL(Start=area_13.Centroid, Direction=expr("-x", X_15), Length=expr("x/2", division_41))
join_4 = JoinCurves(Curves=[line_10, line_11], Preserve=False)  # -> simplify(Curves)
flip_6 = FlipCurve(Curve=join_4)  # -> Curve, Flag
textsrf_5 = TextOnSurface(
    Text=graft(size_6.EquipmentNames),
    Font="Sans Bold:no Italic:no",
    Height="2",
    Depth=0.1,
    BaseLine=flip_6.Curve,
    BaseSurface=srf_8)

srf_9 = Surface(flatten(move_24.Geometry))
preview_5 = CustomPreview(Geometry=srf_9, Material=concat_5)
crv_6 = Curve(offset_13)
item_36 = ListItem(List=srf_9, Index=0, Wrap=True)  # -> Item, Item1, Item2, Item3
c_bake_16 = ContextBake(RetailZone_47_43_38_200=flatten(textsrf_5))
c_bake_17 = ContextBake(RetailSurface1_216_67_30_150=flatten(item_36.Item))
c_bake_18 = ContextBake(RetailSurface2_246_99_62_150=flatten(item_36.Item1))
c_bake_19 = ContextBake(RetailSurface3_255_141_112_150=flatten(item_36.Item2))
c_bake_20 = ContextBake(RetailSurface4_253_189_173_150=flatten(item_36.Item3))
subtraction_19 = Subtraction(A="18", B="3")
division_42 = Division(A=subtraction_19, B=addition_5)
round_11 = Round(Number=division_42)  # -> Nearest, Floor, Ceiling
series_5 = Series(Start=0, Step=addition_5, Count=round_11.Ceiling)
X_16 = UnitX(Factor=series_5)
move_25 = Move(Geometry=group, Motion=X_16)  # -> Geometry, Transform

b_std = BoardingStandards(
    CriticalAircraftCapacity=boarding_inputs_critical_aircraft_capaci,
    PassengerLoadFactor=division_7,
    TurnaroundTime=boarding_inputs_turnaround_time_min,
    GateUtilization=division_8,
    GateShowUpRate=division_9,
    SeatingProvision=division_10)
tpl_7 = FacilityTemplate(FacilityType=list_23)  # -> Template, AvailableTopologies
size_7 = FacilitySizer(Passengers=dwell.Passengers, Standards=b_std, Template=tpl_7.Template)  # -> SizingResult, TotalArea, QueueArea, ProcessingArea, CirculationArea, Topology, Advice, EquipmentNames, EquipmentCounts
item_37 = ListItem(List=size_7.EquipmentCounts, Index=0, Wrap=True)  # -> Item, Item1, Item2, Item3
panel_48 = Panel(size_7.EquipmentNames)
panel_49 = Panel(size_7.EquipmentCounts)
panel_50 = Panel(size_7.Advice)

report_5 = FacilityReporter(FacilityType=list_16, SizingResult=size_7.SizingResult, TargetWait95=10)  # -> LevelOfService, ExecutiveSummary
panel_51 = Panel(report_5.ExecutiveSummary)
c_print_11 = ContextPrint(BoardingGatesSummary=report_5.ExecutiveSummary)
filter_15 = StreamFilter(Gate=boarding_inputs_optimise_boarding_gates, Stream0=boarding_inputs_seating_islands_per_gate_2, Stream1=item_37.Item)

multiplication_34 = Multiplication(A="18", B=filter_15)
X_17 = UnitX(Factor=expr("-x/2", multiplication_34))
line_12 = LineSDL(Start=curvepoint_7, Direction=expr("-x", X_17), Length=X_17)
line_13 = LineSDL(Start=curvepoint_7, Direction=X_17, Length=X_17)
join_5 = JoinCurves(Curves=[line_13, line_12], Preserve=False)

divide_4 = DivideCurve(Curve=join_5, Count=filter_15, Kinks=False)  # -> Points, Tangents, Parameters
shatter_4 = Shatter(Curve=join_5, Parameters=divide_4.Parameters)
division_43 = Division(A=size_7.ProcessingArea, B=filter_15)
len_6 = Length(Curve=shatter_4)
division_44 = Division(A=division_43, B=len_6)
offcrv_4 = OffsetCurve(Curve=shatter_4, Plane=PlaneXY(0, 0, 0), Distance=expr("x", division_44), BothSides=0, Kinks=0, CapType=1)

eval_5 = EvaluateCurve(Curve=reparameterize(shatter_4), Parameter=Slider(0.15, range=0..1))  # -> Point, Tangent, Angle
xprod = CrossProduct(VectorA=eval_5.Tangent, VectorB=Z_3, Unitize=False)  # -> Vector, Length
line_14 = LineSDL(Start=eval_5.Point, Direction=xprod.Vector, Length="20")
len_7 = Length(Curve=shatter_4)
c_script_5 = CSharpScript(TargetSeats=item_37.Item1, ModuleSizes=panel_23)  # -> out, BestLayoutText, BestIslandCounts, AllOptions; inputs TargetSeats: Int32, ModuleSizes: list of Int32
# ---------- c_script_5: C# ----------
// Grasshopper Script Instance
#region Usings
using System;
using System.Linq;
using System.Collections;
using System.Collections.Generic;
using System.Drawing;

using Rhino;
using Rhino.Geometry;

using Grasshopper;
using Grasshopper.Kernel;
using Grasshopper.Kernel.Data;
using Grasshopper.Kernel.Types;
#endregion

public class Script_Instance : GH_ScriptInstance
{
    #region Notes
    /* 
      Members:
        RhinoDoc RhinoDocument
        GH_Document GrasshopperDocument
        IGH_Component Component
        int Iteration

      Methods (Virtual & overridable):
        Print(string text)
        Print(string format, params object[] args)
        Reflect(object obj)
        Reflect(object obj, string method_name)
    */
    #endregion

   private void RunScript(
		int TargetSeats,
		List<int> ModuleSizes,
		ref object BestLayoutText,
		ref object BestIslandCounts,
		ref object AllOptions)
{
    if (TargetSeats <= 0 || ModuleSizes == null || ModuleSizes.Count == 0)
    {
        Print("Please provide a valid Target Seat count and a list of Module Sizes.");
        return;
    }

    // 1. Convert "Module Sizes" (e.g., 3) into "Island Sizes" (e.g., 6) since they are paired back-to-back
    int[] moduleSizes = ModuleSizes.ToArray();
    int[] islandSizes = ModuleSizes.Select(m => m * 2).ToArray();
    
    List<SeatingLayout> validLayouts = new List<SeatingLayout>();

    // 2. Auto-expanding search limit: We will search up to the size of the largest island
    // This guarantees we NEVER break, even if you only input a single module size!
    int maxSearchLimit = TargetSeats + islandSizes.Max();

    // 3. RECURSIVE SEARCH ALGORITHM
    Action<int[], int, int> Search = null;
    Search = (currentCounts, currentIndex, currentSeats) =>
    {
        // Base Case: We have assigned a count to every island size in the list
        if (currentIndex == islandSizes.Length)
        {
            // Keep any combination that hits the target or overshoots within the safe limit
            if (currentSeats >= TargetSeats && currentSeats <= maxSearchLimit)
            {
                int totalIslands = currentCounts.Sum();
                
                // SCORING LOGIC:
                // Multiply extra seats by 100 so accuracy is the #1 priority.
                // Add the total islands so if two layouts have the same seats, it picks the one with fewer, larger islands.
                int penalty = ((currentSeats - TargetSeats) * 100) + totalIslands;
                
                validLayouts.Add(new SeatingLayout {
                    Counts = (int[])currentCounts.Clone(),
                    TotalSeats = currentSeats,
                    TotalIslands = totalIslands,
                    PenaltyScore = penalty
                });
            }
            return;
        }

        // Calculate the maximum number of THIS island we could possibly fit
        int maxCount = maxSearchLimit / islandSizes[currentIndex];
        
        for (int i = 0; i <= maxCount; i++)
        {
            currentCounts[currentIndex] = i;
            Search(currentCounts, currentIndex + 1, currentSeats + (i * islandSizes[currentIndex]));
        }
    };

    // Start the search
    Search(new int[islandSizes.Length], 0, 0);

    if (validLayouts.Count == 0)
    {
        BestLayoutText = "Error: Could not calculate a layout.";
        return;
    }

    // 4. Sort by the best score
    validLayouts = validLayouts.OrderBy(l => l.PenaltyScore).ToList();
    SeatingLayout best = validLayouts.First();

    // 5. FORMAT THE OUTPUTS FOR GRASSHOPPER
    List<string> bestParts = new List<string>();
    for (int i = 0; i < moduleSizes.Length; i++)
    {
        if (best.Counts[i] > 0)
        {
            bestParts.Add($"{best.Counts[i]}x [{moduleSizes[i]}-Seat Islands]");
        }
    }

    BestLayoutText = $"BEST: {best.TotalSeats} Seats | " + string.Join(", ", bestParts);
    
    // Output the raw integer counts of ISLANDS so you can plug them into your Array components
    BestIslandCounts = best.Counts.ToList();

    // Format the list of all options for the user to review
    List<string> optionsList = new List<string>();
    foreach (var l in validLayouts)
    {
        List<string> p = new List<string>();
        for (int i = 0; i < moduleSizes.Length; i++) 
        {
            if (l.Counts[i] > 0) p.Add($"{l.Counts[i]}x [{moduleSizes[i]}-Seat]");
        }
        optionsList.Add($"{l.TotalSeats} Seats ({l.TotalIslands} Islands) -> {string.Join(", ", p)}");
    }
    
    AllOptions = optionsList;
}

// <Custom additional code> 
private class SeatingLayout
{
    public int[] Counts { get; set; }
    public int TotalSeats { get; set; }
    public int TotalIslands { get; set; }
    public int PenaltyScore { get; set; }
}
// </Custom additional code>
// </Custom additional code>
}
# ---------- end c_script_5 ----------
division_45 = Division(A=item_37.Item1, B=list_24)
ma_5 = MassAddition(Input=len_7)  # -> Result, PartialResults
round_12 = Round(Number=division_45)  # -> Nearest, Floor, Ceiling
division_46 = Division(A=size_7.CirculationArea, B=ma_5.Result)
filter_16 = StreamFilter(
    Gate=boarding_inputs_optimise_seating_per_gat,
    Stream0=boarding_inputs_seating_islands_per_gate,
    Stream1=c_script_5.BestIslandCounts)
filter_17 = StreamFilter(Gate=boarding_inputs_optimise_seating_per_gat, Stream0=offcrv_4, Stream1=offcrv_4)
offset_14 = OffsetCurve(Curve=shatter_4, Distance=expr("-x", division_46), Corners=1)
brec_29 = BoundingRectangle(Geometry=filter_17, Plane=PlaneXY(0, 0, 0), Axis=0, Slide=0, Union=True)  # -> Bounding, simplify(DimensionX), DimensionY
addition_22 = Addition(A=division_46)
ma_6 = MassAddition(Input=filter_16)  # -> Result, PartialResults
offset_15 = OffsetCurve(Curve=crv_6, Distance=expr("-x", addition_22), Corners=1)
area_14 = Area(Geometry=brec_29.Bounding)  # -> Area, simplify(Centroid)
offset_16 = OffsetCurve(Curve=brec_29.Bounding, Distance=expr("-x", "0.1"), Corners=1)
boundary_7 = BoundarySurfaces(Edges=flatten([brec_29.Bounding, offset_16]))
division_47 = Division(A=ma_6.Result, B=round_11.Ceiling)
mod = Modulus(A=ma_6.Result, B=round_11.Ceiling)
round_13 = Round(Number=division_47)  # -> Nearest, Floor, Ceiling
larger = LargerThan(FirstNumber=mod, SecondNumber="1")  # -> LargerThan, OrEqualTo
panel_52 = Panel(division_47)
brec_30 = BoundingRectangle(
    Geometry=flatten([brec_27.Bounding, brec_25.Bounding, rectangle.Rectangle, move_24.Geometry, offset_15]),
    Plane=PlaneXY(0, 0, 0),
    Axis=0,
    Slide=0,
    Union=True)  # -> Bounding, DimensionX, DimensionY
brec_31 = BoundingRectangle(Geometry=flatten([offset_14, brec_29.Bounding]), Plane=PlaneXY(0, 0, 0), Axis=0, Slide=0, Union=True)  # -> Bounding, DimensionX, DimensionY
runion_3 = RegionUnion(Curves=[brec_30.Bounding, brec_31.Bounding])
offcrv_5 = OffsetCurve(Curve=runion_3, Plane=PlaneXY(0, 0, 0), Distance="0.3", BothSides=0, Kinks=0, CapType=1)
series_6 = Series(Start=0, Step=addition_6, Count=round_13.Ceiling)
boundary_8 = BoundarySurfaces(Edges=flatten([runion_3, offcrv_5]))
X_18 = UnitX(Factor=series_6)
Y_13 = UnitY(Factor=series_6)
move_26 = Move(Geometry=graft(move_25.Geometry), Motion=Y_13)  # -> Geometry, Transform
flip_7 = FlipMatrix(Data=move_26.Geometry)
lng_10 = ListLength(List=flip_7)  # -> simplify(Length)
lng_11 = ListLength(List=flatten(lng_10))  # -> simplify(Length)
mod_2 = Modulus(A=ma_6.Result, B=round_11.Ceiling)
equals = Equality(FirstNumber=mod_2, SecondNumber="0")  # -> Equality, Inequality
panel_53 = Panel(flip_7)
filter_18 = StreamFilter(Gate=equals.Equality, Stream0=mod_2, Stream1=round_11.Ceiling)
replace = ReplaceItems(List=flatten(lng_10), Item=filter_18, Indices="0", Wrap=False)  # -> simplify(graft(List))
repeat_5 = RepeatData(Data=flip_7, Length=replace)
brec_32 = BoundingRectangle(Geometry=flatten(repeat_5), Plane=PlaneXY(0, 0, 0), Axis=0, Slide=0, Union=True)  # -> Bounding, DimensionX, DimensionY
area_15 = Area(Geometry=brec_32.Bounding)  # -> Area, Centroid
group_3 = Group(Geometry=flatten(repeat_5))
move2pt_5 = MoveToPoint(Geometry=group_3, PointA=area_15.Centroid, PointB=area_14.Centroid)  # -> Moved, Vector, Transform
preview_6 = CustomPreview(Geometry=boundary_8, Material=concat_12)
c_bake_21 = ContextBake(GatesBoundary_179_57_26_150=flatten(boundary_7))
c_bake_22 = ContextBake(OuterBoundary_0_0_0_150=flatten(boundary_8))
c_bake_23 = ContextBake(Seats_179_57_26_150=flatten(move2pt_5.Moved))

# ==== cluster Cluster
N = ClusterInput()
C = ClusterInput()
O = ClusterInput()
relay = ClusterInput()
series = Series(Start=0, Step=N, Count=C)
yz = YZPlane(Origin=O)
X = UnitX(Factor=series)
mirror = Mirror(Geometry=relay, Plane=yz)  # -> Geometry, Transform
division = Division(A=C, B="2")
move = Move(Geometry=relay, Motion=X)  # -> Geometry, Transform
move_2 = Move(Geometry=mirror.Geometry, Motion=X)  # -> Geometry, Transform
dispatch = Dispatch(List=move.Geometry, DispatchPattern=[True, False])  # -> ListA, ListB
dispatch_2 = Dispatch(List=move_2.Geometry, DispatchPattern=[True, False])  # -> ListA, ListB
weave = Weave(Pattern=[0, 1], Stream0=dispatch.ListA, Stream1=dispatch_2.ListB, NullGaps=False)
geo = Geometry(weave)
brec = BoundingRectangle(Geometry=geo, Plane=PlaneXY(0, 0, 0), Axis=0, Slide=0, Union=True)  # -> Bounding, DimensionX, DimensionY
explode = Explode(Curve=brec.Bounding, Recursive=True)  # -> Segments, Vertices
A = ClusterInput()
A_2 = ClusterInput()
item = ListItem(List=explode.Segments, Index=0, Wrap=True)  # -> Item2, Item1, Item
crv = Curve(item.Item2)
divide = DivideCurve(Curve=crv, Count=division, Kinks=False)  # -> Points, Tangents, Parameters
shatter = Shatter(Curve=crv, Parameters=divide.Parameters)
len = Length(Curve=crv)
len_2 = Length(Curve=shatter)
curvepoint = PointOnCurve(shatter, parameter=1)
division_2 = Division(A=A, B=len)
division_3 = Division(A=A_2, B=len)
rectangle = Rectangle(Plane=curvepoint, XSize=len_2, YSize=division_2, Radius=0)  # -> Rectangle, Length
Y = UnitY(Factor=division_3)
geo_2 = ClusterOutput(geo)
R = ClusterOutput(rectangle.Rectangle)
V = ClusterOutput(Y)
