# Grasshopper definition TerminalAutomation_WebApp.ghx (Grasshopper 1.0.8)
# plug-ins: Pufferfish, ShapeDiverForGrasshopper, eleFront, Wombat, AirportPlanning

level_of_service = ValueList({"A": 1, "B": 2, "C": 3, "D": 4, "E": 5, "F": 6}, selected="C")
wait_ciculatearea_m2 = Panel("""2.7
2.3
1.9
1.5
1.0
1.0""")
check_in_area_m2 = Panel("""1.6
1.4
1.2
1.0
0.8
0.5""")
panel = Panel("""A
B
C
D
E
F""")
max_wait_min = Panel("20")

# ---- group: Planning Inputs
avg_processing_min = Panel("2.5")
p_departing = Slider(80, range=20..80)
p_staffed_desk = Slider(80, range=20..80)
p_using_checkin = Slider(70, range=20..80)

# ----
check_in_counters = Slider(124, range=60..150)

# ----
# Planning Inputs
annual_pax_million = Slider(30, range=1..50)

# ---- group: IATA Inputs
level_of_service_2 = GetInteger(
    level_of_service,
    {"A": 1, "B": 2, "C": 3, "D": 4, "E": 5, "F": 6}, selected=[],
    AtLeast=1,
    AtMost=6,
    Maximum=2147483647,
    Minimum=-2147483648,
    TreeAccess=False)
avg_process_time_min_for_check_in = GetNumber(avg_processing_min, AtLeast=1, AtMost=1, Maximum=1.797693135e+308, Minimum=-1.797693135e+308, TreeAccess=False)
avg_process_time_min_for_check_in_2 = GetNumber(max_wait_min, AtLeast=1, AtMost=1, Maximum=1.797693135e+308, Minimum=-1.797693135e+308, TreeAccess=False)

# ---- group: Planning Inputs
passenger_departing = GetInteger(p_departing, AtLeast=20, AtMost=80, Maximum=2147483647, Minimum=-2147483648, TreeAccess=False)
staffed_desk = GetInteger(p_staffed_desk, AtLeast=20, AtMost=80, Maximum=2147483647, Minimum=-2147483648, TreeAccess=False)
passengers_using_check_in = GetInteger(p_using_checkin, AtLeast=20, AtMost=80, Maximum=2147483647, Minimum=-2147483648, TreeAccess=False)
annual_pax_million_2 = GetInteger(annual_pax_million, AtLeast=1, AtMost=50, Maximum=2147483647, Minimum=-2147483648, TreeAccess=False)

# ----
subtraction = Subtraction(A=level_of_service_2, B="1")
item = ListItem(List=panel, Index=subtraction, Wrap=True)
item_2 = ListItem(List=check_in_area_m2, Index=subtraction, Wrap=True)
item_3 = ListItem(List=wait_ciculatearea_m2, Index=subtraction, Wrap=True)

# ---- group: Spatial Inputs
list = ValueList({"Config A:Perpendicular to Movement": 0, "Config B:Parallel to Movement": 1}, selected="Config B:Parallel to Movement")
config_b_max_counters_in_line = Panel("15")
config_a_max_counters_in_line = Panel("35")

boundary_dimensions_x = Slider(180, range=50..300)
boundary_dimensionsy = Slider(44, range=10..100)
total_check_in_counters = GetInteger(check_in_counters, AtLeast=60, AtMost=150, Maximum=2147483647, Minimum=-2147483648, TreeAccess=False)

# ----
no_of_entry_gates = Slider(4, range=2..30)
pt = Point(Point(0, 0, 0))
xy = XYPlane(Origin=pt)

# ---- group: Spatial Inputs
boundary_dimensions_x_2 = GetInteger(boundary_dimensions_x, AtLeast=50, AtMost=300, Maximum=2147483647, Minimum=-2147483648, TreeAccess=False)
orientation_of_check_in_counters = GetInteger(
    list,
    {"Config A:Perpendicular to Movement": 0, "Config B:Parallel to Movement": 1}, selected=[],
    AtLeast=1,
    AtMost=1,
    Maximum=2147483647,
    Minimum=-2147483648,
    TreeAccess=False)
boundary_dimensions_y = GetInteger(boundary_dimensionsy, AtLeast=10, AtMost=100, Maximum=2147483647, Minimum=-2147483648, TreeAccess=False)
max_counters_in_a_row = GetInteger(config_a_max_counters_in_line, AtLeast=1, AtMost=1, Maximum=2147483647, Minimum=-2147483648, TreeAccess=False)
max_counters_in_a_columns = GetInteger(config_b_max_counters_in_line, AtLeast=1, AtMost=1, Maximum=2147483647, Minimum=-2147483648, TreeAccess=False)
no_of_entry_gates_2 = GetInteger(no_of_entry_gates, AtLeast=10, AtMost=100, Maximum=2147483647, Minimum=-2147483648, TreeAccess=False)

# ----
dom = ConstructDomain(DomainStart=0, DomainEnd=boundary_dimensions_x_2)
dom_2 = ConstructDomain(DomainStart=0, DomainEnd=boundary_dimensions_y)
rectangle = Rectangle(Plane=xy, XSize=dom, YSize=dom_2, Radius=0)  # -> Rectangle, Length
disc = Discontinuity(Curve=rectangle.Rectangle, Level=1)  # -> Points, Parameters
shatter = Shatter(Curve=rectangle.Rectangle, Parameters=disc.Parameters)
item_4 = ListItem(List=shatter, Index=0, Wrap=True)  # -> Item2, Item1, Item
range = Range(Domain=Domain(0, 1), Steps=expr("x*2", no_of_entry_gates_2))
offset = OffsetCurve(Curve=rectangle.Rectangle, Distance=expr("-x/2", "0.4"), Corners=1)
crv = Curve(item_4.Item2)
boundary = BoundarySurfaces(Edges=flatten([offset, rectangle.Rectangle]))
dispatch = Dispatch(List=range, DispatchPattern=[True, False])  # -> ListA, ListB
eval = EvaluateCurve(Curve=reparameterize(crv), Parameter=dispatch.ListB)  # -> Point, Tangent, Angle

filter = StreamFilter(Gate=orientation_of_check_in_counters, Stream0=max_counters_in_a_row, Stream1=max_counters_in_a_columns)
c_bake = ContextBake(BoundaryInput_155_171_32=boundary)
sort_pt = SortPoints(Points=eval.Point)  # -> Points, Indices

dom_3 = ConstructDomain(DomainStart=expr("-x", "0"), DomainEnd="6")
dom_4 = ConstructDomain(DomainStart=expr("-x", "6"), DomainEnd="6")
X = UnitX(Factor=1)
rectangle_2 = Rectangle(Plane=sort_pt.Points, XSize=dom_4, YSize=dom_3, Radius=0)  # -> Rectangle, Length
area = Area(Geometry=rectangle_2.Rectangle)  # -> Area, Centroid
srf = Surface(rectangle_2.Rectangle)
X_2 = UnitX(Factor=expr("-x", "6"))
move = Move(Geometry=area.Centroid, Motion=X_2)  # -> Geometry, Transform
line = LineSDL(Start=move.Geometry, Direction=X, Length=expr("x*2", "6"))

index = ItemIndex(List=sort_pt.Points, Item=sort_pt.Points)
_2checkin_module = Curve(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)
list_2 = ValueList({"Domestic": 0, "International": 1}, selected="Domestic")
list_3 = ValueList({"Origin": 0, "Transfer": 1, "Destination": 2}, selected="Origin")
list_4 = ValueList({"Domestic": 0, "International": 1}, selected="International")
list_5 = ValueList({"Origin": 0, "Transfer": 1, "Destination": 2}, selected="Origin")
ap = ArrivalProfile(Peak="120", Sigma="1.5")
addition = Addition(A=index, B="1")
ap_2 = ArrivalProfile(Peak="180", Sigma="2.5")
concat = Concatenate(FragmentA="Gate ", FragmentB=addition)
random_seed = Panel("5")
wp = WalkingProfile(AverageSpeed="1.35", StandardDeviation="1")
multiplication = Multiplication(A="10", B="2")
brec = BoundingRectangle(Geometry=rectangle.Rectangle, Plane=PlaneXY(0, 0, 0), Axis=0, Slide=0, Union=True)  # -> Bounding, DimensionX, DimensionY
multiplication_2 = Multiplication(A="20", B="2")

expression = Expression(x=annual_pax_million_2, Expression="0.002*(1/x^(1/2))")
multiplication_3 = Multiplication(A=annual_pax_million_2, B="1000000")
multiplication_4 = Multiplication(A=expression, B=multiplication_3)
roundf = RoundToFactor(NumberX=multiplication_4, Factor="200", RoundType=0)  # -> Rounded, Difference, MultiplierR, MultiplierX
dhp = Integer(roundf.Rounded)

pp = PassengerProfile(
    Name="Domestic Economy",
    Percentage=Slider(100, range=0..100),
    PassengerType=list_2,
    Journey=list_3,
    OnlineCheckInProbability=Slider(0.3, range=0.1..1),
    CheckedBagProbability=Slider(0.3, range=0.1..1),
    ServiceTimeMultiplier=1,
    ArrivalProfile=ap)
pp_2 = PassengerProfile(
    Name="International Leisure",
    Percentage=Slider(100, range=0..100),
    PassengerType=list_4,
    Journey=list_5,
    OnlineCheckInProbability=Slider(0.1, range=0.1..1),
    CheckedBagProbability=Slider(0.1, range=0.1..1),
    ServiceTimeMultiplier=1,
    ArrivalProfile=ap_2)
pd = PassengerDemand(DesignHourDemand=dhp, DeparturePercentage=Slider(70, range=0..100), DomesticPercentage=Slider(50, range=0..100))
subtraction_2 = Subtraction(A=brec.DimensionX, B=multiplication_2)
subtraction_3 = Subtraction(A=brec.DimensionY, B=multiplication)
area_2 = Area(Geometry=brec.Bounding)  # -> Area, Centroid
pg = PassengerGenerator(
    PassengerDemand=pd,
    DomesticProfiles=pp,
    InternationalProfiles=pp_2,
    DepartureMinute="800",
    SimulationHorizon="300",
    WalkingProfile=wp,
    RandomSeed=random_seed)  # -> Passengers, PassengerGenerationResult, ArrivalSimulations
avg_processing_min_2 = Panel("2.5")
min_passenger = Panel("1.5")
target_wait_min = Panel("20")
staffing = Slider(100, range=0..100)
division = Division(A=subtraction_2, B=brec.DimensionX)
division_2 = Division(A=subtraction_3, B=brec.DimensionY)
optimize_counters = BooleanToggle(True)
Z = UnitZ(Factor="0.1")
integer_division = IntegerDivision(A=total_check_in_counters, B=filter)

brec_2 = BoundingRectangle(Geometry=_2checkin_module, Plane=PlaneXY(0, 0, 0), Axis=0, Slide=0, Union=True)  # -> Bounding, DimensionX, DimensionY
brec_3 = BoundingRectangle(Geometry=rectangle.Rectangle, Plane=PlaneXY(0, 0, 0), Axis=0, Slide=0, Union=True)  # -> Bounding, DimensionX, DimensionY
division_3 = Division(A=total_check_in_counters, B="2")
series = Series(Start=0, Step=brec_2.DimensionX, Count=expr("x/2", total_check_in_counters))
division_4 = Division(A=division_3, B=integer_division)
division_5 = Division(A=brec_3.DimensionX, B=integer_division)
round = Round(Number=division_4)  # -> Nearest, Floor, Ceiling
int = Integer(division_5)
c_script = CSharpScript(x=integer_division, y=round.Ceiling)  # -> out, PartitionSize, a; inputs x: Int32, y: Int32
# ---------- c_script: C# ----------
// Grasshopper Script Instance
#region Usings
using System;
using System.Linq;
using System.Collections;
using System.Collections.Generic;
using System.Drawing;

using Rhino;
using Rhino.Geometry;

using Grasshopper;
using Grasshopper.Kernel;
using Grasshopper.Kernel.Data;
using Grasshopper.Kernel.Types;
#endregion

public class Script_Instance : GH_ScriptInstance
{
    #region Notes
    /* 
      Members:
        RhinoDoc RhinoDocument
        GH_Document GrasshopperDocument
        IGH_Component Component
        int Iteration

      Methods (Virtual & overridable):
        Print(string text)
        Print(string format, params object[] args)
        Reflect(object obj)
        Reflect(object obj, string method_name)
    */
    #endregion

    private void RunScript(int x, int y, ref object PartitionSize, ref object a)
    {   
        int index;
        List<int> ListSize=new List<int>();
        if(x%2==0)
        {
            index=x/2;
        }
        else
         {index=(x+1)/2;
         }
         for(int i=0;i<x;i++)
         {
            if((x%2)!=0)
            {
            if(i==(index-1))
            ListSize.Add(y-(y%x));
            else
            ListSize.Add(y);
            }
            else
            {if(i==index-1)
            ListSize.Add(y-(y%x));
            else if(i==index)
            ListSize.Add(y-(y%x));
            else
            ListSize.Add(y);
            }
         }
        PartitionSize=ListSize;
    }
}
# ---------- end c_script ----------
range_2 = Range(Domain=Domain(0, 1), Steps=expr("x-1", integer_division))  # -> expr("x", Range)
series_2 = Series(Start=0, Step=int, Count=integer_division)

disc_2 = Discontinuity(Curve=brec_3.Bounding, Level=1)  # -> Points, Parameters
shatter_2 = Shatter(Curve=brec_3.Bounding, Parameters=disc_2.Parameters)
item_5 = ListItem(List=shatter_2, Index=0, Wrap=True)  # -> Item1, Item, Item1_2, Item2
crv_2 = Curve(item_5.Item)

scale_nu = ScaleNU(Geometry=brec.Bounding, Plane=area_2.Centroid, ScaleX=division, ScaleY=division_2, ScaleZ=1)  # -> Geometry, Transform
sp = ServiceProfile(MeanServiceTime=avg_processing_min_2, StandardDeviation=min_passenger)
dim = Dimensions(Surface=scale_nu.Geometry)  # -> UDimension, VDimension
explode = Explode(Curve=scale_nu.Geometry, Recursive=True)  # -> Segments, Vertices
drec = DeconstructRectangle(Rectangle=scale_nu.Geometry)  # -> BasePlane, XInterval, YInterval
pdt = PassengerDetails(Passengers=pg.Passengers)  # -> PassengerID, ArrivalTime, ServiceTime, StartService, EndService, WaitingTime, AssignedCounter, WalkingSpeed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
avg_processing_min_3 = Panel("1.5")
min_passenger_2 = Panel("0.5")
division_6 = Division(A=brec_2.DimensionX, B="2")
chk = CheckIn(
    Passengers=pg.Passengers,
    ServiceProfile=sp,
    CheckInCounters="8",
    OptimizeCounters=optimize_counters,
    TargetWait=target_wait_min,
    StaffingPercentage=staffing,
    RandomSeed=random_seed)  # -> Passengers, CheckInPassengers, QueueResults, CountersUsed, PeakQueueLength, AverageWait, MaximumWait, _95thPercentileWait, CounterUtilization

list_6 = ValueList({"Island", "Linear", "Flow-Through"}, selected="Flow-Through")
list_7 = ValueList({"CheckIn": 0, "BagDrop": 1, "Security": 2, "Immigration": 3}, selected="CheckIn")
division_7 = Division(A=brec_2.DimensionX, B="2")
tpl = FacilityTemplate(FacilityType=list_7, TopologyOverride=list_6)  # -> Template, AvailableTopologies
std = FacilityStandards(
    FacilityType=list_7,
    QueueAreaPax=Slider(1.3, range=1.3..1.8),
    ProcessorWidth=division_7,
    ProcessorDepth=brec_2.DimensionY,
    ProcessorPitch=division_7,
    Circulation=25,
    Support=10)
size = FacilitySizer(OperationalResults=chk.QueueResults, Passengers=chk.Passengers, Standards=std, Template=tpl.Template)  # -> SizingResult, TotalArea, QueueArea, ProcessingArea, CirculationArea, Topology, Advice
panel_2 = Panel(size.QueueArea)

c_bake_2 = ContextBake(Gates_155_171_32=srf)
c_bake_3 = ContextBake(Gates_46_61_122=srf)
division_8 = Division(A=dim.VDimension, B=division_6)
panel_3 = Panel(pdt.ArrivalTime)
sp_2 = ServiceProfile(MeanServiceTime=avg_processing_min_3, StandardDeviation=min_passenger_2)
round_2 = Round(Number=division_8)  # -> Nearest, Floor, Ceiling
item_6 = ListItem(List=explode.Segments, Index=0, Wrap=True)  # -> Item, Item1, Item2
division_9 = Division(A=brec_2.DimensionX, B="2")

divide = DivideCurve(Curve=crv_2, Count=integer_division, Kinks=False)  # -> Points, Tangents, Parameters
item_7 = ListItem(List=divide.Points, Index=0, Wrap=True)
cull_ends = CullEnds(List=divide.Points)  # -> List, Culled
cp = ClosestPoint(Point=eval.Point, Cloud=cull_ends.List)  # -> ClosestPoint, CPIndex, Distance
ln = Line(StartPoint=eval.Point, EndPoint=cp.ClosestPoint)

staffing_2 = Slider(100, range=0..100)
optimize_counters_2 = BooleanToggle(True)
min = Minimum(A=round_2.Nearest, B=filter)
target_wait_min_2 = Panel("10")
pdt_2 = PassengerDetails(Passengers=chk.Passengers)  # -> PassengerID, ArrivalTime, ServiceTime, StartService, EndService, WaitingTime, AssignedCounter, WalkingSpeed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
multiplication_5 = Multiplication(A=min, B="2")
bd = BagDrop(
    Passengers=chk.Passengers,
    ServiceProfile=sp_2,
    BagDropCounters=8,
    OptimizeCounters=optimize_counters_2,
    TargetWait=target_wait_min_2,
    StaffingPercentage=staffing_2,
    RandomSeed=random_seed)  # -> Passengers, QueueResults, PhysicalCounters
panel_4 = Panel(pdt_2.ArrivalTime)

list_8 = ValueList({"CheckIn": 0, "BagDrop": 1, "Security": 2, "Immigration": 3, "Verification": 4}, selected="BagDrop")
list_9 = ValueList({"Island", "Linear", "Flow-Through"}, selected="Flow-Through")
division_10 = Division(A=brec_2.DimensionX, B="2")
tpl_2 = FacilityTemplate(FacilityType=list_8)  # -> Template, AvailableTopologies
std_2 = FacilityStandards(
    FacilityType=list_8,
    QueueAreaPax=Slider(1.3, range=1.3..1.8),
    ProcessorWidth=division_10,
    ProcessorDepth=brec_2.DimensionY,
    ProcessorPitch=division_10,
    Circulation=25,
    Support=10)
panel_5 = Panel(tpl_2.AvailableTopologies)
size_2 = FacilitySizer(OperationalResults=bd.QueueResults, Passengers=bd.Passengers, Standards=std_2, Template=tpl_2.Template)  # -> SizingResult, TotalArea, QueueArea, ProcessingArea, CirculationArea, Topology, Advice
panel_6 = Panel(size_2.ProcessingArea)

division_11 = Division(A=total_check_in_counters, B=multiplication_5)
from_facility = ValueList({"CheckIn", "BagDrop", "Immigration", "Security"}, selected="CheckIn")
from_facility_2 = ValueList({"CheckIn", "BagDrop", "Immigration", "Security"}, selected="BagDrop")
round_3 = Round(Number=division_11)  # -> Nearest, Floor, Ceiling
eligible = Slider(100, range=0..100)
wlk = Walking(Passengers=bd.Passengers, Distance="50", WalkingSpeed=wp, FromFacility=from_facility, ToFacility=from_facility_2)
division_12 = Division(A=brec_2.DimensionX, B="2")
divide_2 = DivideCurve(Curve=item_6.Item2, Count=expr("x-1", round_3.Nearest), Kinks=False)  # -> reverse(Points), Tangents, Parameters
divide_3 = DivideCurve(Curve=item_6.Item, Count=expr("x-1", round_3.Nearest), Kinks=False)  # -> Points, Tangents, Parameters
Y = UnitY(Factor=1)
multiplication_6 = Multiplication(A=min, B=division_12)
ver = PassengerVerification(Passengers=wlk, EligiblePercentage=eligible, ThroughputPerGate=300, DesignUtilization=0.85)  # -> Passengers, VerificationResults, RequiredGates, EligiblePassengers
line_2 = LineSDL(Start=divide_2.Points, Direction=expr("-x", Y), Length=multiplication_6)
from_facility_3 = ValueList({"CheckIn", "BagDrop", "Immigration", "Security"}, selected="BagDrop")
from_facility_4 = ValueList({"CheckIn", "BagDrop", "Immigration", "Security"}, selected="Immigration")
avg_processing_min_4 = Panel("2.5")
min_passenger_3 = Panel("0.5")
target_wait_min_3 = Panel("10")
wlk_2 = Walking(Passengers=ver.Passengers, Distance="50", WalkingSpeed=wp, FromFacility=from_facility_3, ToFacility=from_facility_4)
list_10 = ValueList({"CheckIn": 0, "BagDrop": 1, "Security": 2, "Immigration": 3, "Verification": 4}, selected="Verification")
list_11 = ValueList({"Island", "Linear", "Flow-Through"}, selected="Flow-Through")
sp_3 = ServiceProfile(MeanServiceTime=avg_processing_min_4, StandardDeviation=min_passenger_3)
division_13 = Division(A=brec_2.DimensionX, B="2")
shift = ShiftList(List=divide_3.Parameters, Shift=1, Wrap=False)
tpl_3 = FacilityTemplate(FacilityType=list_10)  # -> Template, AvailableTopologies
std_3 = FacilityStandards(
    FacilityType=list_10,
    QueueAreaPax=Slider(1.3, range=1.3..1.8),
    ProcessorWidth=division_13,
    ProcessorDepth=brec_2.DimensionY,
    ProcessorPitch=division_13,
    Circulation=25,
    Support=10)
imm = Immigration(
    Passengers=wlk_2,
    ServiceProfile=sp_3,
    ImmigrationBooths=8,
    OptimizeBooths=Toggle(True),
    TargetWait=target_wait_min_3,
    StaffingPercentage=Slider(100, range=0..100),
    RandomSeed=random_seed)  # -> Passengers, QueueResults, PhysicalBooths
offset_2 = OffsetCurve(Curve=line_2, Distance=expr("x/2", "3"), Corners=1)
offset_3 = OffsetCurve(Curve=line_2, Distance=expr("-x/2", "3"), Corners=1)
panel_7 = Panel(tpl_3.AvailableTopologies)
min_passenger_4 = Panel("0.25")
avg_processing_min_5 = Panel("0.5")
size_3 = FacilitySizer(OperationalResults=ver.VerificationResults, Passengers=ver.Passengers, Standards=std_3, Template=tpl_3.Template)  # -> SizingResult, TotalArea, QueueArea, ProcessingArea, CirculationArea, Topology, Advice
merge = Merge(Data1=offset_3, Data2=offset_2)  # -> simplify(Result)
flip = FlipCurve(Curve=offset_2)  # -> Curve, Flag
flip_2 = FlipCurve(Curve=offset_3)  # -> Curve, Flag
target_wait_min_4 = Panel("20")
sp_4 = ServiceProfile(MeanServiceTime=avg_processing_min_5, StandardDeviation=min_passenger_4)
divlength = DivideLength(Curve=flip_2.Curve, Length=expr("x/2", brec_2.DimensionX))  # -> Points, Tangents, Parameters
divlength_2 = DivideLength(Curve=flip.Curve, Length=expr("x/2", brec_2.DimensionX))  # -> Points, Tangents, Parameters
brec_4 = BoundingRectangle(Geometry=merge, Plane=PlaneXY(0, 0, 0), Axis=0, Slide=0, Union=True)  # -> Bounding, DimensionX, DimensionY
panel_8 = Panel(size_3.QueueArea)
cull_i = CullIndex(List=divlength_2.Points, Indices=0, Wrap=True)
cull_i_2 = CullIndex(List=divlength.Points, Indices=0, Wrap=True)
sec = Security(
    Passengers=imm.Passengers,
    ServiceProfile=sp_4,
    SecurityLanes=8,
    OptimizeLanes=Toggle(True),
    TargetWait=target_wait_min_4,
    StaffingPercentage=Slider(100, range=0..100),
    RandomSeed=random_seed)  # -> Passengers, QueueResults, PhysicalLanes
pflip = FlipPlane(Plane=cull_i_2, ReverseX=False, ReverseY=True, SwapAxes=True)
pflip_2 = FlipPlane(Plane=cull_i, ReverseX=True, ReverseY=True, SwapAxes=True)
offset_4 = OffsetCurve(Curve=brec_4.Bounding, Distance=expr("-x/2", "1"), Corners=1)
dispatch_2 = Dispatch(List=pflip, DispatchPattern=[True, False])  # -> ListA, ListB
dispatch_3 = Dispatch(List=pflip_2, DispatchPattern=[True, False])  # -> ListA, ListB
qs = QueueStatistics(QueueResults=sec.QueueResults)  # -> AverageWait, MaximumWait, _95thPercentileWait, PeakQueueLength, ResourceUtilization
fillet = Fillet(Curve=brec_4.Bounding, Radius="1")
fillet_2 = Fillet(Curve=offset_4, Radius=expr("x/2", "1"))
X_3 = UnitX(Factor=expr("x/2", brec_2.DimensionX))
pdt_3 = PassengerDetails(Passengers=sec.Passengers)  # -> PassengerID, ArrivalTime, ServiceTime, StartService, EndService, WaitingTime, AssignedCounter, WalkingSpeed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
pdt_4 = PassengerDetails(Passengers=sec.Passengers)  # -> PassengerID, ArrivalTime, ServiceTime, StartService, EndService, WaitingTime, AssignedCounter, WalkingSpeed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
item_8 = ListItem(List=dispatch_3.ListA, Index=0, Wrap=True)  # -> Item1, Item
item_9 = ListItem(List=dispatch_2.ListA, Index=0, Wrap=True)  # -> Item1, Item
merge_2 = Merge(Data1=fillet, Data2=fillet_2)
panel_9 = Panel(pdt_3.WaitingTime)
panel_10 = Panel(pdt_4.PassengerType)
pln = Plane(simplify([item_9.Item1, item_8.Item1]))
pln_2 = Plane(simplify([dispatch_2.ListB, dispatch_3.ListB]))
lng = ListLength(List=flatten(pln_2))  # -> expr("x*2", Length)
lng_2 = ListLength(List=flatten(pln))
ma = MassAddition(Input=[lng_2, lng])  # -> Result, PartialResults

addition_2 = Addition(A=brec_2.DimensionY, B="2")
addition_3 = Addition(A=brec_2.DimensionY, B="2")
offset_5 = OffsetCurve(Curve=offset_3, Distance=expr("-x", addition_3), Corners=1)
offset_6 = OffsetCurve(Curve=offset_2, Distance=addition_2, Corners=1)

multiplication_7 = Multiplication(A="2", B="2")

insert = InsertBlock(BlockName="Block 02", Plane=pln)
insert_2 = InsertBlock(BlockName="Block 01", Plane=pln_2)

merge_3 = Merge(Data1=insert, Data2=insert_2)
min_walk = CSharpScript(x=cp.Distance, y="75")  # -> out, b, a; inputs x: list of Int32, y: Int32
# ---------- min_walk: C# ----------
// Grasshopper Script Instance
#region Usings
using System;
using System.Linq;
using System.Collections;
using System.Collections.Generic;
using System.Drawing;

using Rhino;
using Rhino.Geometry;

using Grasshopper;
using Grasshopper.Kernel;
using Grasshopper.Kernel.Data;
using Grasshopper.Kernel.Types;
#endregion

public class Script_Instance : GH_ScriptInstance
{
    #region Notes
    /* 
      Members:
        RhinoDoc RhinoDocument
        GH_Document GrasshopperDocument
        IGH_Component Component
        int Iteration

      Methods (Virtual & overridable):
        Print(string text)
        Print(string format, params object[] args)
        Reflect(object obj)
        Reflect(object obj, string method_name)
    */
    #endregion

    private void RunScript(List<int> x, int y, ref object b, ref object a)
    {
        foreach(int l in x)
        {
        if(l<75)
        {a="Walk Distance from Entry to E-Gates is comfortable";
          b=1;}
        else 
        {a=$"Walking Distance from Entry to E-Gate {l}m is not comfortable";
         b=2; }
        }
    }
}
# ---------- end min_walk ----------
eval_2 = EvaluateCurve(Curve=reparameterize(offset_5), Parameter=0)  # -> Point, Tangent, Angle
eval_3 = EvaluateCurve(Curve=reparameterize(offset_6), Parameter=1)  # -> Point, Tangent, Angle
len = Length(Curve=offset_6)
len_2 = Length(Curve=offset_5)
subtraction_4 = Subtraction(A=ma.Result, B=total_check_in_counters)
item_10 = ListItem(List=min_walk.a, Index=0, Wrap=True)
min_counters = CSharpScript(x=subtraction_4)  # -> out, a; inputs x: Int32, y: Boolean
# ---------- min_counters: C# ----------
// Grasshopper Script Instance
#region Usings
using System;
using System.Linq;
using System.Collections;
using System.Collections.Generic;
using System.Drawing;

using Rhino;
using Rhino.Geometry;

using Grasshopper;
using Grasshopper.Kernel;
using Grasshopper.Kernel.Data;
using Grasshopper.Kernel.Types;
#endregion

public class Script_Instance : GH_ScriptInstance
{
    #region Notes
    /* 
      Members:
        RhinoDoc RhinoDocument
        GH_Document GrasshopperDocument
        IGH_Component Component
        int Iteration

      Methods (Virtual & overridable):
        Print(string text)
        Print(string format, params object[] args)
        Reflect(object obj)
        Reflect(object obj, string method_name)
    */
    #endregion

    private void RunScript(int x, bool y, ref object a)
    {
        if(x>0)
        a=$"You can reduce {x} counter";
        else if(x==0)
        a=$"The Configuration fits {x} counters";
        else 
        a=$"You need to add {Math.Abs(x)} counters";
    }
}
# ---------- end min_counters ----------
ma_2 = MassAddition(Input=flatten([len, len_2]))  # -> Result, PartialResults
prot = RotatePlane(Plane=eval_2.Point, Angle=degrees("-90"))
prot_2 = RotatePlane(Plane=eval_3.Point, Angle=degrees("90"))
dom_5 = ConstructDomain(DomainStart=0, DomainEnd=len)
panel_11 = Panel(min_counters.a)
division_14 = Division(A="3", B="2")
subtraction_5 = Subtraction(A=round_3.Nearest, B="1")
md_slider = MDSlider(
    SliderMode=0,
    slider_value=Point(0.502658751, 1, 0.5),
    x_domain=Domain(0, 1),
    y_domain=Domain(0, 1),
    z_domain=Domain(0, 1))
division_15 = Division(A=brec_3.DimensionX, B="2")
panel_12 = Panel(division_15)

md_slider_2 = MDSlider(
    SliderMode=0,
    slider_value=Point(0.5406689528, 0.826637082, 0.5),
    x_domain=Domain(0, 1),
    y_domain=Domain(0, 1),
    z_domain=Domain(0, 1))
evalsrf = EvaluateSurface(Surface=reparameterize(brec_3.Bounding), Point=md_slider_2)  # -> Point, Normal, UDirection, VDirection, Frame
Y_2 = UnitY(Factor="2")
move_2 = Move(Geometry=evalsrf.Point, Motion=Y_2)  # -> Geometry, Transform
X_4 = UnitX(Factor=expr("-x", division_15))
move_3 = Move(Geometry=move_2.Geometry, Motion=X_4)  # -> Geometry, Transform

division_16 = Division(A="100", B=staffed_desk)
xy_2 = XYPlane(Origin=Point(0, 0, 0))
prot_3 = RotatePlane(Plane=xy_2, Angle=degrees("90"))
tag_orientation = StreamFilter(Gate=orientation_of_check_in_counters, Stream0=xy_2, Stream1=prot_3)
furniture_blocks = StreamFilter(
    Gate=orientation_of_check_in_counters,
    Stream0=" is not sufficient(Check Width of Aisles).",
    Stream1=" is not sufficient(Check Depth or Aisle Spacing).")
furniture_blocks_2 = StreamFilter(Gate=orientation_of_check_in_counters, Stream0=move_3.Geometry, Stream1=move_3.Geometry)
over_design = ColourSwatch(SwatchColor=RGBA(255, 23, 23, 100))
Y_3 = UnitY(Factor="1")
X_5 = UnitX(Factor=1)
division_17 = Division(A="100", B=p_staffed_desk)
concat_2 = Concatenate(FragmentA="E-Gates")
sub_optimum = ColourSwatch(SwatchColor=RGB(255, 200, 61))
optimum = ColourSwatch(SwatchColor=RGB(43, 166, 53))
over_design_2 = ColourSwatch(SwatchColor=RGB(255, 23, 23))
gltf2material = GlTF20Material(
    BaseColorFactor=optimum,
    MetallicFactor=0,
    RoughnessFactor=1,
    EmissiveFactor=RGB(0, 0, 0),
    AlphaMode="BLEND",
    AlphaCutoff=0.5,
    DoubleSided=False)
gltf2material_2 = GlTF20Material(
    BaseColorFactor=over_design_2,
    MetallicFactor=0,
    RoughnessFactor=1,
    EmissiveFactor=RGB(0, 0, 0),
    AlphaMode="BLEND",
    AlphaCutoff=0.5,
    DoubleSided=False)
gltf2material_3 = GlTF20Material(
    BaseColorFactor=sub_optimum,
    MetallicFactor=0,
    RoughnessFactor=1,
    EmissiveFactor=RGB(0, 0, 0),
    AlphaMode="BLEND",
    AlphaCutoff=0.5,
    DoubleSided=False)
panel_13 = Panel("""A
B
C
D
E
F
G
H
I
J
K
L""")
panel_14 = Panel("1,0.5")
textsrf = TextOnSurface(Text=concat, Font="Sans Bold:no Italic:no", Height="1.5", Depth=0, BaseLine=line, BaseSurface=srf)  # -> flatten(Symbols)
move_4 = Move(Geometry=textsrf, Motion=Z)  # -> Geometry, Transform
preview = CustomPreview(Geometry=move_4.Geometry, Material=ColourSwatch(SwatchColor=RGB(255, 0, 0)))
Z_2 = UnitZ(Factor=0.1)
filter_2 = StreamFilter(Gate=0, Stream0="Over-Design", Stream1="Optimum", Stream2="Sub-Optimum")
paramptinrec = ParameterPointInRectangle(Rectangle=rectangle.Rectangle, ParameterX=0.5, ParameterY=0.85)  # -> Point, Normal
filter_3 = StreamFilter(Gate=0, Stream0=over_design_2, Stream1=optimum, Stream2=sub_optimum)
panel_15 = Panel("sq.m.This includes Queue Area, Circulation Area and Corridor Area")
pt_2 = Point(paramptinrec.Point)
X_6 = UnitX(Factor=1)
line_3 = LineSDL(Start=pt_2, Direction=expr("-x", X_6), Length="8")
line_4 = LineSDL(Start=pt_2, Direction=X_6, Length="8")
join = JoinCurves(Curves=[line_4, line_3], Preserve=False)
flip_3 = FlipCurve(Curve=join)  # -> Curve, Flag
srf_2 = Surface(rectangle.Rectangle)

concat_3 = Concatenate(FragmentA="Your desired LoS was ", FragmentB=item, FragmentC=",and you are successfully delivering it.")

subtraction_6 = Subtraction(A=100, B=passengers_using_check_in)
self_check_in = Panel(subtraction_6)
multiplication_8 = Multiplication(A=passenger_departing, B=dhp, C="0.01")
multiplication_9 = Multiplication(A=multiplication_8, B=passengers_using_check_in, C="0.01")
min_passenger_5 = Panel("1.5")

physical_counter_check_in = Integer(multiplication_9)
dist_arrival_perflight = CSharpScript(PaxCount=physical_counter_check_in, DepMinute="800", Horizon="300", Run=Toggle(True), Seed=Slider(60, range=0..100))  # -> out, ArrivalMinutes, Histogram, LambdaValues; inputs PaxCount: Int32, DepMinute: Int32, Horizon: Int32, Run: Boolean, Seed: Int32
# ---------- dist_arrival_perflight: C# ----------
// Grasshopper Script Instance
#region Usings
using System;
using System.Linq;
using System.Collections;
using System.Collections.Generic;
using System.Drawing;

using Rhino;
using Rhino.Geometry;

using Grasshopper;
using Grasshopper.Kernel;
using Grasshopper.Kernel.Data;
using Grasshopper.Kernel.Types;
#endregion

public class Script_Instance : GH_ScriptInstance
{
    #region Notes
    /* 
      Members:
        RhinoDoc RhinoDocument
        GH_Document GrasshopperDocument
        IGH_Component Component
        int Iteration

      Methods (Virtual & overridable):
        Print(string text)
        Print(string format, params object[] args)
        Reflect(object obj)
        Reflect(object obj, string method_name)
    */
    #endregion

    private void RunScript(
		int PaxCount,
		int DepMinute,
		int Horizon,
		bool Run,
		int Seed,
		ref object ArrivalMinutes,
		ref object Histogram,
		ref object LambdaValues)
{
    if (!Run)
        return;

    Random rnd = new Random(Seed);

    List<double> lambda = new List<double>();
    List<int> hist = new List<int>();
    List<int> arrivals = new List<int>();

    // ------------------------------------------------------------------
    // Define the arrival profile (Gaussian shape)
    // ------------------------------------------------------------------
    double peak = 90.0;   // Most passengers arrive 90 min before departure
    double sigma = 35.0;  // Spread of arrivals

    // Build unscaled profile
    double totalWeight = 0.0;

    for (int t = Horizon; t >= 1; t--)
    {
        double z = (t - peak) / sigma;
        double w = Math.Exp(-0.5 * z * z);
        lambda.Add(w);
        totalWeight += w;
    }

    // Scale profile so total expected passengers = PaxCount
    double scale = PaxCount / totalWeight;

    for (int i = 0; i < lambda.Count; i++)
        lambda[i] *= scale;

    // ------------------------------------------------------------------
    // Simulate arrivals minute by minute
    // ------------------------------------------------------------------
    int generated = 0;

    for (int i = 0; i < Horizon; i++)
    {
        double lam = lambda[i];
        int count = SamplePoisson(lam, rnd);

        // Ensure we do not exceed total passengers
        if (generated + count > PaxCount)
            count = PaxCount - generated;

        hist.Add(count);

        // Convert minute index to actual clock time
        int minutesBeforeDeparture = Horizon - i;
        int arrivalMinute = DepMinute - minutesBeforeDeparture;

        for (int k = 0; k < count; k++)
            arrivals.Add(arrivalMinute);

        generated += count;

        if (generated >= PaxCount)
        {
            // Fill remaining histogram entries with zeros
            for (int j = i + 1; j < Horizon; j++)
                hist.Add(0);
            break;
        }
    }

    ArrivalMinutes = arrivals.Select(a=> Horizon-(DepMinute-a));
    Histogram = hist;
    LambdaValues = lambda;
}

// ----------------------------------------------------------------------
// Poisson random sampler (Knuth algorithm)
// ----------------------------------------------------------------------
private int SamplePoisson(double lambda, Random rnd)
{
    if (lambda <= 0.0)
        return 0;

    double L = Math.Exp(-lambda);
    int k = 0;
    double p = 1.0;

    do
    {
        k++;
        p *= rnd.NextDouble();
    }
    while (p > L);

    return k - 1;
}
}
# ---------- end dist_arrival_perflight ----------

dist_arrival_perflight_2 = CSharpScript(
    arrivals=dist_arrival_perflight.ArrivalMinutes,
    Mean=avg_process_time_min_for_check_in,
    StandardDeviation=min_passenger_5)  # -> out, ServiceTimes; inputs arrivals: list of Int32, Mean: Double, StandardDeviation: Double
# ---------- dist_arrival_perflight_2: C# ----------
// Grasshopper Script Instance
#region Usings
using System;
using System.Linq;
using System.Collections;
using System.Collections.Generic;
using System.Drawing;

using Rhino;
using Rhino.Geometry;

using Grasshopper;
using Grasshopper.Kernel;
using Grasshopper.Kernel.Data;
using Grasshopper.Kernel.Types;
#endregion

public class Script_Instance : GH_ScriptInstance
{
    #region Notes
    /* 
      Members:
        RhinoDoc RhinoDocument
        GH_Document GrasshopperDocument
        IGH_Component Component
        int Iteration

      Methods (Virtual & overridable):
        Print(string text)
        Print(string format, params object[] args)
        Reflect(object obj)
        Reflect(object obj, string method_name)
    */
    #endregion

    private void RunScript(
		List<int> arrivals,
		double Mean,
		double StandardDeviation,
		ref object ServiceTimes)
    {
        List<double> serviceTimes = new List<double>();
        Random rnd=new Random();

    for (int i = 0; i < arrivals.Count; i++)
    {
        double s = SampleLognormal(Mean,StandardDeviation, rnd);
        serviceTimes.Add(s);
    }
    ServiceTimes=serviceTimes;
    }
    private double SampleLognormal(double mean,double std,Random rnd)
    {
        double m;
        double v;
        double s;
        v=std*std;
        s=Math.Sqrt(Math.Log(1+((std*std)/(mean*mean))));
        m=Math.Log(mean)-0.5*s*s;

        //Standard normal using Box -Muller
        double u1=rnd.NextDouble();
        double u2=rnd.NextDouble();
        double z=Math.Sqrt(-2.0*Math.Log(u1))*Math.Cos(2.0*Math.PI*u2);
        
        return Math.Round(Math.Exp(m+s*z),2);
    }

}
# ---------- end dist_arrival_perflight_2 ----------
c_script_2 = CSharpScript(
    arrivalTimes=dist_arrival_perflight.ArrivalMinutes,
    serviceTimes=dist_arrival_perflight_2.ServiceTimes,
    horizon="300",
    N=total_check_in_counters)  # -> out, PeakQueueLength, AverageWait, MaxWait, Wait95, CounterUtilization; inputs arrivalTimes: list of Double, serviceTimes: list of Double, horizon: Int32, N: Int32
# ---------- c_script_2: C# ----------
// Grasshopper Script Instance
#region Usings
using System;
using System.Linq;
using System.Collections;
using System.Collections.Generic;
using System.Drawing;

using Rhino;
using Rhino.Geometry;

using Grasshopper;
using Grasshopper.Kernel;
using Grasshopper.Kernel.Data;
using Grasshopper.Kernel.Types;
#endregion

public class Script_Instance : GH_ScriptInstance
{
    #region Notes
    /* 
      Members:
        RhinoDoc RhinoDocument
        GH_Document GrasshopperDocument
        IGH_Component Component
        int Iteration

      Methods (Virtual & overridable):
        Print(string text)
        Print(string format, params object[] args)
        Reflect(object obj)
        Reflect(object obj, string method_name)
    */
    #endregion

    public class Passenger
    {
        //Inputs
        public double ArrivalTime{get;set;}
        public double ServiceTime{get;set;}

        //Outputs from Queue Simulation
        public double StartServiceTime { get;set;}
        public double EndServiceTime {get;set;}
        public double WaitTime{get;set;}
        public int AssignedCounter{get;set;}
    }
    public class Counter
    {
        public int Id {get;set;}
        public double NextAvailableTime {get;set;}
    }
    //Factory style method to populate Passengers
    public List<Passenger> CreatePassenger(List<double> arrivalTimes,List<double> serviceTimes)
    {
        List<Passenger> passengers=new List<Passenger>();
        for(int i=0; i<arrivalTimes.Count; i++)
        {Passenger p=new Passenger();
         p.ArrivalTime=arrivalTimes[i];
         p.ServiceTime=serviceTimes[i];
         passengers.Add(p);
        }
        return passengers;
    }
    //Factory style method to Populate Counters
    public List<Counter> CreateCounters(int numberOfCounters)
    {
        List<Counter> counters=new List<Counter>();
        for(int i=0;i<numberOfCounters;i++)
        {
            Counter C=new Counter();
            C.Id=i;
            C.NextAvailableTime=0.0;
            counters.Add(C);
        }
        return counters;
    }
    private void RunQueue(List<Passenger> passengers,List<Counter> counters)
    {//Ensure All the passengers are processed in arrival order
      passengers.Sort((a,b)=> a.ArrivalTime.CompareTo(b.ArrivalTime));
      foreach(Passenger p in passengers)
        {
            //Find Earliest Available Counter
            Counter best=counters[0];
            for(int i=1;i<counters.Count;i++)
            {
                //Find earliest available Counter 
                if(counters[i].NextAvailableTime < best.NextAvailableTime)
                {
                    best=counters[i];
                }
            }
            p.StartServiceTime=Math.Max(p.ArrivalTime,best.NextAvailableTime);
            p.WaitTime=(p.StartServiceTime-p.ArrivalTime);
            p.EndServiceTime=p.StartServiceTime+p.ServiceTime;
            p.AssignedCounter=best.Id;
            best.NextAvailableTime=p.EndServiceTime;
        }

    }
    //Getting the relevant Metrics for the passengers and the Counters
    private void GetPassengerMetrics(List<Passenger>passengers,ref double AverageWait,ref double MaxWait,ref double Wait95)
    {
        List<double> sortedWaitTimes=passengers.Select(p=>p.WaitTime).OrderBy(w=>w).ToList();
        int index=(int)Math.Ceiling(0.95*sortedWaitTimes.Count)-1;

        AverageWait=passengers.Average(p=>p.WaitTime);
        MaxWait=passengers.Max(p=>p.WaitTime);
        Wait95=sortedWaitTimes[index];
    }
    //Getting Peak Queue Length to Compare with LoS Metric
   private int GetPeakQueueLength(List<Passenger> passengers)
    {
    // No passengers
    if (passengers == null || passengers.Count == 0)
        return 0;

    // Ensure chronological order
    passengers.Sort((a, b) =>
        a.ArrivalTime.CompareTo(b.ArrivalTime));

    int peakQueue = 0;

    // Check queue length at each passenger arrival time
    foreach (Passenger current in passengers)
    {
        int queueLength = 0;
        double t = current.ArrivalTime;

        // Count passengers who have arrived but have not yet started service
        foreach (Passenger p in passengers)
        {
            if (p.ArrivalTime <= t &&
                p.StartServiceTime > t)
            {
                queueLength++;
            }
        }

        if (queueLength > peakQueue)
            peakQueue = queueLength;
    }

    return peakQueue;
    }
    //
    private void GetCounterUtilization(List<Passenger> passengers,List<Counter> counters,ref List<double>utilization)
    {
        //No Counters
        if((counters==null)||counters.Count==0)
        return;

        //No Passengers
        if(passengers==null||passengers.Count==0)
        {
            for(int i=0;i<counters.Count;i++)
            {
                utilization.Add(0.0);
                return;
            }
        }
        double simulationDuration=passengers.Max(p=>p.EndServiceTime);
        if(simulationDuration <=0.0)
        {for(int i=0;i<counters.Count;i++)
            {
                utilization.Add(0.0);
                return;
            }

        }
        foreach(Counter C in counters)
        {
            double busyTime=0.0;
            foreach(Passenger p in passengers)
            {
                if(p.AssignedCounter==C.Id)
                {
                    busyTime+=p.ServiceTime;
                }
            }
            double u=busyTime/simulationDuration;
            utilization.Add(u);
        }

    }
    private void GetPassengerPerCounter()
    {
        
    }
    private void RunScript(
		List<double> arrivalTimes,
		List<double> serviceTimes,
		int horizon,
		int N,
		ref object PeakQueueLength,
		ref object AverageWait,
		ref object MaxWait,
		ref object Wait95,
		ref object CounterUtilization)
    {
        // Write your logic here
        List<Passenger> passengers=new List<Passenger>();
        List<Counter> counters=new List<Counter>();
        passengers=CreatePassenger(arrivalTimes,serviceTimes);
        counters=CreateCounters(N);
        RunQueue(passengers,counters);
        //Sanity Check
        double totalServiceDemand = passengers.Sum(p => p.ServiceTime);
        double totalCapacity =counters.Count * passengers.Max(p => p.ArrivalTime);
        Print($"Demand/Capacity = {Math.Round((totalServiceDemand / totalCapacity),2)}");

        List<double> utilization=new List<double>();
        GetCounterUtilization(passengers,counters,ref utilization);
         PeakQueueLength=GetPeakQueueLength(passengers);
         double avgWait=0;
         double maxWait=0;
         double wait95=0;
         GetPassengerMetrics(passengers,ref avgWait,ref maxWait,ref wait95);
         AverageWait=avgWait;
         MaxWait=maxWait;
         Wait95=wait95;
         CounterUtilization=utilization;
    }
}
# ---------- end c_script_2 ----------

# ---- group: Peak Queueing Area
area_for_ropes_corners = Panel("1.2")
multiplication_10 = Multiplication(A=c_script_2.PeakQueueLength, B=item_2)

# ----
c_script_3 = CSharpScript(y=c_script_2.Wait95)  # -> out, a; inputs y: Double
# ---------- c_script_3: C# ----------
// Grasshopper Script Instance
#region Usings
using System;
using System.Linq;
using System.Collections;
using System.Collections.Generic;
using System.Drawing;

using Rhino;
using Rhino.Geometry;

using Grasshopper;
using Grasshopper.Kernel;
using Grasshopper.Kernel.Data;
using Grasshopper.Kernel.Types;
#endregion

public class Script_Instance : GH_ScriptInstance
{
    #region Notes
    /* 
      Members:
        RhinoDoc RhinoDocument
        GH_Document GrasshopperDocument
        IGH_Component Component
        int Iteration

      Methods (Virtual & overridable):
        Print(string text)
        Print(string format, params object[] args)
        Reflect(object obj)
        Reflect(object obj, string method_name)
    */
    #endregion

    private void RunScript(double y, ref object a)
    {
        string b;
        // Write your logic here
       
         if(y<10)
         b="A";
         else if(y<12)
         b="B";
         else if(y<20)
         b="C";
         else if(y<25)
         b="D";
         else if(y<30)
         b="E";
         else
         b="F";
        
        a=b;
    }
}
# ---------- end c_script_3 ----------
expression_2 = Expression(x=item, y=c_script_3.a, Expression="If(x=y, true, false)")

concat_4 = Concatenate(FragmentA="Your desired LoS was ", FragmentB=item, FragmentC=",but you are delivering ", FragmentD=c_script_3.a)

filter_4 = StreamFilter(Gate=expression_2, Stream0=concat_4, Stream1=concat_3)
panel_16 = Panel(filter_4)
multiplication_11 = Multiplication(A=c_script_2.PeakQueueLength, B=item_3)
multiplication_12 = Multiplication(A=division_17, B=c_script_2.Wait95)
c_script_4 = CSharpScript(x=multiplication_12, y=avg_process_time_min_for_check_in_2)  # -> out, a; inputs x: Double, y: Double
# ---------- c_script_4: C# ----------
// Grasshopper Script Instance
#region Usings
using System;
using System.Linq;
using System.Collections;
using System.Collections.Generic;
using System.Drawing;

using Rhino;
using Rhino.Geometry;

using Grasshopper;
using Grasshopper.Kernel;
using Grasshopper.Kernel.Data;
using Grasshopper.Kernel.Types;
#endregion

public class Script_Instance : GH_ScriptInstance
{
    #region Notes
    /* 
      Members:
        RhinoDoc RhinoDocument
        GH_Document GrasshopperDocument
        IGH_Component Component
        int Iteration

      Methods (Virtual & overridable):
        Print(string text)
        Print(string format, params object[] args)
        Reflect(object obj)
        Reflect(object obj, string method_name)
    */
    #endregion

    private void RunScript(double x, double y, ref object a)
    {
    if (x < y/2)
         a= 1;
    else if (x < y) // here x is already >= 10
         a= 0;
    else
   a= 2;     // x >= 20
    }
    
}
# ---------- end c_script_4 ----------
int_2 = Integer(c_script_4.a)
round_4 = Round(Number=c_script_2.Wait95)  # -> Nearest, Floor, Ceiling
round_5 = Round(Number=c_script_2.AverageWait)  # -> Nearest, Floor, Ceiling
filter_5 = StreamFilter(Gate=int_2, Stream0="Optimum", Stream1="Over-Design", Stream2="Sub-Optimum")
filter_6 = StreamFilter(Gate=int_2, Stream0=optimum, Stream1=over_design_2, Stream2=sub_optimum)
_95_percentile_wait_time_min = Panel(round_4.Floor)
_95_percentile_wait_time_min_2 = Panel(round_5.Floor)
peak_queue_length = Panel(c_script_2.PeakQueueLength)
demand_capacity = Panel(c_script_2.out)
filter_7 = StreamFilter(Gate=int_2, Stream0=gltf2material, Stream1=gltf2material_2, Stream2=gltf2material_3)
c_print = ContextPrint(CheckInAreaColor=filter_6)
concat_5 = Concatenate(FragmentA="Peak Queue Length Combined", FragmentD=":", FragmentB=peak_queue_length)
concat_6 = Concatenate(FragmentA="95th Percentile Wait Time (min)", FragmentD=":", FragmentB=_95_percentile_wait_time_min)
concat_7 = Concatenate(FragmentA="Average Wait Time (min)", FragmentD=":", FragmentB=_95_percentile_wait_time_min_2)
concat_8 = Concatenate(FragmentC="Configuration of ", FragmentA=total_check_in_counters, FragmentD=" Counters is ", FragmentB=filter_5)
concat_9 = Concatenate(FragmentB=filter_4)
textsrf_2 = TextOnSurface(Text=filter_5, Font="Sans Bold:no Italic:no", Height=3, Depth=0.4, BaseLine=flip_3.Curve, BaseSurface=srf_2)

# ---- group: ARDM text
c_bake_4 = ContextBake(Counters_46_61_122=textsrf_2)

# ----
partition = PartitionList(List=series, Size=c_script.PartitionSize)  # -> simplify(Chunks)
lng_3 = ListLength(List=partition)
multiplication_13 = Multiplication(A=lng_3, B=brec_2.DimensionX)
bnd = Bounds(Numbers=partition)
dedomain = DeconstructDomain(Domain=bnd)  # -> Start, End
subtraction_7 = Subtraction(A=simplify(graft(series_2)), B=dedomain.Start)
panel_17 = Panel("0")

subtraction_8 = Subtraction(A=int, B=multiplication_13)
addition_4 = Addition(A=partition, B=subtraction_7)

cull_i_3 = CullIndex(List=flatten(subtraction_8), Indices=integer_division, Wrap=True)

lng_4 = ListLength(List=cull_i_3)  # -> expr("x-1", Length)
max = Maximum(A=lng_4, B="1")
ma_3 = MassAddition(Input=cull_i_3)  # -> Result, PartialResults

division_18 = Division(A=ma_3.Result, B=max)

panel_18 = Panel(ma_3.Result)
min_cross_circulation_spacing = Integer(division_18)
min_cross_circulation = CSharpScript(x=min_cross_circulation_spacing, y="10")  # -> out, b, c, a; inputs x: Int32, y: Int32
# ---------- min_cross_circulation: C# ----------
// Grasshopper Script Instance
#region Usings
using System;
using System.Linq;
using System.Collections;
using System.Collections.Generic;
using System.Drawing;

using Rhino;
using Rhino.Geometry;

using Grasshopper;
using Grasshopper.Kernel;
using Grasshopper.Kernel.Data;
using Grasshopper.Kernel.Types;
#endregion

public class Script_Instance : GH_ScriptInstance
{
    #region Notes
    /* 
      Members:
        RhinoDoc RhinoDocument
        GH_Document GrasshopperDocument
        IGH_Component Component
        int Iteration

      Methods (Virtual & overridable):
        Print(string text)
        Print(string format, params object[] args)
        Reflect(object obj)
        Reflect(object obj, string method_name)
    */
    #endregion

    private void RunScript(int x, int y, ref object b, ref object c, ref object a)
    {
        if(x>y)
        {a=$"You can reduce {x-y}m for cross circulation per aisle.";
         b=true;
         c=0;}
        else if(x<y)
        {a=$"You need to increase {y-x}m for cross circulation per aisle.";
         b=false;
         c=2;}
        else if(x==y)
        {a=$"Optimum cross circulation aisle";
         b=true;
         c=1;}
    }
}
# ---------- end min_cross_circulation ----------
int_3 = Integer(min_cross_circulation.b)

multiplication_14 = Multiplication(A=simplify(graft(range_2)), B=subtraction_8)  # -> simplify(Result)
addition_5 = Addition(A=addition_4, B=multiplication_14)
X_7 = UnitX(Factor=addition_5)

move_5 = Move(Geometry=item_7, Motion=X_7)  # -> Geometry, Transform
move2pt = MoveToPoint(Geometry=_2checkin_module, PointA=<geometry referenced from the Rhino model>, PointB=move_5.Geometry)  # -> Moved, Vector, Transform

lng_5 = ListLength(List=flatten(move_5.Geometry))
xy_3 = XYPlane(Origin=move_5.Geometry)
brec_5 = BoundingRectangle(Geometry=move2pt.Moved, Plane=PlaneXY(0, 0, 0), Axis=0, Slide=0, Union=True)  # -> simplify(Bounding), DimensionX, DimensionY
insert_3 = InsertBlock(BlockName="Block 01", Plane=xy_3)
disc_3 = Discontinuity(Curve=brec_5.Bounding, Level=1)  # -> Points, Parameters
shatter_3 = Shatter(Curve=brec_5.Bounding, Parameters=disc_3.Parameters)
item_11 = ListItem(List=shatter_3, Index=0, Wrap=True)  # -> Item1, Item, Item1_2, Item2
crv_3 = Curve(item_11.Item2)
len_3 = Length(Curve=crv_3)
eval_4 = EvaluateCurve(Curve=reparameterize(crv_3), Parameter="0.5")  # -> Point, Tangent, Angle
dom_6 = ConstructDomain(DomainStart=expr("-x/2", len_3), DomainEnd=expr("x/2", len_3))

move_6 = Move(Geometry=xy_3, Motion=X_3)  # -> Geometry, Transform
multiplication_15 = Multiplication(A=lng_5, B="2")
min_check_in = CSharpScript(x=multiplication_15, y=total_check_in_counters)  # -> out, a; inputs x: Int32, y: Int32
# ---------- min_check_in: C# ----------
// Grasshopper Script Instance
#region Usings
using System;
using System.Linq;
using System.Collections;
using System.Collections.Generic;
using System.Drawing;

using Rhino;
using Rhino.Geometry;

using Grasshopper;
using Grasshopper.Kernel;
using Grasshopper.Kernel.Data;
using Grasshopper.Kernel.Types;
#endregion

public class Script_Instance : GH_ScriptInstance
{
    #region Notes
    /* 
      Members:
        RhinoDoc RhinoDocument
        GH_Document GrasshopperDocument
        IGH_Component Component
        int Iteration

      Methods (Virtual & overridable):
        Print(string text)
        Print(string format, params object[] args)
        Reflect(object obj)
        Reflect(object obj, string method_name)
    */
    #endregion

    private void RunScript(int x, int y, ref object a)
    {
        if(x>y)
        a=$"You can reduce {x-y} check in counters.";
        else if(x<y)
        a=$"You need to increase {y-x} heck in counters.";
        else if(x==y)
        a=$"The Configuration matches the check in counter demand.";
    }
}
# ---------- end min_check_in ----------
furniture_blocks_3 = StreamFilter(Gate=orientation_of_check_in_counters, Stream0=insert_3, Stream1=[merge_3, merge_2])

# ---- group: Counter Blocks
geo = Geometry(flatten(furniture_blocks_3))
c_bake_5 = ContextBake(Counters_0_0_0=geo)

# ----
multiplication_16 = Multiplication(A=multiplication_10, B=area_for_ropes_corners)
md_slider_3 = MDSlider(
    SliderMode=0,
    slider_value=Point(0.502658751, 0, 0.5),
    x_domain=Domain(0, 1),
    y_domain=Domain(0, 1),
    z_domain=Domain(0, 1))
division_19 = Division(A=multiplication_16, B=division_3)
multiplication_17 = Multiplication(A=division_19, B=lng_3)  # -> simplify(Result)
division_20 = Division(A=multiplication_17, B=len_3)  # -> simplify(Result)

division_21 = Division(A=multiplication_16, B=ma_2.Result)
multiplication_18 = Multiplication(A=division_21, B="2")
addition_6 = Addition(A=multiplication_7, B=multiplication_18)
subtraction_9 = Subtraction(A=shift, B=addition_6)
dom_7 = ConstructDomain(DomainStart=0, DomainEnd=division_21)
addition_7 = Addition(A=division_21, B=addition_2, C=division_14)

rectangle_3 = Rectangle(Plane=simplify(prot_2), XSize=dom_5, YSize=dom_7, Radius=0)  # -> Rectangle, Length
rectangle_4 = Rectangle(Plane=simplify(prot), XSize=dom_5, YSize=dom_7, Radius=0)  # -> simplify(Rectangle), Length
flatten = FlattenTree(Tree=[rectangle_4.Rectangle, rectangle_3.Rectangle], Path="{0}")

multiplication_19 = Multiplication(A=addition_7, B=subtraction_5, C="2")
roundd = RoundToDecimalPlace(NumberX=multiplication_19, DecimalPlace="2", RoundType=0)  # -> Rounded, Difference
roundd_2 = RoundToDecimalPlace(NumberX=division_21, DecimalPlace="2", RoundType=2)  # -> Rounded, Difference
partition_2 = PartitionList(List=flatten, Size="2")
brec_6 = BoundingRectangle(Geometry=flatten, Plane=PlaneXY(0, 0, 0), Axis=0, Slide=0, Union=True)  # -> Bounding, DimensionX, DimensionY
brec_7 = BoundingRectangle(Geometry=partition_2, Plane=PlaneXY(0, 0, 0), Axis=0, Slide=0, Union=False)  # -> Bounding, DimensionX, DimensionY
multiplication_20 = Multiplication(A=brec_6.DimensionY, B=brec.DimensionX)
offset_7 = OffsetCurve(Curve=brec_6.Bounding, Distance=1, Corners=1)
rdiff = RegionDifference(CurvesA=brec_6.Bounding, CurvesB=flatten(brec_7.Bounding))
subtraction_10 = Subtraction(A=dim.UDimension, B=roundd.Rounded)
roundf_2 = RoundToFactor(NumberX=multiplication_20, Factor="5", RoundType=0)  # -> Rounded, Difference, MultiplierR, MultiplierX
brec_8 = BoundingRectangle(Geometry=rdiff, Plane=PlaneXY(0, 0, 0), Axis=0, Slide=0, Union=False)  # -> Bounding, DimensionX, DimensionY
division_22 = Division(A=subtraction_10, B=subtraction_5)
paramptinrec_2 = ParameterPointInRectangle(Rectangle=brec_8.Bounding, ParameterX=0.5, ParameterY=0)  # -> Point, Normal
min_circulation_space = CSharpScript(x=division_22, y="6")  # -> out, b, a; inputs x: Int32, y: Double
# ---------- min_circulation_space: C# ----------
// Grasshopper Script Instance
#region Usings
using System;
using System.Linq;
using System.Collections;
using System.Collections.Generic;
using System.Drawing;

using Rhino;
using Rhino.Geometry;

using Grasshopper;
using Grasshopper.Kernel;
using Grasshopper.Kernel.Data;
using Grasshopper.Kernel.Types;
#endregion

public class Script_Instance : GH_ScriptInstance
{
    #region Notes
    /* 
      Members:
        RhinoDoc RhinoDocument
        GH_Document GrasshopperDocument
        IGH_Component Component
        int Iteration

      Methods (Virtual & overridable):
        Print(string text)
        Print(string format, params object[] args)
        Reflect(object obj)
        Reflect(object obj, string method_name)
    */
    #endregion

    private void RunScript(int x, double y, ref object b, ref object a)
    {
        if(x>y)
       { a=$"You can reduce {x-y}m for cross circulation per aisle.";
         b= true;}
        else if(x<y)
        {a=$"You need to increase {y-x}m for cross circulation per aisle.";
          b= false;}
        else if(x==y)
       { a=$"Optimum cross circulation aisle";
        b= true;}
    }
}
# ---------- end min_circulation_space ----------
dispatch_4 = Dispatch(List=paramptinrec_2.Point, DispatchPattern=[True, False])  # -> ListA, ListB
int_4 = Integer(min_circulation_space.b)
multiplication_21 = Multiplication(A=division_20, B=division_16)

addition_8 = Addition(A="2", B=multiplication_21)
dom_8 = ConstructDomain(DomainStart="2", DomainEnd=addition_8)
rectangle_5 = Rectangle(Plane=eval_4.Point, XSize=dom_6, YSize=dom_8, Radius=0)  # -> Rectangle, Length

area_3 = Area(Geometry=rectangle_5.Rectangle)  # -> Area, Centroid
brec_9 = BoundingRectangle(Geometry=flatten(rectangle_5.Rectangle), Plane=PlaneXY(0, 0, 0), Axis=0, Slide=0, Union=True)  # -> Bounding, DimensionX, DimensionY
ma_4 = MassAddition(Input=flatten(area_3.Area))  # -> Result, PartialResults
area_4 = Area(Geometry=brec_9.Bounding)  # -> Area, Centroid
rdiff_2 = RegionDifference(CurvesA=brec_9.Bounding, CurvesB=flatten(rectangle_5.Rectangle))
evalsrf_2 = EvaluateSurface(Surface=reparameterize(brec_9.Bounding), Point=md_slider)  # -> Point, Normal, UDirection, VDirection, Frame
paramptinrec_3 = ParameterPointInRectangle(Rectangle=rdiff_2, ParameterX=1, ParameterY=0.5)  # -> Point, Normal
addition_9 = Addition(A=brec_9.DimensionY, B="2", C=brec_2.DimensionY)
division_23 = Division(A=addition_9, B=brec_9.DimensionY)
area_5 = Area(Geometry=rdiff_2)  # -> Area, Centroid
subtraction_11 = Subtraction(A=multiplication_11, B=area_5.Area)
scale_nu_2 = ScaleNU(Geometry=brec_9.Bounding, Plane=evalsrf_2.Point, ScaleX=1, ScaleY=division_23, ScaleZ=1)  # -> Geometry, Transform
area_6 = Area(Geometry=scale_nu_2.Geometry)  # -> Area, Centroid
area_7 = Area(Geometry=scale_nu_2.Geometry)  # -> Area, Centroid
addition_10 = Addition(A=subtraction_11, B=area_6.Area)

evalsrf_3 = EvaluateSurface(Surface=reparameterize(scale_nu_2.Geometry), Point=md_slider_3)  # -> Point, Normal, UDirection, VDirection, Frame
item_12 = ListItem(List=addition_10, Index=0, Wrap=True)
division_24 = Division(A=item_12, B=area_6.Area)
item_13 = ListItem(List=flatten(multiplication_21), Index=0, Wrap=True)

scale_nu_3 = ScaleNU(Geometry=scale_nu_2.Geometry, Plane=evalsrf_3.Point, ScaleX=1, ScaleY=division_24, ScaleZ=1)  # -> Geometry, Transform
offset_8 = OffsetCurve(Curve=scale_nu_3.Geometry, Distance=1, Corners=1)
roundf_3 = RoundToFactor(NumberX=area_7.Area, Factor="5", RoundType=0)  # -> Rounded, Difference, MultiplierR, MultiplierX
subtraction_12 = Subtraction(A=brec_3.DimensionY, B=addition_9)
min_cross_circulation_2 = CSharpScript(x=subtraction_12, y="10")  # -> out, b, a; inputs x: Int32, y: Int32
# ---------- min_cross_circulation_2: C# ----------
// Grasshopper Script Instance
#region Usings
using System;
using System.Linq;
using System.Collections;
using System.Collections.Generic;
using System.Drawing;

using Rhino;
using Rhino.Geometry;

using Grasshopper;
using Grasshopper.Kernel;
using Grasshopper.Kernel.Data;
using Grasshopper.Kernel.Types;
#endregion

public class Script_Instance : GH_ScriptInstance
{
    #region Notes
    /* 
      Members:
        RhinoDoc RhinoDocument
        GH_Document GrasshopperDocument
        IGH_Component Component
        int Iteration

      Methods (Virtual & overridable):
        Print(string text)
        Print(string format, params object[] args)
        Reflect(object obj)
        Reflect(object obj, string method_name)
    */
    #endregion

    private void RunScript(int x, int y, ref object b, ref object a)
    {
        if(x<y)
        {a=$"You need {y-x}m space for circulation behind queueing area.";
         b=true;}
        else if((x>y)&&((x-y)<10))
        {a=$"You have {x-y}m deep Check-In Hall area,do check if that's sufficient.";
         b=false;}
        else 
        {a=$"You have {x-y}m deep Check-In Hall area,do check if it's not overdesigned.";
         b=true;}
    }
}
# ---------- end min_cross_circulation_2 ----------
panel_19 = Panel(subtraction_12)
queue_area = StreamFilter(Gate=orientation_of_check_in_counters, Stream0=rectangle_5.Rectangle, Stream1=flatten)
que_depth = StreamFilter(Gate=orientation_of_check_in_counters, Stream0=item_13, Stream1=roundd_2.Rounded)
furniture_blocks_4 = StreamFilter(Gate=orientation_of_check_in_counters, Stream0=int_3, Stream1=int_4)
furniture_blocks_5 = StreamFilter(Gate=orientation_of_check_in_counters, Stream0=roundf_3.Rounded, Stream1=roundf_2.Rounded)
total_cuvre = StreamFilter(Gate=orientation_of_check_in_counters, Stream0=offset_8, Stream1=offset_7)
total_cuvre_2 = StreamFilter(Gate=orientation_of_check_in_counters, Stream0=paramptinrec_3.Point, Stream1=dispatch_4.ListB)
gate = StreamGate(Stream=furniture_blocks, Gate=furniture_blocks_4)  # -> Target0, Target1
gate_2 = StreamGate(Stream=rectangle.Rectangle, Gate=furniture_blocks_4)  # -> Target0, Target1

Y_4 = UnitY(Factor=1)
line_5 = LineSDL(Start=total_cuvre_2, Direction=expr("-x", Y_4), Length="4")
end = EndPoints(Curve=line_5)  # -> Start, End
panel_20 = Panel("45")
Z_3 = UnitZ(Factor=1)
X_8 = UnitX(Factor=end.End)
vrot = Rotate(Vector=X_8, Axis=Z_3, Angle=degrees("45"))
yz = YZPlane(Origin=end.End)
line_6 = LineSDL(Start=end.End, Direction=vrot, Length="1.5")
mirror = Mirror(Geometry=line_6, Plane=yz)  # -> Geometry, Transform

check_in_area = Panel(furniture_blocks_5)
panel_21 = Panel(roundf_3.Rounded)
srf_3 = Surface(gate_2.Target0)
preview_2 = CustomPreview(Geometry=srf_3, Material=over_design)
concat_10 = Concatenate(FragmentD="Designed Check In  Area of ", FragmentA=check_in_area, FragmentB="sq.m", FragmentC=gate.Target0)
move_7 = Move(Geometry=end.Start, Motion=Y_3)  # -> Geometry, Transform
line_7 = LineSDL(Start=move_7.Geometry, Direction=expr("-x", X_5), Length="3")
line_8 = LineSDL(Start=move_7.Geometry, Direction=X_5, Length="3")
join_2 = JoinCurves(Curves=[line_8, line_7], Preserve=False)  # -> flatten(Curves)
srf_4 = Surface(total_cuvre)
flip_4 = FlipCurve(Curve=join_2)  # -> Curve, Flag
join_3 = JoinCurves(Curves=[mirror.Geometry, line_6, line_5], Preserve=False)
textsrf_3 = TextOnSurface(Text=concat_2, Font="Sans Bold:no Italic:no", Height=1.2, Depth=0, BaseLine=flip_4.Curve, BaseSurface=srf_4)  # -> flatten(Symbols)
offcrv = OffsetCurve(Curve=join_3, Plane=PlaneXY(0, 0, 0), Distance=-0.2, BothSides=0.2, Kinks=0, CapType=1)  # -> flatten(Offset)
runion = RegionUnion(Curves=offcrv)
srf_5 = Surface(queue_area)
srf_6 = Surface(runion)
runion_2 = RegionUnion(Curves=flatten(srf_5))
crv_4 = Curve(runion_2)
srf_7 = Surface(crv_4)
queue_area_sq_m = Panel(multiplication_16)
queue_depth_m = Panel(que_depth)
area_8 = Area(Geometry=crv_4)  # -> Area, Centroid
gltfdisplay = GlTF20Display(Geometry=srf_7, Material=filter_7)
c_bake_6 = ContextBake(CheckInArea=srf_7)
sort_pt_2 = SortPoints(Points=area_8.Centroid)  # -> Points, Indices
concat_11 = Concatenate(FragmentA="Queue Depth (m)", FragmentD=":", FragmentB=queue_depth_m)
concat_12 = Concatenate(FragmentA="Queue Area (sq.m)", FragmentD=":", FragmentB=queue_area_sq_m)
index_2 = ItemIndex(List=sort_pt_2.Points, Item=sort_pt_2.Points)
item_14 = ListItem(List=panel_13, Index=index_2, Wrap=True)
merge_4 = Merge(Data1=concat_8, Data2=concat_12, Data3=concat_5, Data4=concat_7, Data5=concat_6, Data6=concat_11)  # -> flatten(Result)
c_print_2 = ContextPrint(Metrics=merge_4)
concat_13 = Concatenate(FragmentA="Zone ", FragmentB=item_14)
pl_origin = PlaneOrigin(Base=tag_orientation, Origin=sort_pt_2.Points)
brec_10 = BoundingRectangle(Geometry=srf_7, Plane=pl_origin, Axis=0, Slide=0, Union=True)  # -> Bounding, flatten(DimensionX), DimensionY
item_15 = ListItem(List=brec_10.DimensionX, Index=0, Wrap=True)
deplane = DeconstructPlane(Plane=pl_origin)  # -> Origin, XAxis, YAxis, ZAxis
amp = Amplitude(Vector=deplane.XAxis, Amplitude=expr("-x/2", item_15))
offset_9 = OffsetCurve(Curve=total_cuvre, Distance=expr("-x/2", "0.15"), Corners=1)
offset_10 = OffsetCurve(Curve=total_cuvre, Distance=expr("x/2", "0.15"), Corners=1)
move_8 = Move(Geometry=pl_origin, Motion=amp)  # -> Geometry, Transform

c_bake_7 = ContextBake(Arrows_0_0_0=srf_6)
c_bake_8 = ContextBake(Text_0_0_0=textsrf_3)

boundary_2 = BoundarySurfaces(Edges=[offset_9, offset_10])
line_9 = LineSDL(Start=move_8.Geometry, Direction=deplane.XAxis, Length=item_15)
area_9 = Area(Geometry=offset_9)  # -> Area, Centroid
roundf_4 = RoundToFactor(NumberX=area_9.Area, Factor="10", RoundType=0)  # -> Rounded, Difference, MultiplierR, MultiplierX
textsrf_4 = TextOnSurface(Text=concat_13, Font="Sans Bold:no Italic:no", Height="1.5", Depth=0, BaseLine=line_9, BaseSurface=srf_7)
move_9 = Move(Geometry=textsrf_4, Motion=Z_2)  # -> Geometry, Transform

concat_14 = Concatenate(FragmentA="3.", FragmentB=min_cross_circulation.a)
concat_15 = Concatenate(FragmentA="1.", FragmentB=min_check_in.a)
concat_16 = Concatenate(FragmentA="4.", FragmentB=min_cross_circulation_2.a)
concat_17 = Concatenate(FragmentA="2.", FragmentB=item_10)
config_summariser = Concatenate(Min_Counters=concat_15, Min_Walk=concat_17, Min_Cross_Space=concat_14, Min_Space_Behind_Queue=concat_16)

concat_18 = Concatenate(FragmentA="Total designed check in area is ", FragmentB=roundf_4.Rounded, FragmentC=panel_15)

concat_19 = Concatenate(FragmentA="1.", FragmentB=min_counters.a, FragmentC=" in the layout")
concat_20 = Concatenate(FragmentA="2.", FragmentB=min_circulation_space.a)
concat_21 = Concatenate(FragmentA="3.", FragmentB=min_circulation_space.a)
config_summariser_2 = Concatenate(Min_Counters=concat_19, Min_Cross_Space=concat_20)

tag = TextTag3D(Location=furniture_blocks_2, Text=concat_10, Size=2, Colour=ColourSwatch(SwatchColor=RGB(0, 0, 0)), Justification=7)
iata_los_summary = Concatenate(LoS_Provided=concat_9, Min_Cross_Space=concat_18)
c_print_3 = ContextPrint(LoSSummary=iata_los_summary)
filter_8 = StreamFilter(Gate=orientation_of_check_in_counters, Stream0=config_summariser, Stream1=config_summariser_2)
txt = Text(flatten(filter_8))

# ----
# Summary:
# Metrics:
panel_22 = Panel(merge_4)
# Suggested Improvements:
panel_23 = Panel(txt)
panel_24 = Panel(iata_los_summary)

c_print_4 = ContextPrint(SuggestedLayoutImprovements=txt)

# ---- group: Check In Area
c_bake_9 = ContextBake(CheckIn_BoundingBox_179_57_26=flatten(boundary_2))

# ---- group: Check In Zone Texts
c_bake_10 = ContextBake(Zone_225_231_254=flatten(move_9.Geometry))
